# Grasshopper definition ProgressiveFailureAnalysis_ForceTransfer.gh (Grasshopper 1.0.7)
# plug-ins: LunchBox, Pufferfish, Pancake, Anemone, MeshEdit Components, MetaHopper, eleFront, TT Toolbox

# ----
# Progressive failure analysis with force transfer
# Author: Jessica Ka Yi Chiu
# This script reads the blocks and joints (OBJ) of all valid blocks exported from RocSlope, and implemented limit equilibrium FS calculation that enable force transfer and joint water pressure.
# Colour code:
# User input
# PROCESS 0: GEOMETRY DATA INPUT & VISUALISATION
# 0-1. Read Block Information CSV
# 0-2. Read Blocks and Joints OBJ
# Block ID in Rhino/Grasshopper will start from 0.
# Optional 0-3. View all non-free joints, block IDs and joint IDs
# The {block ID} and joint ID should match with each others
block_information_csv = FilePath()
blocks_obj_file_path = FilePath()
blocks_joints_obj_file_path = FilePath()
view_all_non_free_joints_block_id_and_jo = BooleanToggle(False)  # "View ALL non-free joints, block ID and joint ID?"
view_individual_block_id_and_joint_id = BooleanToggle(False)
block_id_follows_rhino_grasshopper = Panel("0")
# Pre-defined values
# Results
block_information_file_path = Panel(block_information_csv)
blocks_joints_obj_file_path_2 = Panel(blocks_joints_obj_file_path)
# For developer:
# Referenced clusters
blocks_obj_file_path_2 = Panel(blocks_obj_file_path)

# ----
# PROCESS 2: LIMIT EQUILIBRIUM CALCUATION
# Click the buttons one-by-one from top to bottom. After step 2-5, skip step 2-0, increase the iteration ID by 1 in step 2-1, and so on.
optional_2_0_reset_iteration_id = Button()
_2_1_iteration_id = ValueList({"0", "1", "2", "3", "4", "5", "6", "7", "8", "9"}, selected="7")
optional_2_6_view_force_transfer = BooleanToggle(False)

_2_5_write_input_info_and_results_to_exc = Button()  # "2-5. Write input info and results to Excel"
excel_file_path = Panel("")

# ----
# 0-1
block_information_csv_2 = FilePath(block_information_csv)
read_file = ReadFile(File=block_information_csv_2, PerLineParse=True)
read_csv = ReadCSV(CSVString=read_file, Delimiter=",")  # -> Headers, Values
panel = Panel(read_csv.Values)
panel_2 = Panel(read_csv.Headers)

# ---- group: Only useful for calculation of shotcrete shear resistance
assummed_vertical_slope_surface = Panel("90")
arbitrary_number = Panel("100")

arbitrary_number_2 = Panel("100")
assummed_vertical_slope_surface_2 = Panel("90")

# ---- group: Write to Excel / Reset Iteration ID
get_selected_objects = GetSelectedObjects(AllObjects_Object=_2_1_iteration_id)  # -> ComponentObjects, ParamObjects, OtherObjects
stream_filter = StreamFilter(Gate=optional_2_0_reset_iteration_id, Stream1=get_selected_objects.ParamObjects)
set_object_value = SetObjectValue(ObjectToSet=stream_filter, ValueToSet="0")

# ---- group: Block status visulisation / Failed/Sliding
colour_picker = ColourPicker(PickedColour=RGBA(255, 0, 86, 120))

# ---- group: Block status visulisation / Stable
colour_picker_2 = ColourPicker(PickedColour=RGBA(249, 138, 0, 120))

# ---- group: Block status visulisation / Removed
colour_picker_3 = ColourPicker(PickedColour=RGBA(50, 50, 50, 0))

# ----
# 2-6
# 
# Visualisation for Figure_ForceTransfer
# To export figure:
# 1. "Open C:\Users\KYC\OneDrive - NGI\Documents\PhD\Data\Data processing\Larvik\Rhino\Larvik_Rhino_ProgressiveFailure_FOS_SetView.3dm."
# 2. Print Layout "Figure_ForceTransfer" as JPG
# - 300 dpi (High Quality)
# - Scale = 1:1
# - Linetype: Match viewport display
hide_show_object_preview = HideShowObjectPreview(
    Visible=optional_2_6_view_force_transfer,
    AllObjects_Object=[custom_preview_3, vector_display_ex, custom_preview_4, vector_display_ex_2, custom_preview_5, custom_preview_2])

# ----
# PROCESS 3: VISUALISATION OF FAILURE SEQUENCE
# copy the list from  tab "Failure sequence" in the Excel file saved in step 2-5
_3_0_view_failure_sequence = BooleanToggle(False)
maximum_failure_iteration_number = Panel("8")
failed_blocks_id_use_as_separator = Panel("""4;35
0
12
17;23;37
10
5
6;11""")

_2_2_read_removed_blocks_from_excel = TrueOnlyButton(LastSaveLocalization="neutral,N")

_2_3_calculate_force_transfer = Button()

_2_4_calculate_fos_with_force_transfer = Button()

# ----
# PROCESS 1: GROUND CONDITIONS INPUT
cohesion_mpa_without_partial_factor = Panel("0")
joint_friction_angle_deg_without_partial = Panel("44.6")  # "Joint Friction Angle (deg) (without Partial Factor)"
unit_weight_mn_m3 = Panel("0.0279")
force_transfer = Slider(0.5, range=0..1)
groundwater_level = Slider(0.2, range=0..1)
apply_1_25_material_partial_factor = BooleanToggle(False)
view_groundwater_level = BooleanToggle(True)

# ----
# 1
phi = Number(joint_friction_angle_deg_without_partial)
c = Number(cohesion_mpa_without_partial_factor)
unit_weight = Number(unit_weight_mn_m3)
number = Number(force_transfer)
apply_material_partial_factor = ApplyMaterialPartialFactor(c_1=c, phi_1=phi)  # -> c_1_4, phi_1_4, phi_1_r_4, c_2_4, phi_2_4, phi_2_r_4
stream_filter_2 = StreamFilter(Gate=apply_1_25_material_partial_factor, Stream0=phi, Stream1=apply_material_partial_factor.phi_1_4)
stream_filter_3 = StreamFilter(Gate=apply_1_25_material_partial_factor, Stream0=c, Stream1=apply_material_partial_factor.c_1_4)
phi_2 = Number(stream_filter_2)
c_2 = Number(stream_filter_3)

cohesion_mpa_to_be_used = Panel(c_2)
friction_angle_deg_to_be_used = Panel(phi_2)

# ---- group: Groundwater level
number_2 = Number(groundwater_level)
hide_show_object_preview_2 = HideShowObjectPreview(Visible=view_groundwater_level, AllObjects_Object=gw_brep)

# ---- group: Write input parametes to Excel
panel_3 = Panel("""c
phi
FT
GW""")
entwine = Entwine(Branch00=c_2, Branch01=phi_2, Branch02=number, Branch03=number_2, FlattenInputs=True)
excel_write = ExcelWrite(
    WriteExcelData=_2_5_write_input_info_and_results_to_exc,
    WorkbookPath=excel_file_path,
    WorksheetName="input",
    ColumnHeadings=panel_3,
    Data=entwine,
    ClearSheet=invert(False))

# ---- group: Block FS based on documentation in RocSlope
xy_plane = XYPlane(Origin=Point(0, 0, 0))
polygon = Polygon(Plane=xy_plane, Radius="1", Segments="3", FilletRadius=0)  # -> Polygon, Length
panel_4 = Panel(unit_weight)
unit_z = UnitZ(Factor="0")

# ---- group: Out-of-balance force (MN)
panel_5 = Panel("0")

# ----
# 0-2
blocks_joints_obj_file_path_3 = FilePath(blocks_joints_obj_file_path)
blocks_obj_file_path_3 = FilePath(blocks_obj_file_path)
import_obj = ImportOBJ(File=blocks_obj_file_path_3, MapYtoZ=False, LastSaveLocalization="neutral,N")
import_obj_2 = ImportOBJ(File=blocks_joints_obj_file_path_3, MapYtoZ=False, LastSaveLocalization="neutral,N")

# ---- group: Sort geometry based on numberical keys
list_indices = ListIndices(List=import_obj)
sort_text = SortText(Keys=list_indices, Values=list_indices, Culture=127)  # -> Keys, Values

list_indices_2 = ListIndices(List=import_obj_2)
sort_text_2 = SortText(Keys=list_indices_2, Values=list_indices_2, Culture=127)  # -> Keys, Values

# ----
replace_items = ReplaceItems(List=import_obj_2, Item=import_obj_2, Indices=sort_text_2.Values, Wrap=False)
replace_items_2 = ReplaceItems(List=import_obj, Item=import_obj, Indices=sort_text.Values, Wrap=False)
object_id_sorted_blocks_obj = Geometry(replace_items_2)
list_indices_3 = ListIndices(List=object_id_sorted_blocks_obj)
object_id_sorted_joints_obj = Geometry(replace_items)
object_id = Integer(list_indices_3)
block_mesh = Mesh(object_id_sorted_blocks_obj)

# ---- group: Groundwater level (continued)
bounding_box = BoundingBox(Content=block_mesh, Plane=PlaneXY(0, 0, 0), UnionBox=True)  # -> Box, Box_2
evaluate_box = EvaluateBox(Box=bounding_box.Box, UParameter=0.5, VParameter=0.5, WParameter=number_2)  # -> Plane, Point, Include
bounding_rectangle = BoundingRectangle(Geometry=bounding_box.Box, Plane=PlaneXY(0, 0, 0), Axis=0, Slide=number_2, Union=True)  # -> Bounding, DimensionX, DimensionY
gw_brep = Brep(bounding_rectangle.Bounding)

# ----
# CREATE JOINT BREP
mesh_to_polysurface = MeshToPolysurface(Mesh=object_id_sorted_joints_obj, Triangles=False, FaceMerge=invert(False))
deconstruct_brep = DeconstructBrep(Brep=mesh_to_polysurface)  # -> Faces, Edges, Vertices
joint_brep_tree = Brep(simplify(deconstruct_brep.Faces))

# ---- group: Block ID / Block ID visualisation
volume = Volume(Geometry=block_mesh)  # -> Volume, Centroid
concatenate = Concatenate(FragmentA="Block", FragmentB=object_id)
panel_6 = Panel("Black")
text_tag = TextTag(Location=volume.Centroid, Text=object_id, Colour=panel_6)

# ---- group: Block ID / Joint ID visualisation
tree_statistics = TreeStatistics(Tree=joint_brep_tree)  # -> Paths, Length, Count
list_indices_4 = ListIndices(List=joint_brep_tree)  # -> flatten(Indices)
duplicate_data = DuplicateData(Data=graft(tree_statistics.Paths), Number=graft(tree_statistics.Length), Order=True)  # -> flatten(Data)
pull_point = PullPoint(Point=simplify(graft(volume.Centroid)), Geometry=joint_brep_tree, ClosestOnly=False)  # -> flatten(ClosestPoint), Distance
concatenate_2 = Concatenate(FragmentA=duplicate_data, FragmentB=list_indices_4)
text_tag_2 = TextTag(Location=pull_point.ClosestPoint, Text=concatenate_2, Colour="White")

# ---- group: Block ID
# 0-3
hide_show_object_preview_3 = HideShowObjectPreview(Visible=view_all_non_free_joints_block_id_and_jo, AllObjects_Object=[joint_brep_tree, text_tag_2, text_tag])
block_id = Integer(block_id_follows_rhino_grasshopper)
list_item = ListItem(List=concatenate, Index=block_id, Wrap=True)
hide_show_object_preview_4 = HideShowObjectPreview(Visible=view_individual_block_id_and_joint_id, AllObjects_Object=[text_tag_4, text_tag_3, custom_preview])

# ---- group: Block ID / INDIVIDUAL Joint ID visualisation
create_tree = CreateTree(Data=pull_point.ClosestPoint, Path=concatenate_2)
create_tree_2 = CreateTree(Data=concatenate_2, Path=concatenate_2)
tree_branch = TreeBranch(Tree=create_tree, Path=block_id, MaintainPaths=True)
tree_branch_2 = TreeBranch(Tree=create_tree_2, Path=block_id, MaintainPaths=True)
text_tag_3 = TextTag(Location=tree_branch, Text=tree_branch_2, Colour=panel_6)

# ---- group: Block ID / INDIVIDUAL joint visualistion
tree_branch_3 = TreeBranch(Tree=joint_brep_tree, Path=block_id, MaintainPaths=True)
custom_preview = CustomPreview(Geometry=tree_branch_3, Material="Yellow")

# ---- group: Block ID / INDIVIDUAL Block ID visualisation
list_item_2 = ListItem(List=volume.Centroid, Index=block_id, Wrap=True)
text_tag_4 = TextTag(Location=list_item_2, Text=list_item, Colour=panel_6)

# ---- group: All joint brep outlines
custom_preview_2 = CustomPreview(Geometry=joint_brep_tree, Material=colour_picker_3)

# ----
# REMOVE BLOCKS DURING PROGRESSIVE FAILURE
block_mesh_2 = Mesh(flatten(object_id_sorted_blocks_obj))
joint_brep_tree_2 = Brep(simplify(joint_brep_tree))

# ----
# Joint breps at intersections
int_joint_breps_at_intersections = IntJointBrepsAtIntersections(block_mesh_list=block_mesh_2, joint_brep_tree=joint_brep_tree_2)  # -> int_1_splitted_joint_brep_tree_2, int_2_joint_brep_id_for_splitted_joint_b_2, int_3_own_adjacent_block_id_for_splitted_2

# ---- group: Get Block BREP and volume
block_mesh_3 = Mesh(block_mesh_2)
mesh_to_polysurface_2 = MeshToPolysurface(Mesh=block_mesh_3, Triangles=False, FaceMerge=False)
mesh_volume = MeshVolume(Mesh=block_mesh_3)  # -> Volume, Centroid

# ---- group: Loop over the list of blocks
last_index = LastIndex(List=object_id)
loop_start = LoopStart(Repeat=last_index, Trigger=_2_3_calculate_force_transfer)  # -> port, Counter, Data

# ----
ft_counter = Panel(loop_start.Counter)

# ---- group: Get Block BREP and volume (continued)
list_item_3 = ListItem(List=mesh_to_polysurface_2, Index=loop_start.Counter, Wrap=True)
list_item_4 = ListItem(List=mesh_volume.Volume, Index=loop_start.Counter, Wrap=True)

# ----
panel_7 = Panel(int_joint_breps_at_intersections.int_2_joint_brep_id_for_splitted_joint_b_2)
panel_8 = Panel(int_joint_breps_at_intersections.int_3_own_adjacent_block_id_for_splitted_2)

# ---- group: Get Block BREP and volume
block_mesh_4 = Mesh(block_mesh_2)
mesh_to_polysurface_3 = MeshToPolysurface(Mesh=block_mesh_4, Triangles=False, FaceMerge=False)
mesh_volume_2 = MeshVolume(Mesh=block_mesh_4)  # -> Volume, Centroid

# ---- group: Loop over the list of blocks
last_index_2 = LastIndex(List=object_id)
loop_start_2 = LoopStart(Repeat=last_index_2, Trigger=_2_4_calculate_fos_with_force_transfer)  # -> port, Counter, Data

# ----
fs_counter = Panel(loop_start_2.Counter)

# ---- group: Get Block BREP and volume (continued)
list_item_5 = ListItem(List=mesh_volume_2.Volume, Index=loop_start_2.Counter, Wrap=True)
list_item_6 = ListItem(List=mesh_to_polysurface_3, Index=loop_start_2.Counter, Wrap=True)

# ----
xy_plane_2 = XYPlane(Origin=Point(0, 0, 0))
polygon_2 = Polygon(Plane=xy_plane_2, Radius="1", Segments="3", FilletRadius=0)  # -> Polygon, Length
panel_9 = Panel(unit_weight)
unit_z_2 = UnitZ(Factor="0")

# ---- group: Write Failure Iteration to Excel
failure_iteration = Integer(_2_1_iteration_id)
addition = Addition(A=failure_iteration, B="1")
panel_10 = Panel(";")
panel_11 = Panel("Failure sequence")
write_options = WriteOptions(
    FilePath=excel_file_path,
    ClearDataOverwrite=invert(True),
    SaveAfterWrite=invert(False),
    CloseAfterWrite=invert(False),
    ColumnStartPosition=1,
    RowStartPosition=addition)  # -> UserMessages, WriteOptions

# ---- group: Read removed blocks from Excel
read_excel_sheet = ReadExcelSheet(Run=_2_2_read_removed_blocks_from_excel, FilePath=excel_file_path, Worksheet=panel_11, Listen=False)  # -> UserMessages, Columns, Rows
tree_branch_4 = TreeBranch(Tree=read_excel_sheet.Columns, Path="2", MaintainPaths=True)
split_list = SplitList(List=tree_branch_4, Index=failure_iteration)  # -> ListA, ListB
text_split = TextSplit(Text=split_list.ListA, Separators=panel_10)  # -> flatten(Result)
panel_12 = Panel(text_split)

# ----
update_failure_order_block_id = Panel(panel_12)

removed_block_id_list = Integer(flatten(update_failure_order_block_id))

# ----
# Remove blocks
rem_block_removal_during_progressive_fai = RemBlockRemovalDuringProgressiveFailure(
    block_mesh=block_mesh_2,
    removed_block_id_list=removed_block_id_list,
    int_3_own_adjacent_block_id_for_splitted=int_joint_breps_at_intersections.int_3_own_adjacent_block_id_for_splitted_2,
    int_1_splitted_joint_brep_tree=int_joint_breps_at_intersections.int_1_splitted_joint_brep_tree_2,
    int_2_joint_brep_id_for_splitted_joint_b=int_joint_breps_at_intersections.int_2_joint_brep_id_for_splitted_joint_b_2)  # -> rem_1_joint_brep_id_for_removed_block_sp_2, rem_2_before_block_removal_joint_id_tree_2, rem_3_removed_block_merged_joint_brep_tr_2, rem_4_removed_block_splitted_joint_breps_2, rem_5_removed_block_adjacent_block_id_fo_2; "Rem: block removal during progressive failure"

# ---- group: Get joint brep
rem_3_removed_block_merged_joint_brep_tr = Brep(simplify(rem_block_removal_during_progressive_fai.rem_3_removed_block_merged_joint_brep_tr_2))  # "Rem-3. Removed block merged joint brep TREE"
tree_branch_5 = TreeBranch(Tree=rem_3_removed_block_merged_joint_brep_tr, Path=loop_start.Counter, MaintainPaths=True)  # -> simplify(graft(Branch))

# ---- group: Block FS based on documentation in RocSlope (continued)
cluster = Cluster_2(
    gamma_r=panel_4,
    joint=tree_branch_5,
    wedge_slope_face_mesh=polygon.Polygon,
    wedge_upper_face_mesh=polygon.Polygon,
    block_brep=list_item_3,
    volume=list_item_4,
    slope_dip=assummed_vertical_slope_surface,
    slope_dip_direction=arbitrary_number,
    c_1=c_2,
    phi_1=phi_2,
    phi_1_r=phi_2,
    k="0",
    e_cap_seismic=unit_z,
    c_i=unit_z,
    water_table_plane_z_upwards=evaluate_box.Plane,
    c_active="0",
    e_cap_bolt_active=unit_z,
    c_passive="0",
    e_cap_bolt_passive=unit_z)  # -> fs_system_2, fs_s_2, fs_c_2, sliding_direction_number_2, sliding_joint_index_2, driving_force_2, resisting_force_2, sliding_direction_unit_vector_2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

# ---- group: Loop over the list of blocks (continued)
entwine_2 = Entwine(
    Branch00=loop_start.Counter,
    Branch01=cluster.fs_system_2,
    Branch02=cluster.sliding_direction_number_2,
    Branch03=cluster.sliding_joint_index_2,
    Branch04=cluster.driving_force_2,
    Branch05=cluster.resisting_force_2,
    Branch06=cluster.sliding_direction_unit_vector_2,
    Branch07=cluster.normal_force_on_joints_mn_2,
    Branch08=cluster.shear_resistance_on_joints_mn_2,
    Branch09=cluster.water_pressure_on_joints_mpa_2,
    Branch010=cluster.if_removable_2,
    Branch011=cluster.if_parallel_joints_2,
    FlattenInputs=True)
loop_end = LoopEnd(port=loop_start.port, Exit=False, Data=entwine_2, TimeOutVal=0, pausedState=False, state="Constant & Record")
trim_tree = TrimTree(Tree=loop_end, Depth=1)
flip_matrix = FlipMatrix(Data=trim_tree)  # -> simplify(Data)
explode_tree = ExplodeTree(Data=flip_matrix)  # -> Branch0, Branch1, Branch2, Branch3, Branch4, Branch5, Branch6, Branch7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

# ---- group: Out-of-balance force (MN) (continued)
resisting_force = Number(explode_tree.Branch5)
driving_force = Number(explode_tree.Branch4)
larger_than = LargerThan(DrivingForce=driving_force, ResistingForce=resisting_force)  # -> LargerThan, OrEqualTo
subtraction = Subtraction(DrivingForce=driving_force, ResistingForce=resisting_force)
multiplication = Multiplication(A=subtraction, B=panel_5)
pick_n_choose = PickNChoose(Pattern=larger_than.LargerThan, Stream0=multiplication, Stream1=subtraction)
out_of_balance_force_mn = Number(pick_n_choose)

# ----
# Sliding direction number:
# 0 = Unconditionally stable
# 1 = Falling or lifting
# 2 = Sliding on more than two joints
# 3 = Sliding on single joint
# 4 = Sliding on joint intersection
object_id_2 = Panel(explode_tree.Branch0)
fs = Panel(explode_tree.Branch1)
sliding_direction_number = Panel(explode_tree.Branch2)
sliding_joint_index = Panel(explode_tree.Branch3)
driving_force_2 = Panel(explode_tree.Branch4)
resisting_force_2 = Panel(explode_tree.Branch5)
sliding_direction_unit_vector = Panel(explode_tree.Branch6)
normal_force_on_joints_mn = Panel(explode_tree.Branch7)
shear_resistance_on_joints_mn = Panel(explode_tree.Branch8)
water_pressure_on_joints_mpa = Panel(explode_tree.Branch9)
if_removable = Panel(explode_tree.Branch10)
if_parallel_joints = Panel(explode_tree.Branch11)

# ---- group: Out-of-balance is lost once the influential block is removed
removed_block_id_list_2 = Integer(flatten(update_failure_order_block_id))
null_item = NullItem(Item=removed_block_id_list_2)  # -> NullFlags, InvalidFlags, Description
replace_items_3 = ReplaceItems(List=out_of_balance_force_mn, Item=panel_5, Indices=removed_block_id_list_2, Wrap=False)
stream_filter_4 = StreamFilter(Gate=null_item.NullFlags, Stream0=replace_items_3, Stream1=out_of_balance_force_mn)
culled_removed_influential_block_out_of = Number(stream_filter_4)  # "Culled removed influential block Out-of-balance force (MN)"

# ---- group: Sliding block force is lost once the influential block is removed
removed_block_id_list_3 = Integer(flatten(removed_block_id_list_2))
null_item_2 = NullItem(Item=removed_block_id_list_3)  # -> NullFlags, InvalidFlags, Description
replace_items_4 = ReplaceItems(List=sliding_joint_index, Item="Null", Indices=removed_block_id_list_3, Wrap=False)
stream_filter_5 = StreamFilter(Gate=null_item_2.NullFlags, Stream0=replace_items_4, Stream1=sliding_joint_index)
culled_influential_removed_block_sliding = Text(stream_filter_5)  # "Culled influential removed block Sliding joint ID TEXT"

# ----
# Force Transfer from Sliding Blocks
force_transfer_from_sliding_block = ForceTransferFromSlidingBlock(
    block_mesh=block_mesh_2,
    rem_3_removed_block_merged_joint_brep_tr=rem_block_removal_during_progressive_fai.rem_3_removed_block_merged_joint_brep_tr_2,
    rem_2_before_block_removal_joint_id_tree=rem_block_removal_during_progressive_fai.rem_2_before_block_removal_joint_id_tree_2,
    rem_1_joint_brep_id_for_removed_block_sp=rem_block_removal_during_progressive_fai.rem_1_joint_brep_id_for_removed_block_sp_2,
    rem_4_removed_block_splitted_joint_breps=rem_block_removal_during_progressive_fai.rem_4_removed_block_splitted_joint_breps_2,
    rem_5_removed_block_adjacent_block_id_fo=rem_block_removal_during_progressive_fai.rem_5_removed_block_adjacent_block_id_fo_2,
    sliding_joint_id_text=culled_influential_removed_block_sliding,
    normal_force_text=normal_force_on_joints_mn,
    shear_resistance_text=shear_resistance_on_joints_mn,
    sliding_direction_unit_vector=sliding_direction_unit_vector,
    groundwater_level_plane=evaluate_box.Plane)  # -> influential_adjacent_block_id_tree_2, transferred_force_vector_list_2, force_transfer_from_sliding_block_vector_3, force_transfer_from_sliding_block_vector_4, projected_joint_brep_tree_2

# ----
# Force Transfer from later batches (Modified from Fu & Ma 2014)
force_transfer_from_later_batch = ForceTransferFromLaterBatch(
    block_mesh_list=block_mesh_2,
    sliding_direction_unit_vector_list=sliding_direction_unit_vector,
    out_of_balance_force_mn_list=culled_removed_influential_block_out_of,
    int_1_splitted_joint_brep_tree=int_joint_breps_at_intersections.int_1_splitted_joint_brep_tree_2,
    int_3_own_adjacent_block_id_for_splitted=int_joint_breps_at_intersections.int_3_own_adjacent_block_id_for_splitted_2,
    groundwater_level_plane=evaluate_box.Plane)  # -> filtered_adjacent_block_ids_tree_2, transferred_force_vector_list_2, out_of_balance_force_vector_anchor_tree_2, out_of_balance_force_vector_tree_2, projected_joint_brep_tree_2

# ----
# FORCE TRANSFER
# Input as c_i for FOS calculation, multiplied by %
multiplication_2 = Multiplication(A=number, B=force_transfer_from_sliding_block.force_transfer_from_sliding_block_vector_4)
multiplication_3 = Multiplication(A=number, B=force_transfer_from_sliding_block.transferred_force_vector_list_2)
multiplication_4 = Multiplication(A=number, B=force_transfer_from_later_batch.transferred_force_vector_list_2)
multiplication_5 = Multiplication(A=number, B=force_transfer_from_later_batch.out_of_balance_force_vector_tree_2)
addition_2 = Addition(A=multiplication_4, B=multiplication_3)
transferred_force_vector_list = Vector(addition_2)

# ----
# 2-3
# CALCULATE FACTOR OF SAFETY
# FOR MODIFIED PROGRESSIVE FAILURE
# (WITHOUT FORCE TRANSFER)
panel_13 = Panel(cluster.fs_system_2)
panel_14 = Panel(loop_end)

total_transferred_force_vector_list_mult = Panel(transferred_force_vector_list)  # "Total Transferred force vector LIST (multiplied by %)"
later_batches_transferred_force_vector_l = Panel(multiplication_4)  # "Later batches: Transferred force vector LIST (multiplied by %)"
sliding_blocks_transferred_force_vector = Panel(multiplication_3)  # "Sliding blocks: Transferred force vector LIST (multiplied by %)"
fs_without_force_transfer = Panel(fs)

# ---- group: Get joint brep
rem_3_removed_block_merged_joint_brep_tr_2 = Brep(simplify(rem_block_removal_during_progressive_fai.rem_3_removed_block_merged_joint_brep_tr_2))  # "Rem-3. Removed block merged joint brep TREE"
tree_branch_6 = TreeBranch(Tree=rem_3_removed_block_merged_joint_brep_tr_2, Path=loop_start_2.Counter, MaintainPaths=True)  # -> simplify(graft(Branch))

# ----
# 2-4
# 
# APPLY FORCE TRANSFER
# 
# CALCULATE FACTOR OF SAFETY
# FOR MODIFIED PROGRESSIVE FAILURE
list_item_7 = ListItem(List=transferred_force_vector_list, Index=loop_start_2.Counter, Wrap=True)

cluster_2 = Cluster_2(
    gamma_r=panel_9,
    joint=tree_branch_6,
    wedge_slope_face_mesh=polygon_2.Polygon,
    wedge_upper_face_mesh=polygon_2.Polygon,
    block_brep=list_item_6,
    volume=list_item_5,
    slope_dip=assummed_vertical_slope_surface_2,
    slope_dip_direction=arbitrary_number_2,
    c_1=c_2,
    phi_1=phi_2,
    phi_1_r=phi_2,
    k="0",
    e_cap_seismic=unit_z_2,
    c_i=list_item_7,
    water_table_plane_z_upwards=evaluate_box.Plane,
    c_active="0",
    e_cap_bolt_active=unit_z_2,
    c_passive="0",
    e_cap_bolt_passive=unit_z_2)  # -> fs_system_2, fs_s_2, fs_c_2, sliding_direction_number_2, sliding_joint_index_2, driving_force_2, resisting_force_2, sliding_direction_unit_vector_2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
panel_15 = Panel(cluster_2.fs_system_2)

# ---- group: Loop over the list of blocks (continued)
entwine_3 = Entwine(
    Branch00=loop_start_2.Counter,
    Branch01=cluster_2.fs_system_2,
    Branch02=cluster_2.sliding_direction_number_2,
    Branch03=cluster_2.sliding_joint_index_2,
    Branch04=cluster_2.driving_force_2,
    Branch05=cluster_2.resisting_force_2,
    Branch06=cluster_2.sliding_direction_unit_vector_2,
    Branch07=cluster_2.if_removable_2,
    Branch08=cluster_2.if_parallel_joints_2,
    FlattenInputs=True)
loop_end_2 = LoopEnd(port=loop_start_2.port, Exit=False, Data=entwine_3, TimeOutVal=0, pausedState=False, state="Constant & Record")
trim_tree_2 = TrimTree(Tree=loop_end_2, Depth=1)
flip_matrix_2 = FlipMatrix(Data=trim_tree_2)  # -> simplify(Data)
explode_tree_2 = ExplodeTree(Data=flip_matrix_2)  # -> Branch0, Branch1, Branch2, Branch3, Branch4, Branch5, Branch6, Branch7, Branch8

# ----
# 2-1; 2-2; 2-5
# 
# Write Results to Excel
# Read removed block list from Excel
removed_block_id_list_4 = Integer(flatten(update_failure_order_block_id))

# ---- group: Sliding block FT
influential_block_id = Panel(force_transfer_from_sliding_block.influential_adjacent_block_id_tree_2)
sliding_force_vector = Panel(multiplication_2)
concatenate_3 = Concatenate(FragmentA=influential_block_id, FragmentA_2=":", FragmentB=sliding_force_vector)
text_join = TextJoin(Text=concatenate_3, Join=";")
sliding_block_ft = Panel(text_join)

# ---- group: Consturct out-of-balance force vector string
out_of_balance_force_vector = Panel(multiplication_5)
influential_block_id_2 = Panel(force_transfer_from_later_batch.filtered_adjacent_block_ids_tree_2)
concatenate_4 = Concatenate(FragmentA=influential_block_id_2, FragmentA_2=":", FragmentB=out_of_balance_force_vector)
text_join_2 = TextJoin(Text=concatenate_4, Join=";")
later_block_ft = Panel(text_join_2)

# ---- group: Out-of-balance force vector and projected joint brep
vector_display_ex = VectorDisplayEx(
    Point=force_transfer_from_later_batch.out_of_balance_force_vector_anchor_tree_2,
    Vector=multiplication_5,
    Colour="Blue",
    Width=2)
custom_preview_3 = CustomPreview(Geometry=force_transfer_from_later_batch.projected_joint_brep_tree_2, Material="Blue")

# ---- group: Sliding block force vector and projected joint brep
vector_display_ex_2 = VectorDisplayEx(
    Point=force_transfer_from_sliding_block.force_transfer_from_sliding_block_vector_3,
    Vector=multiplication_2,
    Colour="Green",
    Width=2)
custom_preview_4 = CustomPreview(Geometry=force_transfer_from_sliding_block.projected_joint_brep_tree_2, Material="Green")

# ----
# Sliding direction number:
# 0 = Unconditionally stable
# 1 = Falling or lifting
# 2 = Sliding on more than two joints
# 3 = Sliding on single joint
# 4 = Sliding on joint intersection
object_id_3 = Panel(explode_tree_2.Branch0)
fs_2 = Panel(explode_tree_2.Branch1)
sliding_direction_number_2 = Panel(explode_tree_2.Branch2)
sliding_joint_index_2 = Panel(explode_tree_2.Branch3)
driving_force_3 = Panel(explode_tree_2.Branch4)
resisting_force_3 = Panel(explode_tree_2.Branch5)
sliding_direction_unit_vector_2 = Panel(explode_tree_2.Branch6)
if_removable_2 = Panel(explode_tree_2.Branch7)
if_parallel_joints_2 = Panel(explode_tree_2.Branch8)

# ---- group: Get sliding block ID (with FT)
removed_block_id_list_5 = Integer(flatten(update_failure_order_block_id))
smaller_than = SmallerThan(FirstNumber=fs_2, SecondNumber="1")  # -> SmallerThan, OrEqualTo
list_indices_5 = ListIndices(List=fs_2)
replace_items_5 = ReplaceItems(List=smaller_than.SmallerThan, Item="False", Indices=removed_block_id_list_5, Wrap=False)
cull_pattern = CullPattern(List=list_indices_5, CullPattern=replace_items_5)
fs_with_ft_1 = Panel(cull_pattern)

# ---- group: click button in 2-2 to append this list to the green box "Update failure order"
fs_with_fs_1 = Panel(fs_with_ft_1)

# ---- group: Calculate trend and plunge from unit vector
vector = Vector(unitize(sliding_direction_unit_vector_2))
ghpython_script = GhPythonScript(vector=vector)  # -> out, trend, plunge; inputs vector: list of Vector3d
# ---------- ghpython_script: Python ----------
import math

def unit_vector_to_trend_plunge(vector):
    if vector is None:
        return None, None

    # Calculate plunge (angle with the horizontal plane)
    plunge = -math.degrees(math.asin(vector[2])) # positive downwards

    # Calculate trend (azimuth of the horizontal projection)
    trend = 90 - math.degrees(math.atan2(vector[1], vector[0]))
    if vector[0]==vector[1]==0:
        trend = 0
    if trend < 0:
        trend += 360

    return trend, plunge

def process_vectors(vectors):
    trends = []
    plunges = []
    for vector in vectors:
        trend, plunge = unit_vector_to_trend_plunge(vector)
        trends.append(trend)
        plunges.append(plunge)
    return trends, plunges

# Grasshopper inputs
vectors = vector  # Assuming 'vector' is the input list of vectors

# Process the vectors
trend, plunge = process_vectors(vectors)
# ---------- end ghpython_script ----------

# ----
trend = Panel(ghpython_script.trend)
plunge = Panel(ghpython_script.plunge)

# ---- group: Determine block status
text_length = TextLength(Text=removed_block_id_list_4)
mass_addition = MassAddition(Input=text_length)  # -> flatten(Result), PartialResults
boolean = Boolean(mass_addition.Result)
list_length = ListLength(List=object_id_2)
list_length_2 = ListLength(List=fs_with_ft_1)
list_length_3 = ListLength(List=removed_block_id_list_4)
duplicate_data_2 = DuplicateData(Data="Stable", Number=list_length, Order=True)  # -> simplify(graft(Data))
multiplication_6 = Multiplication(A=list_length_3, B=boolean)
duplicate_data_3 = DuplicateData(Data="Sliding", Number=list_length_2, Order=True)
duplicate_data_4 = DuplicateData(Data="Removed", Number=multiplication_6, Order=True)
create_tree_3 = CreateTree(Data=duplicate_data_3, Path=fs_with_ft_1, Ensure=object_id_2)
create_tree_4 = CreateTree(Data=duplicate_data_4, Path=removed_block_id_list_4, Ensure=object_id_2)
merge = Merge(Data1=duplicate_data_2, Data2=create_tree_3, Data3=create_tree_4)
list_item_8 = ListItem(List=merge, Index="-1", Wrap=True)
panel_16 = Panel(list_item_8)

# ---- group: Write to Excel
failure_iteration_2 = Integer(_2_1_iteration_id)
panel_17 = Panel("""ID
FS without FT
Sliding direction number without FT	
Later batch FT
Sliding block FT	
Total force transfer vector
FS with FT
Sliding direction number with FT
Status""")
concatenate_5 = Concatenate(FragmentA="Iteration ", FragmentB=failure_iteration_2)
entwine_4 = Entwine(
    Branch00=object_id_2,
    Branch01=fs_without_force_transfer,
    Branch02=sliding_direction_number,
    Branch03=later_block_ft,
    Branch04=sliding_block_ft,
    Branch05=total_transferred_force_vector_list_mult,
    Branch06=fs_2,
    Branch07=sliding_direction_number_2,
    Branch08=list_item_8,
    FlattenInputs=True)
panel_18 = Panel(concatenate_5)
excel_write_2 = ExcelWrite(
    WriteExcelData=_2_5_write_input_info_and_results_to_exc,
    WorkbookPath=excel_file_path,
    WorksheetName=panel_18,
    ColumnHeadings=panel_17,
    Data=entwine_4,
    ClearSheet=invert(False))

# ---- group: Write Failure Iteration to Excel (continued)
text_join_3 = TextJoin(Text=fs_with_ft_1, Join=panel_10)
entwine_5 = Entwine(Branch00=addition, Branch01=text_join_3, FlattenInputs=True)
write_to_excel = WriteToExcel(
    Run=_2_5_write_input_info_and_results_to_exc,
    ExcelWorksheet=panel_11,
    WriteOptions=write_options.WriteOptions,
    ColumnnsOrRows=invert(True),
    DataToWriteIntoColumns=entwine_5)

# ---- group: Block status visulisation
panel_19 = Panel("""Stable
Sliding
Removed""")
list_indices_6 = ListIndices(List=panel_19)
match_text = MatchText(Text=panel_19, Pattern=list_item_8, Case=True)
cull_pattern_2 = CullPattern(List=list_indices_6, CullPattern=match_text)
pick_n_choose_2 = PickNChoose(Pattern=cull_pattern_2, Stream0=colour_picker_2, Stream1=colour_picker, Stream2=colour_picker_3)
custom_preview_5 = CustomPreview(Geometry=joint_brep_tree, Material=pick_n_choose_2)

# ---- group: Block ID
viewport_plane = Plane(Plane(origin=(416.639915, 462.669719, 68.52314229), x=(0.5090523488, 0.8607355611, 0), y=(-0.1034087628, 0.06115754476, 0.9927569604)))
pick_n_choose_3 = PickNChoose(Pattern=cull_pattern_2, Stream0="Black", Stream1="Black", Stream2="Gray")  # -> flatten(Result)
plane_origin = PlaneOrigin(Base=viewport_plane, Origin=volume.Centroid)
text_tag_3d = TextTag3D(Location=plane_origin, Text=object_id, Size=Slider(0.8, range=0..10), Colour=pick_n_choose_3, Justification=5)

# ----
# 2-7
# 
# Visualisation for Failure Sequence
# To export figure:
# 1. "Open C:\Users\KYC\OneDrive - NGI\Documents\PhD\Data\Data processing\Larvik\Rhino\Larvik_Rhino_ProgressiveFailure_FOS_SetView.3dm."
# 2. Print Layout "Figure_FailureSequence" as JPG
# - 300 dpi (High Quality)
# - Scale = 1:1
# - Linetype: Match viewport display
maximum_failure_iteration_number_2 = Integer(maximum_failure_iteration_number)
subtraction_2 = Subtraction(A=maximum_failure_iteration_number_2, B="1")
construct_domain = ConstructDomain(DomainStart="1", DomainEnd=maximum_failure_iteration_number_2)
range = Range(Domain=construct_domain, Steps=subtraction_2)
integer = Integer(range)
concatenate_6 = Concatenate(FragmentA="Iteration ", FragmentB=integer)
failed_blocks_id_list = Text(failed_blocks_id_use_as_separator)
list_indices_7 = ListIndices(List=failed_blocks_id_list)
colour_picker_4 = ColourPicker(PickedColour=RGBA(0, 0, 0, 0))
colour_picker_5 = ColourPicker(PickedColour=RGB(128, 128, 128))
text_split_2 = TextSplit(Text=failed_blocks_id_list, Separators=";")  # -> simplify(Result)
cull_index = CullIndex(List=block_mesh_3, Indices=flatten(text_split_2), Wrap=True)
list_item_9 = ListItem(List=block_mesh_3, Index=text_split_2, Wrap=True)
hide_show_object_preview_5 = HideShowObjectPreview(Visible=_3_0_view_failure_sequence, AllObjects_Object=[custom_preview_7, custom_preview_6])
custom_preview_6 = CustomPreview(Geometry=cull_index, Material=colour_picker_4)

domain_end = Slider(60, range=0..100)
domain_start = Slider(10, range=0..100)

construct_domain_2 = ConstructDomain(DomainStart=domain_start, DomainEnd=domain_end)
range_2 = Range(Domain=construct_domain_2, Steps=subtraction_2)

gradient = Gradient(
    LowerLimit=domain_start,
    UpperLimit=domain_end,
    Parameter=range_2,
    stops=[0: RGB(221, 33, 125), 0.25: RGB(255, 95, 0), 0.5: RGB(255, 176, 13), 0.75: RGB(91, 142, 253), 1: RGB(114, 93, 239)])

legend = Legend(Colour=gradient, Legend=concatenate_6, LegendType=1)

panel_20 = Panel(gradient)
concatenate_7 = Concatenate(Fragment_A=gradient, Fragment_B="(", A=Slider(255, range=0..255), B=")")
list_item_10 = ListItem(List=concatenate_7, Index=list_indices_7, Wrap=True)

# ----
# Visualise iteration order with rainbow color
custom_preview_7 = CustomPreview(Geometry=list_item_9, Material=simplify(graft(list_item_10)))

# ==== cluster ForceTransferFromLaterBatch
sliding_direction_unit_vector_list = ClusterInput()
out_of_balance_force_mn_list = ClusterInput()
block_mesh_list = ClusterInput()
int_1_splitted_joint_brep_tree = ClusterInput()
int_3_own_adjacent_block_id_for_splitted = ClusterInput()  # "Int-3. Own & adjacent block ID for Splitted joint brep TREE"
groundwater_level_plane = ClusterInput()
groundwater_level_plane_2 = Plane(groundwater_level_plane)

# ---- group: Get contacting joints and blocks
int_1_splitted_joint_brep_tree_2 = Brep(int_1_splitted_joint_brep_tree)
int_3_own_adjacent_block_id_for_splitted_2 = Integer(int_3_own_adjacent_block_id_for_splitted)  # "Int-3. Own & adjacent block ID for Splitted joint brep TREE"
# FORCE TRASNSFER
block_mesh_list_2 = Mesh(block_mesh_list)
tree_statistics = TreeStatistics(Tree=int_3_own_adjacent_block_id_for_splitted_2)  # -> Paths, Length, Count
deconstruct_path = DeconstructPath(Branch=tree_statistics.Paths)
equality = Equality(FirstNumber=int_3_own_adjacent_block_id_for_splitted_2, SecondNumber=simplify(deconstruct_path))  # -> Equality, Inequality
cull_pattern = CullPattern(List=int_1_splitted_joint_brep_tree_2, CullPattern=equality.Inequality)
cull_pattern_2 = CullPattern(List=int_3_own_adjacent_block_id_for_splitted_2, CullPattern=equality.Inequality)

# ---- group: Get out-of-balance force vector from adjacent blocks into data tree
adjacent_block_id_for_splitted_joint_bre = Integer(cull_pattern_2)  # "Adjacent block ID for Splitted joint breps at intersections TREE"
sliding_direction_unit_vector_list_2 = Vector(sliding_direction_unit_vector_list)
out_of_balance_force_mn_list_2 = Number(out_of_balance_force_mn_list)
amplitude = Amplitude(Vector=sliding_direction_unit_vector_list_2, Amplitude=out_of_balance_force_mn_list_2)
out_of_balance_force_vectors_list = Vector(amplitude)
list_item = ListItem(List=out_of_balance_force_vectors_list, Index=adjacent_block_id_for_splitted_joint_bre, Wrap=True)
all_adjacent_block_out_of_balance_force = Vector(list_item)  # "ALL Adjacent block out-of-balance force vector TREE"

# ----
panel = Panel(out_of_balance_force_mn_list_2)

# ---- group: Block
# Visualise out-of-balance force vector from all blocks
area = Area(Geometry=block_mesh_list_2)  # -> Area, Centroid

# ---- group: Out-of-balance force vectors
vector_display = VectorDisplay(Anchor=area.Centroid, Vector=out_of_balance_force_vectors_list)

# ----
# Get joint planes at intersections with normals pointing inwards for each block
splitted_joint_breps_at_intersections = Brep(cull_pattern)
mesh_volume = MeshVolume(Mesh=block_mesh_list_2)  # -> Volume, Centroid
is_planar = IsPlanar(Surface=splitted_joint_breps_at_intersections, Interior=True)  # -> Planar, Plane
deconstruct_plane = DeconstructPlane(Plane=is_planar.Plane)  # -> Origin, XAxis, YAxis, ZAxis
reverse = Reverse(Vector=deconstruct_plane.ZAxis)

# ---- group: Joint brep centres
area_2 = Area(Geometry=splitted_joint_breps_at_intersections)  # -> Area, Centroid

# ---- group: Create same data tree structure as joint breps at intersections
tree_statistics_2 = TreeStatistics(Tree=area_2.Centroid)  # -> Paths, Length, Count
deconstruct_path_2 = DeconstructPath(Branch=tree_statistics_2.Paths)  # -> flatten(Indices)
duplicate_data = DuplicateData(Data=simplify(graft(deconstruct_path_2)), Number=simplify(graft(tree_statistics_2.Length)), Order=True)  # -> flatten(Data)
list_item_2 = ListItem(List=mesh_volume.Centroid, Index=deconstruct_path_2, Wrap=True)
duplicate_data_2 = DuplicateData(Data=simplify(graft(list_item_2)), Number=simplify(graft(tree_statistics_2.Length)), Order=True)  # -> flatten(Data)
create_tree = CreateTree(Data=duplicate_data_2, Path=duplicate_data)

# ----
vector_2pt = Vector2Pt(PointA=area_2.Centroid, PointB=create_tree, Unitize=invert(False))  # -> Vector, Length
dot_product = DotProduct(VectorA=deconstruct_plane.ZAxis, VectorB=vector_2pt.Vector, Unitize=False)
smaller_than = SmallerThan(FirstNumber=dot_product, SecondNumber="0")  # -> SmallerThan, OrEqualTo
pick_n_choose = PickNChoose(Pattern=smaller_than.SmallerThan, Stream0=deconstruct_plane.ZAxis, Stream1=reverse)
joint_at_intersections_normals_inwards = Vector(pick_n_choose)

# ---- group: Cull projected joint brep with zero force magnitude / Pulled point with out-of-balance force vector should be in same directions to be influential
all_adjacent_block_out_of_balance_force_2 = Vector(all_adjacent_block_out_of_balance_force)  # "ALL Adjacent block out-of-balance force vector TREE"
joint_at_intersections_normals = Vector(joint_at_intersections_normals_inwards)
joint_breps_at_intersections = Brep(splitted_joint_breps_at_intersections)
dot_product_2 = DotProduct(VectorA=joint_at_intersections_normals, VectorB=all_adjacent_block_out_of_balance_force_2, Unitize=invert(False))
includes = Includes(Value=dot_product_2, Domain="0.001 to 1")  # -> Includes, Deviation
cull_pattern_3 = CullPattern(List=joint_breps_at_intersections, CullPattern=includes.Includes)
influential_joint_breps_at_intersections = Brep(cull_pattern_3)

# ---- group: Cull projected joint brep with zero force magnitude / Create data tree for influential joints at intersections. Path = force transferred from block
adjacent_block_id_for_splitted_joint_bre_2 = Integer(adjacent_block_id_for_splitted_joint_bre)  # "Adjacent block ID for Splitted joint breps at intersections TREE"
is_influential_joint = Boolean(includes.Includes)
out_of_balance_force_vectors_list_2 = Vector(out_of_balance_force_vectors_list)
list_indices = ListIndices(List=out_of_balance_force_vectors_list_2)
cull_pattern_4 = CullPattern(List=adjacent_block_id_for_splitted_joint_bre_2, CullPattern=is_influential_joint)
create_tree_2 = CreateTree(Data=influential_joint_breps_at_intersections, Path=cull_pattern_4, Ensure=list_indices)

# ---- group: Cull projected joint brep with zero force magnitude / Create data tree for corresponding force vector, remove force vector if no influential joints at intersections
tree_statistics_3 = TreeStatistics(Tree=create_tree_2)  # -> Paths, Length, Count
cull_pattern_5 = CullPattern(List=simplify(graft(out_of_balance_force_vectors_list_2)), CullPattern=simplify(graft(tree_statistics_3.Length)))

# ---- group: Cull projected joint brep with zero force magnitude
# Force distribution based on projected area along force vector
# "C:\Users\KYC\OneDrive - NGI\Documents\PhD\OneDrive-Code\GH\Force distribution.ghcluster"
force_distribution = ForceDistribution(force_vector_list=cull_pattern_5, joint_brep_tree=create_tree_2)  # -> distributed_force_vector_tree_2, projected_joint_brep_tree_2

# ---- group: Cull projected joint brep with zero force magnitude / Reduction due to groundwater
plane_trim_surface = PlaneTrimSurface(Surface=graft(create_tree_2), Plane=groundwater_level_plane_2, Flip=False)  # -> Trimmed, Intersected
area_3 = Area(Geometry=plane_trim_surface.Trimmed)  # -> Area, Centroid
point_plane_side = PointPlaneSide(Point=area_3.Centroid, Plane=groundwater_level_plane_2)  # -> Side, Front, Back, Distance
cull_pattern_6 = CullPattern(List=plane_trim_surface.Trimmed, CullPattern=point_plane_side.Front)
area_4 = Area(Geometry=graft(create_tree_2))  # -> Area, Centroid
trimmed_surfaces = Surface(cull_pattern_6)
simplify_tree = SimplifyTree(Tree=trimmed_surfaces, Front=invert(False))
area_5 = Area(Geometry=simplify_tree)  # -> Area, Centroid
mass_addition = MassAddition(Input=area_5.Area)  # -> Result, PartialResults
division = Division(A=mass_addition.Result, B=area_4.Area)  # -> simplify(Result)
reduction_factor_due_to_groundwater = Number(division)
addition = Addition(A=reduction_factor_due_to_groundwater, B="0")
panel_2 = Panel(addition)
multiplication = Multiplication(A=force_distribution.distributed_force_vector_tree_2, B=addition)

# ---- group: Filtered joints
area_6 = Area(Geometry=create_tree_2)  # -> Area, Centroid

# ---- group: Cull projected joint brep with zero force magnitude
cull_pattern_7 = CullPattern(List=force_distribution.projected_joint_brep_tree_2, CullPattern=addition)

# ----
cull_pattern_8 = CullPattern(List=multiplication, CullPattern=addition)

# ---- group: Cull projected joint brep with zero force magnitude / Match tree structure from inputs
tree_statistics_4 = TreeStatistics(Tree=cull_pattern_4)  # -> Paths, Length, Count
duplicate_data_3 = DuplicateData(Data=simplify(graft(tree_statistics_4.Paths)), Number=simplify(graft(tree_statistics_4.Length)), Order=True)  # -> flatten(Data)
create_tree_3 = CreateTree(Data=duplicate_data_3, Path=cull_pattern_4)  # -> flatten(Data)
create_tree_4 = CreateTree(Data=flatten(cull_pattern_8), Path=create_tree_3, Ensure=tree_statistics_4.Paths)

# ---- group: Cull projected joint brep with zero force magnitude / Ensure the projected joint brep match the output data tree
create_tree_5 = CreateTree(Data=flatten(cull_pattern_7), Path=create_tree_3, Ensure=tree_statistics_4.Paths)

# ----
# Visualise out-of-balance force vector on filtered joints at intersections
create_tree_6 = CreateTree(Data=flatten(area_6.Centroid), Path=create_tree_3, Ensure=tree_statistics_4.Paths)
projected_joint_brep_tree = Brep(create_tree_5)

# ----
# Force distribution factors
vector_length = VectorLength(Vector=multiplication)
division_2 = Division(A=vector_length, B=simplify(graft(out_of_balance_force_mn_list_2)))
create_tree_7 = CreateTree(Data=flatten(division_2), Path=create_tree_3, Ensure=tree_statistics_4.Paths)
text_tag = TextTag(Location=create_tree_6, Text=create_tree_7)

out_of_balance_force_vector_anchor_tree = Point(create_tree_6)
out_of_balance_force_vector_anchor_tree_2 = ClusterOutput(out_of_balance_force_vector_anchor_tree)
projected_joint_brep_tree_2 = ClusterOutput(projected_joint_brep_tree)

# ---- group: Cull projected joint brep with zero force magnitude
# Force transfer from later batch(es) to ealier batch(es)
panel_3 = Panel("{0,0,0}")
filtered_adjacent_block_distributed_out = Vector(create_tree_4)  # "FILTERED Adjacent block distributed out-of-balance force vector TREE"
filtered_adjacent_block_ids_tree = Integer(cull_pattern_4)
list_length = ListLength(List=block_mesh_list_2)
duplicate_data_4 = DuplicateData(Data=panel_3, Number=list_length, Order=True)  # -> simplify(graft(Data))
addition_2 = Addition(A=filtered_adjacent_block_distributed_out, B=duplicate_data_4)

# ----
out_of_balance_force_vector_tree = Vector(addition_2)

# ---- group: Out-of-balance force vectors
# Visualise transferred force vector on blocks
vector_display_2 = VectorDisplay(Anchor=out_of_balance_force_vector_anchor_tree, Vector=out_of_balance_force_vector_tree)

# ----
mass_addition_2 = MassAddition(Input=addition_2)  # -> flatten(Result), PartialResults

# ---- group: Cull projected joint brep with zero force magnitude (continued)
transferred_force_vector_list = Vector(flatten(mass_addition_2.Result))
transferred_force_vector_list_2 = ClusterOutput(transferred_force_vector_list)

# ---- group: Out-of-balance force vectors
vector_display_3 = VectorDisplay(Anchor=area.Centroid, Vector=transferred_force_vector_list)

# ----
filtered_adjacent_block_ids_tree_2 = ClusterOutput(filtered_adjacent_block_ids_tree)
out_of_balance_force_vector_tree_2 = ClusterOutput(out_of_balance_force_vector_tree)
panel_4 = Panel(filtered_adjacent_block_ids_tree)

# ==== cluster Cluster_2
water_table_plane_z_upwards = ClusterInput()
volume = ClusterInput()
e_cap_seismic = ClusterInput()
joint = ClusterInput()
c_i = ClusterInput()

gamma_r = ClusterInput()
wedge_upper_face_mesh = ClusterInput()
wedge_slope_face_mesh = ClusterInput()
slope_dip = ClusterInput()
slope_dip_direction = ClusterInput()
phi_1_r = ClusterInput()
c_1 = ClusterInput()
phi_1 = ClusterInput()
block_brep = ClusterInput()
k = ClusterInput()
e_cap_bolt_passive = ClusterInput()
e_cap_bolt_active = ClusterInput()
c_passive = ClusterInput()
c_active = ClusterInput()
c_passive_2 = CapacityOfPassiveBolt(c_passive)
e_cap_bolt_passive_2 = UnitDirectionOfPassiveBolt(e_cap_bolt_passive)
e_cap_bolt_active_2 = UnitDirectionOfActiveBolt(e_cap_bolt_active)
c_active_2 = CapcaityOfActiveBolt(c_active)
block_brep_2 = Brep(block_brep)
k_2 = Number(k)
e_cap_seismic_2 = DirectionOfSeismicForce(e_cap_seismic)
c_i_2 = IndividualExternalForceVectors(c_i)
right_joint_dip = Number()
right_joint_dip_direction = Number()
slope_dip_2 = Number(slope_dip)
slope_dip_direction_2 = Number(slope_dip_direction)
c_1_2 = CohesionOfJoint1(c_1)
phi_1_2 = FrictionAngleOfJoint1(phi_1)
gamma_r_2 = UnitWeightOfRock(gamma_r)
wedge_upper_face_mesh_2 = Mesh(wedge_upper_face_mesh)
phi_1_r_2 = FrictionAngleOfJoint1(phi_1_r)
wedge_slope_face_mesh_2 = Mesh(wedge_slope_face_mesh)

water_table_plane_z_upwards_2 = Plane(water_table_plane_z_upwards)
volume_2 = Number(volume)
joint_2 = Geometry(joint)

# ----
# Active support - Ultimate load
# Active support - FS for shear failure
# Passive support - Ultimate laod
panel = Panel("0")

# ----
# "C:\Users\KYC\OneDrive - NGI\Documents\PhD\OneDrive-Code\GH\Wedge New FS Basal.ghcluster"
cluster = Cluster(
    unit_weight_of_rock=gamma_r_2,
    joint=joint_2,
    block_brep=block_brep_2,
    volume=volume_2,
    wedge_slope_face_mesh=wedge_slope_face_mesh_2,
    wedge_upper_face_mesh=wedge_upper_face_mesh_2,
    slope_dip=slope_dip_2,
    slope_dip_direction=slope_dip_direction_2,
    cohesion_of_joint_1=c_1_2,
    friction_angle_of_joint_1=phi_1_2,
    k=k_2,
    direction_of_seismic_force=e_cap_seismic_2,
    individual_external_force_vectors=c_i_2,
    water_table_plane_z_upwards=water_table_plane_z_upwards_2,
    capcaity_of_active_bolt=c_active_2,
    unit_direction_of_active_bolt=e_cap_bolt_active_2,
    capacity_of_passive_bolt=panel,
    unit_direction_of_passive_bolt="{0,0,0}",
    trace_length_of_joint_1_on_slope_face=panel,
    trace_length_of_joint_2_on_slope_face=panel,
    shotcrete_thickness=panel,
    shotcrete_shear_strength=panel,
    area_where_slope_face_of_block_and_shotc=panel,
    unit_weight_of_shotcrete=panel,
    active_pressure_magnitude_on_slope_face=panel,
    trend_plunge_of_active_slope_pressure="{0,0,0}",
    active_pressure_magnitude_on_upper_face=panel,
    trend_plunge_of_active_upper_face_pressu="{0,0,0}",
    passive_pressure_magnitude_on_slope_face=panel,
    trend_plunge_of_passive_slope_pressure="{0,0,0}",
    passive_pressure_magnitude_on_upper_face=panel,
    trend_plunge_of_passive_upper_face_press="{0,0,0}")  # -> factor_of_safety, sliding_direction_number_4, sliding_joint_index_5, driving_force_4, resisting_force_4, sliding_direction_unit_vector_3, normal_force_on_joints_mn_3, shear_resistance_on_joints_mn_4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
cluster_2 = Cluster(
    unit_weight_of_rock=gamma_r_2,
    joint=joint_2,
    block_brep=block_brep_2,
    volume=volume_2,
    wedge_slope_face_mesh=wedge_slope_face_mesh_2,
    wedge_upper_face_mesh=wedge_upper_face_mesh_2,
    slope_dip=slope_dip_2,
    slope_dip_direction=slope_dip_direction_2,
    cohesion_of_joint_1=c_1_2,
    friction_angle_of_joint_1=phi_1_2,
    k=k_2,
    direction_of_seismic_force=e_cap_seismic_2,
    individual_external_force_vectors=c_i_2,
    water_table_plane_z_upwards=water_table_plane_z_upwards_2,
    capcaity_of_active_bolt=c_passive_2,
    unit_direction_of_active_bolt=e_cap_bolt_active_2,
    capacity_of_passive_bolt=panel,
    unit_direction_of_passive_bolt="{0,0,0}",
    trace_length_of_joint_1_on_slope_face=panel,
    trace_length_of_joint_2_on_slope_face=panel,
    shotcrete_thickness=panel,
    shotcrete_shear_strength=panel,
    area_where_slope_face_of_block_and_shotc=panel,
    unit_weight_of_shotcrete=panel,
    active_pressure_magnitude_on_slope_face=panel,
    trend_plunge_of_active_slope_pressure="{0,0,0}",
    active_pressure_magnitude_on_upper_face=panel,
    trend_plunge_of_active_upper_face_pressu="{0,0,0}",
    passive_pressure_magnitude_on_slope_face=panel,
    trend_plunge_of_passive_slope_pressure="{0,0,0}",
    passive_pressure_magnitude_on_upper_face=panel,
    trend_plunge_of_passive_upper_face_press="{0,0,0}")  # -> factor_of_safety, sliding_direction_number_4, sliding_joint_index_5, driving_force_4, resisting_force_4, sliding_direction_unit_vector_3, normal_force_on_joints_mn_3, shear_resistance_on_joints_mn_4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; disabled
cluster_3 = Cluster(
    unit_weight_of_rock=gamma_r_2,
    joint=joint_2,
    block_brep=block_brep_2,
    volume=volume_2,
    wedge_slope_face_mesh=wedge_slope_face_mesh_2,
    wedge_upper_face_mesh=wedge_upper_face_mesh_2,
    slope_dip=slope_dip_2,
    slope_dip_direction=slope_dip_direction_2,
    cohesion_of_joint_1=panel,
    friction_angle_of_joint_1=phi_1_r_2,
    k=k_2,
    direction_of_seismic_force=e_cap_seismic_2,
    individual_external_force_vectors=c_i_2,
    water_table_plane_z_upwards=water_table_plane_z_upwards_2,
    capcaity_of_active_bolt=c_passive_2,
    unit_direction_of_active_bolt=e_cap_bolt_passive_2,
    capacity_of_passive_bolt=panel,
    unit_direction_of_passive_bolt="{0,0,0}",
    trace_length_of_joint_1_on_slope_face=panel,
    trace_length_of_joint_2_on_slope_face=panel,
    shotcrete_thickness=panel,
    shotcrete_shear_strength=panel,
    area_where_slope_face_of_block_and_shotc=panel,
    unit_weight_of_shotcrete=panel,
    active_pressure_magnitude_on_slope_face=panel,
    trend_plunge_of_active_slope_pressure="{0,0,0}",
    active_pressure_magnitude_on_upper_face=panel,
    trend_plunge_of_active_upper_face_pressu="{0,0,0}",
    passive_pressure_magnitude_on_slope_face=panel,
    trend_plunge_of_passive_slope_pressure="{0,0,0}",
    passive_pressure_magnitude_on_upper_face=panel,
    trend_plunge_of_passive_upper_face_press="{0,0,0}")  # -> factor_of_safety, sliding_direction_number_4, sliding_joint_index_5, driving_force_4, resisting_force_4, sliding_direction_unit_vector_3, normal_force_on_joints_mn_3, shear_resistance_on_joints_mn_4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; disabled

panel_2 = Panel(cluster.sliding_direction_number_4)
larger_than = LargerThan(FirstNumber=cluster.factor_of_safety, SecondNumber="1")  # -> LargerThan, OrEqualTo
panel_3 = Panel(cluster_2.sliding_direction_number_4)
fs_c_active = Number(cluster_2.factor_of_safety)
fs_c_passive = Number(cluster_3.factor_of_safety)
pick_n_choose = PickNChoose(Pattern=larger_than.OrEqualTo, Stream0=fs_c_passive, Stream1=fs_c_active)

panel_4 = Panel(cluster.resisting_force_4)
panel_5 = Panel(cluster.driving_force_4)

sliding_direction_number = Integer(cluster.sliding_direction_number_4)
sliding_direction_unit_vector = Vector(cluster.sliding_direction_unit_vector_3)
fs_s = Number(cluster.factor_of_safety)
fs_system = Number(fs_s)
sliding_joint_index = Text(cluster.sliding_joint_index_5)
fs_c = Number(pick_n_choose)
shear_resistance_on_joints_mn = Text(cluster.shear_resistance_on_joints_mn_4)
normal_force_on_joints_mn = Text(cluster.normal_force_on_joints_mn_3)
resisting_force = Number(cluster.resisting_force_4)
driving_force = Number(cluster.driving_force_4)
water_pressure_on_joints_mpa = Text(cluster.water_pressure_on_joints_mpa_3)
if_removable = Boolean(cluster.if_removable_2)
fs_system_2 = ClusterOutput(fs_system)
fs_s_2 = ClusterOutput(fs_s)
sliding_direction_number_2 = ClusterOutput(sliding_direction_number)  # Sliding direction number: 0 = Unconditionally stable; 1 = Falling or lifting; 2 = Sliding on more than two joints; 3 = Sliding on single joint; 4 = Sliding on joint intersection
fs_c_2 = ClusterOutput(fs_c)
sliding_joint_index_2 = ClusterOutput(sliding_joint_index)
driving_force_2 = ClusterOutput(driving_force)
resisting_force_2 = ClusterOutput(resisting_force)
shear_resistance_on_joints_mn_2 = ClusterOutput(shear_resistance_on_joints_mn)
normal_force_on_joints_mn_2 = ClusterOutput(normal_force_on_joints_mn)
sliding_direction_unit_vector_2 = ClusterOutput(sliding_direction_unit_vector)
water_pressure_on_joints_mpa_2 = ClusterOutput(water_pressure_on_joints_mpa)
if_removable_2 = ClusterOutput(if_removable)

if_parallel_joints = Boolean(cluster.if_parallel_joints_2)
if_parallel_joints_2 = ClusterOutput(if_parallel_joints)

# ==== cluster IntJointBrepsAtIntersections
joint_brep_tree = ClusterInput()
block_mesh_list = ClusterInput()
joint_brep_tree_2 = Brep(simplify(joint_brep_tree))

# ---- group: Use Rhino mesh intersection to determine intersecting mesh
# Adjacent block ID TREE
block_mesh_list_2 = Mesh(block_mesh_list)
list_indices = ListIndices(List=block_mesh_list_2)
cross_reference = CrossReference(ListListA=list_indices, ListListB=list_indices, CrossMode=7)  # -> ListListA, ListListB

# ---- group: Split joint breps with each others
# Splitted joint brep TREE
# Splitting joint breps
split_brep_multiple = SplitBrepMultiple(Brep=joint_brep_tree_2, Cutters=flatten(joint_brep_tree_2))
trim_tree = TrimTree(Tree=split_brep_multiple, Depth=1)
splitted_joint_brep_tree = Brep(simplify(trim_tree))

# ---- group: Get original joint brep ID for splitted joint breps
# Joint brep ID for Splitted joint brep TREE
tree_statistics = TreeStatistics(Tree=graft(split_brep_multiple))  # -> Paths, Length, Count
deconstruct_path = DeconstructPath(Branch=tree_statistics.Paths)
list_item = ListItem(List=deconstruct_path, Index="1", Wrap=True)  # -> flatten(Item)
match_tree_structure = MatchTreeStructure(DataList=flatten(list_item), TreeMask=splitted_joint_brep_tree)
joint_brep_id_for_splitted_joint_brep_tr = Integer(simplify(match_tree_structure))  # "Joint brep ID for Splitted joint brep TREE"

# ----
int_2_joint_brep_id_for_splitted_joint_b = Integer(simplify(joint_brep_id_for_splitted_joint_brep_tr))  # "Int-2. Joint brep ID for Splitted joint brep TREE"
int_1_splitted_joint_brep_tree = Brep(simplify(splitted_joint_brep_tree))
int_1_splitted_joint_brep_tree_2 = ClusterOutput(int_1_splitted_joint_brep_tree)
int_2_joint_brep_id_for_splitted_joint_b_2 = ClusterOutput(int_2_joint_brep_id_for_splitted_joint_b)  # "Int-2. Joint brep ID for Splitted joint brep TREE"

# ---- group: Zoom to block
button = Button()

# ----
# Identify overlapping joints with adjacent blocks, return splitted joint breps and adjacent block IDs
document_distance_tolerance = DocumentDistanceTolerance()

# ---- group: Check if block intersects
brep_join = BrepJoin(Breps=joint_brep_tree_2)  # -> flatten(Breps), Closed
list_item_2 = ListItem(List=brep_join.Breps, Index=cross_reference.ListListA, Wrap=True)
list_item_3 = ListItem(List=brep_join.Breps, Index=cross_reference.ListListB, Wrap=True)
brep_brep = BrepBrep(BrepA=list_item_2, BrepB=list_item_3)  # -> Curves, Points

# If(More than one curve)
join_curves = JoinCurves(Curves=brep_brep.Curves, Preserve=False)  # -> simplify(Curves)
list_length = ListLength(List=join_curves)
larger_than = LargerThan(FirstNumber=list_length, SecondNumber="1")  # -> LargerThan, OrEqualTo
if_more_than_one_curve = Boolean(flatten(larger_than.LargerThan))

# If(Segments)
is_curve_segmented = IsCurveSegmented(Curve=brep_brep.Curves)  # -> simplify(Segments), Amount, Lengths, Degrees
mass_addition = MassAddition(Input=is_curve_segmented.Segments)  # -> Result, PartialResults
replace_nulls = ReplaceNulls(Items=mass_addition.Result, Replacements="False")  # -> Items, Count
if_segments = Boolean(flatten(replace_nulls.Items))

addition = Addition(A=if_more_than_one_curve, B=if_segments)
pair_adjacent_booleans = Boolean(addition)

# ---- group: Organise the intersection plane points into data tree
block_object_id_a = Integer(cross_reference.ListListA)
block_object_id_b = Integer(cross_reference.ListListB)
cull_pattern = CullPattern(List=block_object_id_b, CullPattern=pair_adjacent_booleans)
cull_pattern_2 = CullPattern(List=block_object_id_a, CullPattern=pair_adjacent_booleans)

# ---- group: Organise adjacent block ID into data tree
create_tree = CreateTree(Data=flatten(cull_pattern_2), Path=cull_pattern, Ensure=list_indices)
create_tree_2 = CreateTree(Data=flatten(cull_pattern), Path=cull_pattern_2, Ensure=list_indices)
merge = Merge(Data1=create_tree_2, Data2=create_tree)
adjacent_block_id_tree = Integer(merge)

# ----
# Create Tree of splitted joint plane centroids of own and their adjacent blocks
block_mesh = Mesh(flatten(block_mesh_list_2))
# Own & adjacent block ID for Splitted joint brep TREE
splitted_joint_brep_tree_2 = Brep(simplify(splitted_joint_brep_tree))
ajdacent_block_id_tree = Integer(adjacent_block_id_tree)
list_indices_2 = ListIndices(List=block_mesh)  # -> simplify(graft(Indices))
block_id_tree = Integer(list_indices_2)
area = Area(Geometry=splitted_joint_brep_tree_2)  # -> Area, Centroid
merge_2 = Merge(Data1=block_id_tree, Data2=ajdacent_block_id_tree)
graft_tree = GraftTree(Tree=merge_2, IncludeEmptyLists=True, IncludeNullItems=True)  # -> simplify(graft(Tree))

# ---- group: Get block ID as base path
tree_statistics_2 = TreeStatistics(Tree=graft_tree)  # -> Paths, Length, Count
deconstruct_path_2 = DeconstructPath(Branch=tree_statistics_2.Paths)
list_item_4 = ListItem(List=deconstruct_path_2, Index=0, Wrap=True)  # -> flatten(Item)

# ---- group: Get data point number; create tree structure
tree_branch = TreeBranch(Tree=area.Centroid, Path=graft_tree, MaintainPaths=False)
tree_statistics_3 = TreeStatistics(Tree=tree_branch)  # -> Paths, Length, Count
duplicate_data = DuplicateData(Data=simplify(graft(list_item_4)), Number=simplify(graft(tree_statistics_3.Length)), Order=invert(True))  # -> flatten(Data)

# ----
create_tree_3 = CreateTree(Data=flatten(tree_branch), Path=duplicate_data, Ensure=list_indices_2)
own_and_adjacent_block_joint_plane_centr = Point(create_tree_3)  # "Own and adjacent block Joint plane centroid TREE"

list_length_2 = ListLength(List=splitted_joint_brep_tree_2)
point_groups = PointGroups(Points=own_and_adjacent_block_joint_plane_centr, Distance=document_distance_tolerance)  # -> Groups, Indices
tree_statistics_4 = TreeStatistics(Tree=point_groups.Indices)  # -> Paths, Length, Count
list_length_3 = ListLength(List=point_groups.Indices)
equality = Equality(FirstNumber=flatten(list_length_3), SecondNumber="2")  # -> simplify(Equality), Inequality
cull_pattern_3 = CullPattern(List=tree_statistics_4.Paths, CullPattern=equality.Equality)
tree_branch_2 = TreeBranch(Tree=point_groups.Indices, Path=cull_pattern_3, MaintainPaths=True)
sort_list = SortList(Keys=tree_branch_2)  # -> Keys, ValuesValuesA
first_last = FirstLast(List=sort_list.Keys)  # -> FirstValue, LastValue
shift_to_depth = ShiftToDepth(Tree=first_last.FirstValue, Depth="1", shiftFromStart=False)
tree_statistics_5 = TreeStatistics(Tree=shift_to_depth)  # -> Paths, Length, Count
duplicate_data_2 = DuplicateData(Data=graft(tree_statistics_5.Paths), Number=graft(tree_statistics_5.Length), Order=True)  # -> flatten(Data)
create_tree_4 = CreateTree(Data=flatten(shift_to_depth), Path=duplicate_data_2, Ensure=list_indices)
smaller_than = SmallerThan(FirstNumber=create_tree_4, SecondNumber=list_length_2)  # -> SmallerThan, OrEqualTo
cull_pattern_4 = CullPattern(List=create_tree_4, CullPattern=smaller_than.SmallerThan)
centroid_indices_for_own_block_at_inters = Integer(cull_pattern_4)  # "centroid indices for own block at intersections"

# ----
# Create Tree of splitted joint plane's block IDs
flatten_tree = FlattenTree(Tree=merge_2, Path="{0}")
duplicate_data_3 = DuplicateData(Data=simplify(graft(flatten_tree)), Number=simplify(graft(tree_statistics_3.Length)), Order=invert(True))  # -> flatten(Data)
create_tree_5 = CreateTree(Data=flatten(duplicate_data_3), Path=duplicate_data, Ensure=list_indices_2)
splitted_joint_plane_block_id_tree = Integer(simplify(create_tree_5))

# ----
# Get adjacent block ID for splitted joint brep at intersections
shift_to_depth_2 = ShiftToDepth(Tree=first_last.LastValue, Depth="1", shiftFromStart=False)
tree_statistics_6 = TreeStatistics(Tree=shift_to_depth_2)  # -> Paths, Length, Count
duplicate_data_4 = DuplicateData(Data=graft(tree_statistics_6.Paths), Number=graft(tree_statistics_6.Length), Order=True)  # -> flatten(Data)
create_tree_6 = CreateTree(Data=flatten(shift_to_depth_2), Path=duplicate_data_4, Ensure=list_indices)
cull_pattern_5 = CullPattern(List=create_tree_6, CullPattern=smaller_than.SmallerThan)
list_item_5 = ListItem(List=splitted_joint_plane_block_id_tree, Index=cull_pattern_5, Wrap=True)
adjacent_block_id_for_splitted_joint_bre = Integer(list_item_5)  # "Adjacent block ID for Splitted joint brep at intersection TREE"

# ----
# Get own & adjacent block ID for splitted joint brep
tree_statistics_7 = TreeStatistics(Tree=splitted_joint_brep_tree)  # -> Paths, Length, Count
deconstruct_path_3 = DeconstructPath(Branch=tree_statistics_7.Paths)  # -> flatten(Indices)
duplicate_data_5 = DuplicateData(Data=simplify(graft(deconstruct_path_3)), Number=simplify(graft(tree_statistics_7.Length)), Order=True)  # -> simplify(Data)
own_block_id_for_splitted_joint_brep_tre = Integer(duplicate_data_5)  # "Own block ID for splitted joint brep TREE"
replace_items = ReplaceItems(
    List=own_block_id_for_splitted_joint_brep_tre,
    Item=adjacent_block_id_for_splitted_joint_bre,
    Indices=centroid_indices_for_own_block_at_inters,
    Wrap=False)  # -> simplify(List)
panel = Panel(replace_items)
own_adjacent_block_id_for_splitted_joint = Integer(replace_items)  # "Own & adjacent block ID for Splitted joint brep TREE"

int_3_own_adjacent_block_id_for_splitted = Integer(own_adjacent_block_id_for_splitted_joint)  # "Int-3. Own & adjacent block ID for Splitted joint brep TREE"
int_3_own_adjacent_block_id_for_splitted_2 = ClusterOutput(int_3_own_adjacent_block_id_for_splitted)  # "Int-3. Own & adjacent block ID for Splitted joint brep TREE"

# ----
# FOR BUG-FIXING
# Adjacent block number for each splitted joint brep
block_id = Panel("28")
tree_branch_3 = TreeBranch(Tree=int_3_own_adjacent_block_id_for_splitted, Path=block_id, MaintainPaths=True)
list_item_6 = ListItem(List=block_mesh_list_2, Index=tree_branch_3, Wrap=True)
volume = Volume(Geometry=list_item_6)  # -> Volume, Centroid

# ---- group: Splitted joint brep
tree_branch_4 = TreeBranch(Tree=int_1_splitted_joint_brep_tree, Path=block_id, MaintainPaths=True)

# ----
area_2 = Area(Geometry=tree_branch_4)  # -> Area, Centroid
first_last_2 = FirstLast(List=area_2.Centroid)  # -> FirstValue, LastValue
zoom_to = ZoomTo(TargetPoint=first_last_2.FirstValue, Reset=button, Distance="10")

# ---- group: Adjacent Block ID on Joint
text_tag = TextTag(Location=area_2.Centroid, Text=tree_branch_3, Colour="white")

# ---- group: Adjcent Block IDs
text_tag_2 = TextTag(Location=volume.Centroid, Text=tree_branch_3, Colour="black")

# ==== cluster ForceTransferFromSlidingBlock
rem_3_removed_block_merged_joint_brep_tr = ClusterInput()  # "Rem-3. Removed block merged joint brep TREE"
rem_2_before_block_removal_joint_id_tree = ClusterInput()
rem_1_joint_brep_id_for_removed_block_sp = ClusterInput()  # "Rem-1. Joint brep ID for Removed block Splitted joint brep TREE"
rem_4_removed_block_splitted_joint_breps = ClusterInput()  # "Rem-4. Removed block Splitted joint breps grouped by joint ID (ID before splitting) TREE"
rem_5_removed_block_adjacent_block_id_fo = ClusterInput()  # "Rem-5. Removed block Adjacent block ID for Splitted joint breps grouped by joint ID (ID before splitting) TREE"
block_mesh = ClusterInput()
sliding_joint_id_text = ClusterInput()
normal_force_text = ClusterInput()
shear_resistance_text = ClusterInput()
sliding_direction_unit_vector = ClusterInput()
groundwater_level_plane = ClusterInput()
groundwater_level_plane_2 = Plane(groundwater_level_plane)

# ----
# INPUT - output from block removal
rem_5_removed_block_adjacent_block_id_fo_2 = Integer(rem_5_removed_block_adjacent_block_id_fo)  # "Rem-5. Removed block Adjacent block ID for Splitted joint breps grouped by joint ID (ID before splitting) TREE"
rem_4_removed_block_splitted_joint_breps_2 = Brep(rem_4_removed_block_splitted_joint_breps)  # "Rem-4. Removed block Splitted joint breps grouped by joint ID (ID before splitting) TREE"
rem_3_removed_block_merged_joint_brep_tr_2 = Brep(simplify(rem_3_removed_block_merged_joint_brep_tr))  # "Rem-3. Removed block merged joint brep TREE"
rem_1_joint_brep_id_for_removed_block_sp_2 = Integer(rem_1_joint_brep_id_for_removed_block_sp)  # "Rem-1. Joint brep ID for Removed block Splitted joint brep TREE"
rem_2_before_block_removal_joint_id_tree_2 = Integer(rem_2_before_block_removal_joint_id_tree)

# ----
# Force transfer from sliding blocks
block_mesh_2 = Mesh(flatten(block_mesh))

# ----
# INPUT - output from FOS calculation
sliding_direction_unit_vector_2 = Vector(sliding_direction_unit_vector)
normal_force_text_2 = Text(normal_force_text)
shear_resistance_text_2 = Text(shear_resistance_text)
sliding_joint_id_text_2 = Text(sliding_joint_id_text)

# ---- group: Normal force
text_split = TextSplit(Text=normal_force_text_2, Separators=",")  # -> simplify(Result)

# ---- group: Shear resistance
text_split_2 = TextSplit(Text=shear_resistance_text_2, Separators=",")  # -> simplify(Result)

# ---- group: Sliding joint ID
text_split_3 = TextSplit(Text=sliding_joint_id_text_2, Separators=",")  # -> simplify(Result)
integer = Integer(text_split_3)

# ----
# 3. Determine sliding joint ID (ID before block removal)
list_item = ListItem(List=rem_2_before_block_removal_joint_id_tree_2, Index=integer, Wrap=True)
sliding_joint_id_id_before_block_removal = Integer(list_item)

# ---- group: Sliding joint ID (ID before block removal)
clean_tree = CleanTree(RemoveNulls=True, RemoveInvalid=True, RemoveEmpty=invert(False), Tree=sliding_joint_id_id_before_block_removal)

# ----
# 5. Check if splitted joint slides on own block, return relevant tree paths
removed_block_adjacent_block_id_for_spli = Integer(rem_5_removed_block_adjacent_block_id_fo_2)  # "Removed block Adjacent block ID for Splitted joint breps grouped by joint ID (ID before splitting) TREE"
tree_statistics = TreeStatistics(Tree=removed_block_adjacent_block_id_for_spli)  # -> Paths, Length, Count
duplicate_data = DuplicateData(Data=simplify(graft(tree_statistics.Paths)), Number=simplify(graft(tree_statistics.Length)), Order=True)
deconstruct_path = DeconstructPath(Branch=duplicate_data)
first_last = FirstLast(List=deconstruct_path)  # -> flatten(FirstValue), LastValue
equality = Equality(FirstNumber=flatten(first_last.FirstValue), SecondNumber=flatten(removed_block_adjacent_block_id_for_spli))  # -> Equality, Inequality
match_tree_structure = MatchTreeStructure(DataList=flatten(equality.Equality), TreeMask=removed_block_adjacent_block_id_for_spli)
mass_addition = MassAddition(Input=match_tree_structure)  # -> Result, PartialResults
splitted_joint_sliding_on_own_block = Boolean(mass_addition.Result)

# ---- group: Own block ID
tree_statistics_2 = TreeStatistics(Tree=clean_tree)  # -> Paths, Length, Count
deconstruct_path_2 = DeconstructPath(Branch=tree_statistics_2.Paths)  # -> flatten(Indices)
duplicate_data_2 = DuplicateData(Data=simplify(graft(deconstruct_path_2)), Number=simplify(graft(tree_statistics_2.Length)), Order=True)  # -> flatten(Data)

# ----
# 2. Construct normal and shear force on sliding joints
list_item_2 = ListItem(List=text_split_2, Index=integer, Wrap=True)
list_item_3 = ListItem(List=text_split, Index=integer, Wrap=True)
shear_resistance_force = Panel(list_item_2)
normal_force = Panel(list_item_3)
amplitude = Amplitude(Vector=graft(sliding_direction_unit_vector_2), Amplitude=list_item_2)  # -> simplify(Vector)

# ----
# 1. Get sliding joint planes with normals pointing outwards for each block
list_item_4 = ListItem(List=rem_3_removed_block_merged_joint_brep_tr_2, Index=integer, Wrap=True)
mesh_volume = MeshVolume(Mesh=block_mesh_2)  # -> Volume, Centroid
sliding_joint_breps = Brep(list_item_4)
is_planar = IsPlanar(Surface=sliding_joint_breps, Interior=True)  # -> Planar, Plane
deconstruct_plane = DeconstructPlane(Plane=is_planar.Plane)  # -> Origin, XAxis, YAxis, ZAxis
reverse = Reverse(Vector=deconstruct_plane.ZAxis)

# ---- group: Joint brep centres
area = Area(Geometry=sliding_joint_breps)  # -> Area, Centroid

# ---- group: Create same data tree structure as joint breps at intersections
tree_statistics_3 = TreeStatistics(Tree=area.Centroid)  # -> Paths, Length, Count
deconstruct_path_3 = DeconstructPath(Branch=tree_statistics_3.Paths)  # -> flatten(Indices)
duplicate_data_3 = DuplicateData(Data=simplify(graft(deconstruct_path_3)), Number=simplify(graft(tree_statistics_3.Length)), Order=True)  # -> flatten(Data)
list_item_5 = ListItem(List=mesh_volume.Centroid, Index=deconstruct_path_3, Wrap=True)
duplicate_data_4 = DuplicateData(Data=simplify(graft(list_item_5)), Number=simplify(graft(tree_statistics_3.Length)), Order=True)  # -> flatten(Data)
create_tree = CreateTree(Data=duplicate_data_4, Path=duplicate_data_3)

# ----
vector_2pt = Vector2Pt(PointA=area.Centroid, PointB=create_tree, Unitize=invert(False))  # -> Vector, Length
dot_product = DotProduct(VectorA=deconstruct_plane.ZAxis, VectorB=vector_2pt.Vector, Unitize=False)
smaller_than = SmallerThan(FirstNumber=dot_product, SecondNumber="0")  # -> SmallerThan, OrEqualTo
pick_n_choose = PickNChoose(Pattern=smaller_than.SmallerThan, Stream0=reverse, Stream1=deconstruct_plane.ZAxis)
joint_at_intersections_normals_outwards = Vector(pick_n_choose)

amplitude_2 = Amplitude(Vector=joint_at_intersections_normals_outwards, Amplitude=list_item_3)
addition = Addition(A=amplitude_2, B=amplitude)

sliding_force_vector_tree = Vector(addition)

vector_length = VectorLength(Vector=sliding_force_vector_tree)
panel = Panel(vector_length)

# ---- group: Sliding force vectors
clean_tree_2 = CleanTree(RemoveNulls=True, RemoveInvalid=True, RemoveEmpty=invert(False), Tree=sliding_force_vector_tree)  # -> flatten(Tree)

# ----
# 4. Construct sliding joint force vector into tree with paths block ID; joint IDs
panel_2 = Panel("{")
concatenate = Concatenate(A=panel_2, Fragment_A=flatten(duplicate_data_2), B=";", Fragment_B=flatten(clean_tree), C="}")
create_tree_2 = CreateTree(Data=clean_tree_2, Path=concatenate)
sliding_joint_force_vector_new_paths = Vector(create_tree_2)

# ----
# 6. Select those sliding force vectors that are sliding on adjacent blocks
tree_statistics_4 = TreeStatistics(Tree=removed_block_adjacent_block_id_for_spli)  # -> Paths, Length, Count
cull_pattern = CullPattern(List=tree_statistics_4.Paths, CullPattern=invert(flatten(splitted_joint_sliding_on_own_block)))
data_path_with_adjacent_block = DataPath(cull_pattern)
tree_branch = TreeBranch(Tree=sliding_joint_force_vector_new_paths, Path=data_path_with_adjacent_block, MaintainPaths=True)
clean_tree_3 = CleanTree(RemoveNulls=True, RemoveInvalid=True, RemoveEmpty=invert(False), Tree=tree_branch)
filtered_sliding_joint_force_vector = Vector(clean_tree_3)

# ----
# 7. Group joint breps and adjacent block ID based on joint ID (ID before block removal)
# Then select only those that are sliding on adjacent blocks
removed_block_splitted_joint_breps_group = Brep(rem_4_removed_block_splitted_joint_breps_2)  # "Removed block Splitted joint breps grouped by joint ID (ID before splitting) TREE"
tree_statistics_5 = TreeStatistics(Tree=filtered_sliding_joint_force_vector)  # -> Paths, Length, Count
tree_branch_2 = TreeBranch(Tree=removed_block_splitted_joint_breps_group, Path=tree_statistics_5.Paths, MaintainPaths=True)
splitted_joint_breps_with_sliding_joint = Brep(tree_branch_2)  # "Splitted joint breps with sliding joint force on adjacent blocks"

# ----
# 8. Force distribution based on projected area along force vector
# "C:\Users\KYC\OneDrive - NGI\Documents\PhD\OneDrive-Code\GH\Force distribution.ghcluster"
force_distribution = ForceDistribution(force_vector_list=filtered_sliding_joint_force_vector, joint_brep_tree=splitted_joint_breps_with_sliding_joint)  # -> distributed_force_vector_tree_2, projected_joint_brep_tree_2

# ---- group: Reduction due to groundwater
# 9. Reduction of transferred force magnitude based due to groundwater
plane_trim_surface = PlaneTrimSurface(Surface=graft(splitted_joint_breps_with_sliding_joint), Plane=groundwater_level_plane_2, Flip=False)  # -> Trimmed, Intersected
area_2 = Area(Geometry=plane_trim_surface.Trimmed)  # -> Area, Centroid
point_plane_side = PointPlaneSide(Point=area_2.Centroid, Plane=groundwater_level_plane_2)  # -> Side, Front, Back, Distance
cull_pattern_2 = CullPattern(List=plane_trim_surface.Trimmed, CullPattern=point_plane_side.Front)
area_3 = Area(Geometry=graft(splitted_joint_breps_with_sliding_joint))  # -> Area, Centroid
trimmed_surfaces = Surface(cull_pattern_2)
simplify_tree = SimplifyTree(Tree=trimmed_surfaces, Front=False)
area_4 = Area(Geometry=simplify_tree)  # -> Area, Centroid
mass_addition_2 = MassAddition(Input=area_4.Area)  # -> Result, PartialResults
tree_statistics_6 = TreeStatistics(Tree=area_3.Area)  # -> Paths, Length, Count
create_tree_3 = CreateTree(Data=flatten(mass_addition_2.Result), Path=tree_statistics_6.Paths, Ensure=tree_statistics_6.Paths)
division = Division(A=create_tree_3, B=area_3.Area)  # -> simplify(Result)
reduction_factor_due_to_groundwater = Number(division)
addition_2 = Addition(A=reduction_factor_due_to_groundwater, B="0")
shift_to_depth = ShiftToDepth(Tree=addition_2, Depth="2", shiftFromStart=False)
multiplication = Multiplication(A=force_distribution.distributed_force_vector_tree_2, B=shift_to_depth)
panel_3 = Panel(shift_to_depth)

# ----
cull_pattern_3 = CullPattern(List=multiplication, CullPattern=shift_to_depth)
clean_tree_4 = CleanTree(RemoveNulls=True, RemoveInvalid=True, RemoveEmpty=invert(False), Tree=cull_pattern_3)
# ---- group: Cull projected joint brep if zero force magnitude
cull_pattern_4 = CullPattern(List=force_distribution.projected_joint_brep_tree_2, CullPattern=shift_to_depth)

# ----
clean_tree_5 = CleanTree(RemoveNulls=True, RemoveInvalid=True, RemoveEmpty=invert(False), Tree=cull_pattern_4)
cull_pattern_5 = CullPattern(List=splitted_joint_breps_with_sliding_joint, CullPattern=shift_to_depth)
clean_tree_6 = CleanTree(RemoveNulls=True, RemoveInvalid=True, RemoveEmpty=invert(False), Tree=cull_pattern_5)

# ----
# FOR VISUALISATION:
# force vectors (normal + shear) on adjacent blocks
vector_display = VectorDisplay(Anchor=deconstruct_plane.Origin, Vector=sliding_force_vector_tree)

# ----
# 11. Get influencial adjacent block IDs
tree_statistics_7 = TreeStatistics(Tree=clean_tree_5)  # -> flatten(Paths), Length, Count
deconstruct_path_4 = DeconstructPath(Branch=tree_statistics_7.Paths)
first_last_2 = FirstLast(List=deconstruct_path_4)  # -> flatten(FirstValue), LastValue
duplicate_data_5 = DuplicateData(Data=graft(first_last_2.FirstValue), Number=graft(tree_statistics_7.Length), Order=True)  # -> flatten(Data)
match_tree_structure_2 = MatchTreeStructure(DataList=flatten(duplicate_data_5), TreeMask=clean_tree_5)

# ----
# 10. Transfer force
removed_block_adjacent_block_id_for_spli_2 = Integer(rem_5_removed_block_adjacent_block_id_fo_2)  # "Removed block Adjacent block ID for Splitted joint breps grouped by joint ID (ID before splitting) TREE"
tree_branch_3 = TreeBranch(Tree=removed_block_adjacent_block_id_for_spli_2, Path=tree_statistics_5.Paths, MaintainPaths=True)
cull_pattern_6 = CullPattern(List=tree_branch_3, CullPattern=shift_to_depth)
list_length = ListLength(List=block_mesh_2)
list_indices = ListIndices(List=block_mesh_2)
clean_tree_7 = CleanTree(RemoveNulls=True, RemoveInvalid=True, RemoveEmpty=invert(False), Tree=cull_pattern_6)
duplicate_data_6 = DuplicateData(Data="{0,0,0}", Number=list_length, Order=True)  # -> simplify(graft(Data))
adjacent_block_id_for_splitted_joint_bre = Integer(clean_tree_7)  # "Adjacent block ID for Splitted joint breps with sliding joint force on adjacent blocks"
create_tree_4 = CreateTree(Data=flatten(clean_tree_4), Path=flatten(adjacent_block_id_for_splitted_joint_bre), Ensure=list_indices)

create_tree_5 = CreateTree(Data=flatten(match_tree_structure_2), Path=flatten(adjacent_block_id_for_splitted_joint_bre), Ensure=list_indices)
influential_adjacent_block_id_tree = Integer(create_tree_5)

addition_3 = Addition(A=create_tree_4, B=duplicate_data_6)

mass_addition_3 = MassAddition(Input=addition_3)  # -> flatten(Result), PartialResults
transferred_force_vector_list = Vector(mass_addition_3.Result)

influential_adjacent_block_id_tree_2 = ClusterOutput(influential_adjacent_block_id_tree)
transferred_force_vector_list_2 = ClusterOutput(transferred_force_vector_list)

# ----
# force distribution ratio
area_5 = Area(Geometry=clean_tree_6)  # -> Area, Centroid
vector_length_2 = VectorLength(Vector=multiplication)
vector_length_3 = VectorLength(Vector=filtered_sliding_joint_force_vector)
create_tree_6 = CreateTree(Data=flatten(area_5.Centroid), Path=flatten(adjacent_block_id_for_splitted_joint_bre), Ensure=list_indices)
create_tree_7 = CreateTree(Data=flatten(clean_tree_5), Path=flatten(adjacent_block_id_for_splitted_joint_bre), Ensure=list_indices)
force_transfer_from_sliding_block_vector = Point(create_tree_6)  # "Force transfer from sliding block vector anchor TREE"
force_transfer_from_sliding_block_vector_2 = Vector(addition_3)  # "Force transfer from sliding block vector TREE"
division_2 = Division(A=vector_length_2, B=vector_length_3)
projected_joint_brep_tree = Brep(create_tree_7)
text_tag = TextTag(Location=area_5.Centroid, Text=division_2)
vector_display_2 = VectorDisplay(Anchor=force_transfer_from_sliding_block_vector, Vector=force_transfer_from_sliding_block_vector_2)

force_transfer_from_sliding_block_vector_3 = ClusterOutput(force_transfer_from_sliding_block_vector)  # "Force transfer from sliding block vector anchor TREE"
force_transfer_from_sliding_block_vector_4 = ClusterOutput(force_transfer_from_sliding_block_vector_2)  # "Force transfer from sliding block vector TREE"
projected_joint_brep_tree_2 = ClusterOutput(projected_joint_brep_tree)

# ==== cluster RemBlockRemovalDuringProgressiveFailure
block_mesh = ClusterInput()
removed_block_id_list = ClusterInput()
int_3_own_adjacent_block_id_for_splitted = ClusterInput()  # "Int-3. Own & adjacent block ID for Splitted joint brep TREE"
int_1_splitted_joint_brep_tree = ClusterInput()
int_2_joint_brep_id_for_splitted_joint_b = ClusterInput()  # "Int-2. Joint brep ID for Splitted joint brep TREE"

# ----
# 1. Get failure order from ordered list of failed Block ID
removed_block_id_list_2 = Integer(removed_block_id_list)
# BLOCK REMOVAL DURING PROGRESSIVE FAILURE
block_mesh_2 = Mesh(flatten(block_mesh))
list_indices = ListIndices(List=removed_block_id_list_2)
list_length = ListLength(List=block_mesh_2)
duplicate_data = DuplicateData(Data=list_length, Number=list_length, Order=True)
replace_items = ReplaceItems(List=duplicate_data, Item=list_indices, Indices=removed_block_id_list_2, Wrap=False)
failure_order_index_block_id_value_order = Panel(replace_items)
split_list = SplitList(RemovedBlockLIST=removed_block_id_list_2, Index=failure_order_index_block_id_value_order)  # -> simplify(ListA), ListB
removed_block_id_for_each_block = Integer(split_list.ListA)
removed_block_id_for_each_block_2 = Panel(removed_block_id_for_each_block)

# ----
# 4. Create data tree paths based on joint brep ID. Block ID; joint brep ID
int_2_joint_brep_id_for_splitted_joint_b_2 = Integer(int_2_joint_brep_id_for_splitted_joint_b)  # "Int-2. Joint brep ID for Splitted joint brep TREE"

# ----
# 2. Check if Adjacent block ID exists in removed block ID for each block;
# return True if the splitted joint brep is to be removed
int_3_own_adjacent_block_id_for_splitted_2 = Integer(int_3_own_adjacent_block_id_for_splitted)  # "Int-3. Own & adjacent block ID for Splitted joint brep TREE"
ghpython_script = GhPythonScript(A=int_3_own_adjacent_block_id_for_splitted_2, B=removed_block_id_for_each_block)  # -> out, a; inputs A: tree, B: tree
# ---------- ghpython_script: Python ----------
import ghpythonlib.treehelpers as th
from Grasshopper.Kernel.Data import GH_Path
from Grasshopper import DataTree

# Initialize the result DataTree
result = DataTree[bool]()

# Iterate over all paths in Tree A
for path in A.Paths:
    # Get the lists of values for the current path
    a_values = A.Branch(path)
    # Ensure B has the same path, if not, use an empty list
    b_values = B.Branch(path) if B.PathExists(path) else []
    
    # Create a new path in the result tree
    result_path = GH_Path(path)
    
    # Check each element in A against the corresponding branch in B
    for a_value in a_values:
        if a_value in b_values:
            result.Add(True, result_path)
        else:
            result.Add(False, result_path)

# Output the result
a = result
# ---------- end ghpython_script ----------

remove_splitted_joint_brep = Boolean(ghpython_script.a)

# ----
# 3. Removed blocks for splitted joint breps
int_1_splitted_joint_brep_tree_2 = Brep(int_1_splitted_joint_brep_tree)
cull_pattern = CullPattern(List=int_1_splitted_joint_brep_tree_2, CullPattern=invert(remove_splitted_joint_brep))
rem_1_removed_block_splitted_joint_brep = Brep(simplify(cull_pattern))  # "Rem-1. Removed block splitted joint brep TREE"

tree_statistics = TreeStatistics(Tree=rem_1_removed_block_splitted_joint_brep)  # -> Paths, Length, Count
deconstruct_path = DeconstructPath(Branch=tree_statistics.Paths)  # -> flatten(Indices)
cull_pattern_2 = CullPattern(List=int_2_joint_brep_id_for_splitted_joint_b_2, CullPattern=invert(remove_splitted_joint_brep))
duplicate_data_2 = DuplicateData(Data=simplify(graft(deconstruct_path)), Number=simplify(graft(tree_statistics.Length)), Order=True)  # -> simplify(Data)
rem_1_joint_brep_id_for_removed_block_sp = Integer(cull_pattern_2)  # "Rem-1. Joint brep ID for Removed block Splitted joint brep TREE"
merge = Merge(Data1=graft(duplicate_data_2), Data2=graft(rem_1_joint_brep_id_for_removed_block_sp))
construct_path = ConstructPath(Indices=merge)  # -> flatten(Branch)

# ----
# 6. Merge subparallel joint breps
own_adjacent_block_id_for_splitted_joint = Integer(int_3_own_adjacent_block_id_for_splitted_2)  # "Own & adjacent block ID for Splitted joint brep TREE"
create_tree = CreateTree(Data=flatten(rem_1_removed_block_splitted_joint_brep), Path=construct_path)
brep_join = BrepJoin(Breps=create_tree)  # -> Breps, Closed
cull_pattern_3 = CullPattern(List=own_adjacent_block_id_for_splitted_joint, CullPattern=invert(remove_splitted_joint_brep))
shift_to_depth = ShiftToDepth(Tree=brep_join.Breps, Depth="1", shiftFromStart=False)
create_tree_2 = CreateTree(Data=flatten(cull_pattern_3), Path=construct_path)
rem_5_removed_block_adjacent_block_id_fo = Integer(create_tree_2)  # "Rem-5. Removed block Adjacent block ID for Splitted joint breps grouped by joint ID (ID before splitting) TREE"
rem_4_removed_block_splitted_joint_breps = Brep(create_tree)  # "Rem-4. Removed block Splitted joint breps grouped by joint ID (ID before splitting) TREE"
rem_3_removed_block_merged_joint_brep_tr = Brep(simplify(shift_to_depth))  # "Rem-3. Removed block merged joint brep TREE"

# ----
# 5. Get before removal joint ID
count_unique = CountUnique(Key=rem_1_joint_brep_id_for_removed_block_sp, SortIfPossible=False, LastSaveLocalization="neutral,N")  # -> KeyList, Count
sort_list = SortList(Keys=count_unique.KeyList)  # -> Keys, ValuesValuesA
before_removal_joint_id = Panel(sort_list.Keys)
rem_2_before_block_removal_joint_id_tree = Integer(before_removal_joint_id)

true_to_be_removed = Panel(remove_splitted_joint_brep)

rem_1_joint_brep_id_for_removed_block_sp_2 = ClusterOutput(rem_1_joint_brep_id_for_removed_block_sp)  # "Rem-1. Joint brep ID for Removed block Splitted joint brep TREE"
rem_3_removed_block_merged_joint_brep_tr_2 = ClusterOutput(rem_3_removed_block_merged_joint_brep_tr)  # "Rem-3. Removed block merged joint brep TREE"
rem_4_removed_block_splitted_joint_breps_2 = ClusterOutput(rem_4_removed_block_splitted_joint_breps)  # "Rem-4. Removed block Splitted joint breps grouped by joint ID (ID before splitting) TREE"
rem_2_before_block_removal_joint_id_tree_2 = ClusterOutput(rem_2_before_block_removal_joint_id_tree)
rem_5_removed_block_adjacent_block_id_fo_2 = ClusterOutput(rem_5_removed_block_adjacent_block_id_fo)  # "Rem-5. Removed block Adjacent block ID for Splitted joint breps grouped by joint ID (ID before splitting) TREE"

# ==== cluster ApplyMaterialPartialFactor
c_1 = ClusterInput()
phi_1 = ClusterInput()
phi_1_r = ClusterInput()
c_2 = ClusterInput()
phi_2 = ClusterInput()
phi_2_r = ClusterInput()
c_1_2 = Number(c_1)
phi_1_2 = Number(phi_1)
phi_1_r_2 = Number(phi_1_r)
c_2_2 = Number(c_2)
phi_2_2 = Number(phi_2)
phi_2_r_2 = Number(phi_2_r)
entwine = Entwine(Branch00=phi_1_2, Branch01=phi_1_r_2, Branch02=phi_2_2, Branch03=phi_2_r_2, FlattenInputs=True)
radians = Radians(Degrees=phi_2_2)
entwine_2 = Entwine(Branch00=c_1_2, Branch01=c_2_2, FlattenInputs=True)
radians_2 = Radians(Degrees=entwine)
expression = Expression(phi=radians, Expression="Atan(tan(phi)/1.25)")
expression_2 = Expression(c=entwine_2, Expression="c/1.25")
expression_3 = Expression(phi=radians_2, Expression="Atan(tan(phi)/1.25)")
explode_tree = ExplodeTree(Data=expression_2)  # -> Branch0, Branch1
degrees = Degrees(Radians=expression)
degrees_2 = Degrees(Radians=expression_3)
explode_tree_2 = ExplodeTree(Data=degrees_2)  # -> Branch0, Branch1, Branch2, Branch3
c_2_3 = Number(explode_tree.Branch1)
phi_2_3 = Number(explode_tree_2.Branch2)
phi_2_r_3 = Number(explode_tree_2.Branch3)
c_1_3 = Number(explode_tree.Branch0)
phi_1_3 = Number(explode_tree_2.Branch0)
phi_1_r_3 = Number(explode_tree_2.Branch1)
c_1_4 = ClusterOutput(c_1_3)
phi_1_4 = ClusterOutput(phi_1_3)
phi_1_r_4 = ClusterOutput(phi_1_r_3)
c_2_4 = ClusterOutput(c_2_3)
phi_2_4 = ClusterOutput(phi_2_3)
phi_2_r_4 = ClusterOutput(phi_2_r_3)

# ==== cluster ForceDistribution
force_vector_list = ClusterInput()
joint_brep_tree = ClusterInput()
# CLUSTER FOR FORCE DISTRIBUTION
force_vector_list_2 = Vector(force_vector_list)
joint_brep_tree_2 = Brep(joint_brep_tree)
graft_tree = GraftTree(Tree=force_vector_list_2, IncludeEmptyLists=True, IncludeNullItems=True)  # -> simplify(Tree)
plane_normal = PlaneNormal(Origin=Point(0, 0, 0), ZAxis=graft_tree)
bounding_rectangle = BoundingRectangle(Geometry=joint_brep_tree_2, Plane=plane_normal, Axis=0, Slide="1", Union=invert(True))  # -> simplify(Bounding), DimensionX, DimensionY
project = Project(Geometry=joint_brep_tree_2, Plane=bounding_rectangle.Bounding)  # -> Geometry, Transform
area = Area(Geometry=project.Geometry)  # -> Area, Centroid
mass_addition = MassAddition(Input=area.Area)  # -> Result, PartialResults
division = Division(A=area.Area, B=mass_addition.Result)
multiplication = Multiplication(A=graft_tree, B=division)
distributed_force_vector_tree = Vector(multiplication)
projected_joint_brep_tree = Brep(project.Geometry)
distributed_force_vector_tree_2 = ClusterOutput(distributed_force_vector_tree)
projected_joint_brep_tree_2 = ClusterOutput(projected_joint_brep_tree)

# ==== cluster Cluster

# ---- group: Groundwater table
water_table_plane_z_upwards = ClusterInput()
water_table_plane_z_upwards_2 = Plane(water_table_plane_z_upwards)

# ---- group: Block rock properties
# INPUT
unit_weight_of_rock = ClusterInput()  # MN/m3

# ---- group: Joint properties
cohesion_of_joint_1 = ClusterInput()  # MPa
friction_angle_of_joint_1 = ClusterInput()  # degree

# ---- group: Seismic
k = ClusterInput()
direction_of_seismic_force = ClusterInput()

# ---- group: External Forces
individual_external_force_vectors = ClusterInput()

# ---- group: Shotcrete
trace_length_of_joint_1_on_slope_face = ClusterInput()  # m
trace_length_of_joint_2_on_slope_face = ClusterInput()  # m
shotcrete_thickness = ClusterInput()  # m
shotcrete_shear_strength = ClusterInput()  # MPa
area_where_slope_face_of_block_and_shotc = ClusterInput()  # m2
unit_weight_of_shotcrete = ClusterInput()  # MN/m3

# ---- group: Active support pressure
active_pressure_magnitude_on_slope_face = ClusterInput()  # MPa
trend_plunge_of_active_slope_pressure = ClusterInput()
active_pressure_magnitude_on_upper_face = ClusterInput()  # MPa
trend_plunge_of_active_upper_face_pressu = ClusterInput()

# ---- group: Bolt
capcaity_of_active_bolt = ClusterInput()  # MN
unit_direction_of_active_bolt = ClusterInput()
capacity_of_passive_bolt = ClusterInput()  # MN
unit_direction_of_passive_bolt = ClusterInput()

# ---- group: Passive support pressure
passive_pressure_magnitude_on_slope_face = ClusterInput()  # MPa
trend_plunge_of_passive_slope_pressure = ClusterInput()
passive_pressure_magnitude_on_upper_face = ClusterInput()  # MPa
trend_plunge_of_passive_upper_face_press = ClusterInput()

# ----
volume = ClusterInput()
volume_2 = Number(volume)

# ---- group: 2.2 - Block Weight Vector
gamma_r = Number(unit_weight_of_rock)
V = Number(volume_2)
g_cap = Vector("{0,0,-1}")
expression = Expression(gamma_r=gamma_r, V=V, g_cap=g_cap, Expression="(gamma_r*V)•g_cap")
W = Vector(expression)

# ---- group: 2.15 - Seismic Force Vector
e_cap_seismic = Vector(unitize(direction_of_seismic_force))
W_2 = Number(W)
# Pond Water Pressure not included.
k_2 = Number(k)
expression_2 = Expression(k=k_2, W=W_2, e_cap_seismic=e_cap_seismic, Expression="(k*W)•e_cap_seismic")
E = Vector(expression_2)

# ---- group: 2.16 - Active Bolt Force Vector
e_cap_bolt_active = Vector(unitize(unit_direction_of_active_bolt))
c_active = Number(capcaity_of_active_bolt)
multiplication = Multiplication(A=c_active, B=e_cap_bolt_active)
mass_addition = MassAddition(Input=multiplication)  # -> Result, PartialResults
b_a = Vector(mass_addition.Result)

# ---- group: 2.17 Shotcrete Weight Vector
a_s = Number(area_where_slope_face_of_block_and_shotc)
gamma_s = Number(unit_weight_of_shotcrete)
expression_3 = Expression(A_s=a_s, gamma_s=gamma_s, t=shotcrete_thickness, g_cap=g_cap, Expression="A_s*gamma_s*t*g_cap")
w_s = Vector(expression_3)

# ---- group: 2.3 - External Force Vector
c_i = Vector(individual_external_force_vectors)
mass_addition_2 = MassAddition(Input=flatten(c_i))  # -> Result, PartialResults
C = Vector(mass_addition_2.Result)

# ---- group: 2.23 - Passive Bolt Force Vector
e_cap_bolt_passive = Vector(unitize(unit_direction_of_passive_bolt))
c_passive = Number(capacity_of_passive_bolt)
multiplication_2 = Multiplication(A=c_passive, B=e_cap_bolt_passive)
mass_addition_3 = MassAddition(Input=multiplication_2)  # -> Result, PartialResults
b_p = Vector(mass_addition_3.Result)

# ---- group: Geometry
wedge_upper_face_mesh = ClusterInput()
wedge_slope_face_mesh = ClusterInput()
joint = ClusterInput()
block_brep = ClusterInput()
slope_dip = ClusterInput()
slope_dip_direction = ClusterInput()
joint_2 = Geometry(joint)
wedge_slope_face_mesh_2 = Mesh(wedge_slope_face_mesh)
wedge_upper_face_mesh_2 = Mesh(wedge_upper_face_mesh)
block_brep_2 = Brep(block_brep)
tension_crack_dip_direction = Number("0")
tension_crack_dip = Number("0")
slope_dip_2 = Number(slope_dip)
slope_dip_direction_2 = Number(slope_dip_direction)
list_item = ListItem(List=joint_2, Index=0, Wrap=True)  # -> flatten(Item)
mesh_dip_dipdirection = MeshDipDipDirection(mesh=list_item, round_to_nearest=False)  # -> dip_deg_2, dip_direction_deg_2, dip_dipdirection_2
joint_dip = Number(mesh_dip_dipdirection.dip_deg_2)
joint_dip_direction = Number(mesh_dip_dipdirection.dip_direction_deg_2)
area = Area(Geometry=wedge_slope_face_mesh_2)  # -> Area, Centroid
area_2 = Area(Geometry=wedge_upper_face_mesh_2)  # -> Area, Centroid
dip_dipdirection_to_plane = DipDipDirectionToPlane(dip_deg=slope_dip_2, dip_direction_deg=slope_dip_direction_2, origin=Point(353.9549866, 506.8420105, 44.99300003))  # -> plane_2, plane_normal_2
dip_dipdirection_to_plane_2 = DipDipDirectionToPlane(
    dip_deg=tension_crack_dip,
    dip_direction_deg=tension_crack_dip_direction,
    origin=Point(353.9549866, 506.8420105, 44.99300003))  # -> plane_2, plane_normal_2
list_length = ListLength(List=list_item)
number_of_joints = Integer(list_length)

# ---- group: In case block joint can be splitted into separated surfaces
area_3 = Area(Geometry=joint_2)  # -> Area, Centroid
first_last = FirstLast(List=area_3.Centroid)  # -> flatten(FirstValue), LastValue
mass_addition_4 = MassAddition(Input=area_3.Area)  # -> flatten(Result), PartialResults

# ---- group: 2.5 & 2.6 - Pressure Force (Active) Vector
p_s_active = Number(active_pressure_magnitude_on_slope_face)
a_s_2 = Number(area.Area)
n_cap_s_active = Vector(unitize(trend_plunge_of_active_slope_pressure))
a_u = Number(area_2.Area)
n_cap_u_active = Vector(unitize(trend_plunge_of_active_upper_face_pressu))
p_u_active = Number(active_pressure_magnitude_on_upper_face)
_3_1d_pressure_force_active_vector = Expression(
    p_s_active=p_s_active,
    a_s=a_s_2,
    n_cap_s_active=n_cap_s_active,
    p_u_active=p_u_active,
    a_u=a_u,
    n_cap_u_active=n_cap_u_active,
    Expression="p_s_active*a_s*n_cap_s_active+p_u_active*a_u*n_cap_u_active")
X = Vector(_3_1d_pressure_force_active_vector)

# ---- group: 2.19 & 2.20 Shotcrete Shear Resistance
n_cap_s = Vector(unitize(dip_dipdirection_to_plane.plane_normal_2))
l_1 = Number(trace_length_of_joint_1_on_slope_face)
tau_s = Number(shotcrete_shear_strength)
l_2 = Number(trace_length_of_joint_2_on_slope_face)
t = Number(shotcrete_thickness)
expression_4 = Expression(L_1=l_1, L_2=l_2, t=t, tau_s=tau_s, n_cap_s=n_cap_s, Expression="(L_1+L_2)*t*tau_s*n_cap_s")
Y = Vector(expression_4)

# ---- group: 2.21 & 2.22 - Pressure Force (Passive) Vector
n_cap_s_passive = Vector(unitize(trend_plunge_of_passive_slope_pressure))
n_cap_u_passive = Vector(unitize(trend_plunge_of_passive_upper_face_press))
p_s_passive = Number(passive_pressure_magnitude_on_slope_face)
p_u_passive = Number(passive_pressure_magnitude_on_upper_face)
_3_1d_pressure_force_active_vector_2 = Expression(
    p_s_passive=p_s_passive,
    a_s=a_s_2,
    n_cap_s_passive=n_cap_s_passive,
    p_u_passive=p_u_passive,
    a_u=a_u,
    n_cap_u_passive=n_cap_u_passive,
    Expression="p_s_passive*a_s*n_cap_s_passive+p_u_passive*a_u*n_cap_u_passive")
H = Vector(_3_1d_pressure_force_active_vector_2)

# ---- group: 3.1a - Active Force Vector / 2.18 - Passive Force Vector
# PASSIVE FORCE VECTOR
H_2 = Vector(H)
Y_2 = Vector(Y)
b_p_2 = Vector(b_p)
expression_5 = Expression(H=H_2, Y=Y_2, B_p=b_p_2, Expression="H+Y+B_p")
P = Vector(expression_5)

# ---- group: 4.4 & 4.6 / 4.1 & 4.3 & 4.6 & 4.7
number_of_joints_2 = Integer(number_of_joints)
duplicate_data = DuplicateData(Data="0", Number=number_of_joints_2, Order=True)
stable_normalforce = Number(duplicate_data)
falling_lifting_normalforce = Number(duplicate_data)

# ---- group: Geometry / Ensure normal vector points inwards
panel = Panel("True")

# ---- group: Geometry (continued)
dip_dipdirection_to_plane_3 = DipDipDirectionToPlane(dip_deg=joint_dip, dip_direction_deg=joint_dip_direction, origin=flatten(area_3.Centroid))  # -> plane_2, plane_normal_2
deconstruct_plane = DeconstructPlane(Plane=dip_dipdirection_to_plane_3.plane_2)  # -> Origin, XAxis, YAxis, ZAxis

# ---- group: Geometry / Ensure normal vector points inwards (continued)
multiplication_3 = Multiplication(A=dip_dipdirection_to_plane_3.plane_normal_2, B="0.02")
move = Move(Geometry=first_last.FirstValue, Motion=multiplication_3)  # -> Geometry, Transform
point_in_brep = PointInBrep(Brep=block_brep_2, Point=move.Geometry, Strict=invert(panel))
reverse = Reverse(Vector=dip_dipdirection_to_plane_3.plane_normal_2)
pick_n_choose = PickNChoose(Pattern=point_in_brep, Stream0=reverse, Stream1=dip_dipdirection_to_plane_3.plane_normal_2)

# ----
unit_vector = UnitVector(Vector=pick_n_choose)

# ---- group: Geometry (continued)
n_cap_i = Vector(unit_vector)

# ---- group: Joint water pressure w.r.t. ground water table (plane)
joint_water_pressure = JointWaterPressure(
    joint_brep_simplified_tree=joint_2,
    n_cap_i=n_cap_i,
    water_table_plane_z_upwards=water_table_plane_z_upwards_2,
    unit_weight_water_mn_m3="0.00981")  # -> peak_water_pressure_points_2, moved_peak_water_pressure_points_2, extrusion, average_water_pressure_2, wetted_area_2, joint_water_force_vector_2, sorted_data_path_2
mass_addition_5 = MassAddition(Input=flatten(joint_water_pressure.joint_water_force_vector_2))  # -> Result, PartialResults
U = Vector(mass_addition_5.Result)

# ---- group: 2.1 - Active Force Vector
C_2 = Vector(C)
U_2 = Vector(U)
b_a_2 = Vector(b_a)
w_s_2 = Vector(w_s)
# ACTIVE FORCE VECTOR
W_3 = Vector(W)
X_2 = Vector(X)
E_2 = Vector(E)
expression_6 = Expression(W=W_3, C=C_2, X=X_2, U=U_2, E=E_2, B_a=b_a_2, W_s=w_s_2, Expression="W+C+X+U+E+B_a+W_s")
A = Vector(expression_6)

# ----
panel_2 = Panel(joint_water_pressure.average_water_pressure_2)
point = Point(joint_water_pressure.peak_water_pressure_points_2)

# ---- group: Joint water pressure w.r.t. ground water table (plane) / Reorder water pressure into LIST based on joint order
list_length_2 = ListLength(List=joint_water_pressure.sorted_data_path_2)
equality = Equality(FirstNumber=list_length_2, SecondNumber="1")  # -> Equality, Inequality
tree_branch = TreeBranch(Tree=joint_water_pressure.average_water_pressure_2, Path=joint_water_pressure.sorted_data_path_2, MaintainPaths=False)
stream_filter = StreamFilter(Gate=equality.Equality, Stream0=tree_branch, Stream1=joint_water_pressure.average_water_pressure_2)  # -> flatten(Stream)

# ---- group: Get n_cap_i facing upwards
# REMOVABILTY OF BLOCK
xy_plane = XYPlane(Origin=area_3.Centroid)  # -> flatten(Plane)
flip_plane = FlipPlane(Plane=dip_dipdirection_to_plane_3.plane_2, Guide=xy_plane, FlipX=False, FlipY=False, FlipZ=True)  # -> Flipped, ResultBoolean
deconstruct_plane_2 = DeconstructPlane(Plane=flip_plane.Flipped)  # -> Origin, XAxis, YAxis, unitize(ZAxis)
n_cap_i_upwards = Vector(deconstruct_plane_2.ZAxis)

# ---- group: 3.2 - Sliding on a Single Face i
expression_7 = Expression(n_cap_i=n_cap_i, A=A, Expression="(n_cap_i┴A)┴n_cap_i")
s_cap_i = Vector(unitize(expression_7))

# ----
# Getting s_cap and n_cap og joint-pairs and other joints (Tree path = xref index)
n_cap_i_2 = Vector(unitize(n_cap_i))
s_cap_i_2 = Vector(unitize(s_cap_i))
list_indices = ListIndices(List=n_cap_i_2)
list_length_3 = ListLength(List=n_cap_i_2)
cross_reference = CrossReference(ListListA=list_indices, ListListB=list_indices, CrossMode=2)  # -> ListListA, ListListB
merge = Merge(Data1=graft(cross_reference.ListListA), Data2=graft(cross_reference.ListListB))  # -> simplify(Result)
subtraction = Subtraction(A=list_length_3, B="2")
expression_8 = Expression(number_k=subtraction, Expression="if(number_k=0,1,number_k)")
duplicate_data_2 = DuplicateData(Data=simplify(graft(cross_reference.ListListB)), Number=expression_8, Order=True)  # -> simplify(Data)
duplicate_data_3 = DuplicateData(Data=simplify(graft(cross_reference.ListListA)), Number=expression_8, Order=True)  # -> simplify(Data)
duplicate_data_4 = DuplicateData(Data=simplify(graft(cross_reference.ListListB)), Number=subtraction, Order=True)  # -> simplify(Data)
cull_index = CullIndex(List=list_indices, Indices=merge, Wrap=True)  # -> simplify(List)
i_xref = Integer(duplicate_data_2)
list_item_2 = ListItem(List=s_cap_i_2, Index=i_xref, Wrap=True)
list_item_3 = ListItem(List=n_cap_i_2, Index=i_xref, Wrap=True)
j_xref = Integer(duplicate_data_3)
list_item_4 = ListItem(List=s_cap_i_2, Index=j_xref, Wrap=True)
list_item_5 = ListItem(List=n_cap_i_2, Index=j_xref, Wrap=True)
k_xref = Integer(cull_index)
list_item_6 = ListItem(List=n_cap_i_2, Index=k_xref, Wrap=True)  # -> simplify(Item)
n_cap_j_xref = Vector(unitize(list_item_5))
n_cap_i_xref = Vector(unitize(list_item_3))
s_cap_j_xref = Vector(unitize(list_item_4))
n_cap_k = Vector(unitize(list_item_6))
s_cap_i_xref = Vector(unitize(list_item_2))

# ---- group: 3.10
expression_9 = Expression(s_cap_j_xref=s_cap_j_xref, n_cap_i_xref=n_cap_i_xref, Expression="s_cap_j_xref•n_cap_i_xref")  # -> simplify(case5)
case5 = Number(expression_9)

# ---- group: 3.4 & 3.7
expression_10 = Expression(A=A, n_cap_i=n_cap_i_2, Expression="A•n_cap_i")  # -> simplify(case1)
case1 = Number(expression_10)

# ---- group: 3.3 - Sliding on a Two Faces
expression_11 = Expression(n_cap_i_xref=n_cap_i_xref, n_cap_j_xref=n_cap_j_xref, A=A, Expression="(n_cap_i_xref┴n_cap_j_xref)•A")
expression_12 = Expression(x=expression_11, Expression="if(x≥0,1,-1)")
expression_13 = Expression(n_cap_i_xref=n_cap_i_xref, n_cap_j_xref=n_cap_j_xref, sign=expression_12, Expression="(n_cap_i_xref┴n_cap_j_xref)*sign")  # -> simplify(results)
s_cap_ij = Vector(unitize(expression_13))

# ---- group: Check if joint pairs are parallel
expression_14 = Expression(n_cap_i_xref=n_cap_i_xref, n_cap_j_xref=n_cap_j_xref, Expression="abs(n_cap_i_xref•n_cap_j_xref)")
panel_3 = Panel("0.00001")
equality_within_tolerance = EqualityWithinTolerance(FirstNumber=expression_14, SecondNumber="1", Tolerance=panel_3)  # -> Equality, Inequality
case0_if_non_parallel = Integer(equality_within_tolerance.Inequality)

# ---- group: 3.6
expression_15 = Expression(A=A, n_cap_k=n_cap_k, Expression="A•n_cap_k")  # -> simplify(case3)
case3 = Number(expression_15)

# ---- group: 3.1 - Falling (or Lifting)
# POSSIBLE SLIDING DIRECTIONS
A_2 = Vector(A)
s_cap_0 = Vector(unitize(A_2))

# ----
# VALID SLIDING DIRECTION
expression_16 = Expression(case1=case1, Expression="if(case1>0, 1, 0)")
mass_multiplication = MassMultiplication(Input=flatten(expression_16))  # -> Result, PartialResults
falling_lifting_sliding_direction = Vector(s_cap_0)
falling_lifting_boolean = Integer(mass_multiplication.Result)

# ----
# NORMAL FORCE
# Force Factor F
expression_17 = Expression(A=A, P=P, Expression="A+P")
F = Vector(expression_17)

# ---- group: 6.3 - Lifting Factor of Safety
s_cap_0_2 = Vector(s_cap_0)
expression_18 = Expression(P=P, A=A, s_cap_0=s_cap_0_2, Expression="(-P•s_cap_0)/(A•s_cap_0)")
fs_f = Number(expression_18)

# ---- group: 3.5
expression_19 = Expression(s_cap_ij=s_cap_ij, n_cap_k=n_cap_k, Expression="s_cap_ij•n_cap_k")  # -> simplify(case2)

# ---- group: 3.5 / ensure case2 to be positive if 1 or 2 input joints
includes = Includes(Value=number_of_joints, Domain="1 to 2")  # -> Includes, Deviation
replace_nulls = ReplaceNulls(Items=expression_19, Replacements="1")  # -> Items, Count
stream_filter_2 = StreamFilter(Gate=includes.Includes, Stream0=expression_19, Stream1=replace_nulls.Items)

# ---- group: 3.5 (continued)
case2 = Number(stream_filter_2)

# ---- group: 3.8 & 3.9
expression_20 = Expression(s_cap_i_xref=s_cap_i_xref, n_cap_j_xref=n_cap_j_xref, Expression="s_cap_i_xref•n_cap_j_xref")  # -> simplify(case4)
case4 = Number(expression_20)
equality_2 = Equality(FirstNumber=number_of_joints, SecondNumber="1")  # -> Equality, Inequality

# ---- group: 3.8 & 3.9 / ensure case4 to be positive if only 1 joint
replace_nulls_2 = ReplaceNulls(Items=case4, Replacements="1")  # -> Items, Count
stream_filter_3 = StreamFilter(Gate=equality_2.Equality, Stream0=case4, Stream1=replace_nulls_2.Items)

# ---- group: 3.8 & 3.9 (continued)
case4_2 = Number(stream_filter_3)

# ----
# For Bug Fixing
case1_2 = Panel(case1)
i_xref_2 = Panel(i_xref)
j_xref_2 = Panel(j_xref)
k_xref_2 = Panel(k_xref)
case_0_if_non_parallel = Panel(case0_if_non_parallel)
case2_2 = Panel(case2)
case3_2 = Panel(case3)
case4_3 = Panel(case4_2)
case5_2 = Panel(case5)

# ---- group: 1.1
i_xref_3 = Integer(i_xref)
j_xref_3 = Integer(j_xref)
k_xref_3 = Integer(k_xref)
list_item_7 = ListItem(List=n_cap_i_upwards, Index=i_xref_3, Wrap=True)  # -> simplify(Item)
list_item_8 = ListItem(List=n_cap_i_upwards, Index=j_xref_3, Wrap=True)  # -> simplify(Item)
list_item_9 = ListItem(List=n_cap_i_upwards, Index=k_xref_3, Wrap=True)  # -> simplify(Item)
expression_21 = Expression(n_cap_i_upwards=list_item_7, n_cap_j_upwards=list_item_8, Expression="n_cap_i_upwards┴n_cap_j_upwards")

# ----
dot_product = DotProduct(VectorA=expression_21, VectorB=list_item_9, Unitize=invert(False))  # -> simplify(graft(DotProduct))

# ---- group: 1.1 (continued)
absolute = Absolute(Value=dot_product)
division = Division(A=dot_product, B=absolute)
equality_within_tolerance_2 = EqualityWithinTolerance(FirstNumber=dot_product, SecondNumber="0", Tolerance=panel_3)  # -> Equality, Inequality
multiplication_4 = Multiplication(A=equality_within_tolerance_2.Inequality, B=division)
sign = Integer(multiplication_4)

# ---- group: I(a_k)
multiplication_5 = Multiplication(A=n_cap_i_upwards, B="0.02")
move_2 = Move(Geometry=first_last.FirstValue, Motion=multiplication_5)  # -> Geometry, Transform
point_in_brep_2 = PointInBrep(Brep=block_brep_2, Point=move_2.Geometry, Strict=invert(panel))
expression_22 = Expression(Inside=point_in_brep_2, Expression="If(Inside=False,-1,1)")  # -> flatten(Sign)
panel_4 = Panel(",")

# ---- group: Get sign for parallel joints
cull_pattern = CullPattern(List=i_xref_3, CullPattern=invert(case0_if_non_parallel))
count_unique = CountUnique(Key=flatten(cull_pattern), SortIfPossible=False, LastSaveLocalization="neutral,N")  # -> KeyList, Count
list_item_10 = ListItem(List=expression_22, Index=count_unique.KeyList, Wrap=True)
text_join = TextJoin(Text=list_item_10, Join=panel_4)
panel_5 = Panel(text_join)

# ---- group: I(a_k) (continued)
replace_items = ReplaceItems(List=expression_22, Item=text_join, Indices=count_unique.KeyList, Wrap=False)

# ----
text_tag = TextTag(Location=flatten(area_3.Centroid), Text=replace_items, Colour="black")
list_item_11 = ListItem(List=replace_items, Index=k_xref_3, Wrap=True)
text_split = TextSplit(Text=list_item_11, Separators=panel_4)  # -> simplify(Result)

# ---- group: 1.2
multiplication_6 = Multiplication(A=sign, B=text_split)

# ----
list_length_4 = ListLength(List=count_unique.KeyList)
if_parallel_joints = Boolean(list_length_4)
if_parallel_joints_2 = ClusterOutput(if_parallel_joints)

# ---- group: Check if every row of the testing matrix includes both positive and negative terms (i.e. no zeros = non-removable)
shift_to_depth = ShiftToDepth(Tree=multiplication_6, Depth="1", shiftFromStart=False)
min_max = MinMax(Number=shift_to_depth)  # -> Minimum, Maximum
panel_6 = Panel("2")
subtraction_2 = Subtraction(A=min_max.Maximum, B=min_max.Minimum)

# ----
equality_3 = Equality(FirstNumber=subtraction_2, SecondNumber=panel_6)  # -> Equality, Inequality

# ---- group: Check if every row of the testing matrix includes both positive and negative terms (i.e. no zeros = non-removable) (continued)
mass_multiplication_2 = MassMultiplication(Input=flatten(equality_3.Equality))  # -> Result, PartialResults

# ----
invert_boolean = InvertBoolean(Boolean=mass_multiplication_2.Result)  # -> Inverted, Number

# ---- group: If less than 3 joints, return True
larger_than = LargerThan(FirstNumber=number_of_joints, SecondNumber="3")  # -> LargerThan, OrEqualTo
pick_n_choose_2 = PickNChoose(Pattern=larger_than.LargerThan, Stream0="True", Stream1=invert_boolean.Inverted)

# ----
panel_7 = Panel(mass_multiplication_2.Result)
if_removable = Boolean(pick_n_choose_2)
if_removable_2 = ClusterOutput(if_removable)

larger_than_2 = LargerThan(FirstNumber=case2, SecondNumber="0")  # -> LargerThan, OrEqualTo

create_tree = CreateTree(Data=flatten(case4_2), Path=flatten(i_xref))
larger_than_3 = LargerThan(FirstNumber=create_tree, SecondNumber="0")  # -> LargerThan, OrEqualTo
tree_statistics = TreeStatistics(Tree=create_tree)  # -> Paths, Length, Count
mass_addition_6 = MassAddition(Input=larger_than_3.LargerThan)  # -> flatten(Result), PartialResults
first_last_2 = FirstLast(List=tree_statistics.Length)  # -> FirstValue, LastValue
equality_4 = Equality(FirstNumber=mass_addition_6.Result, SecondNumber=first_last_2.FirstValue)  # -> Equality, Inequality

# ---- group: Ensure case4GreaterThanZero = 1 if only one joint
stream_filter_4 = StreamFilter(Gate=equality_2.Equality, Stream0=equality_4.Equality, Stream1="1")

# ----
case4greaterthanzero = Number(stream_filter_4)
expression_23 = Expression(case1=case1, case4GreaterThanZero=case4greaterthanzero, Expression="if(case1≤0, 1, 0)*case4GreaterThanZero*3")
min_max_2 = MinMax(Number=flatten(expression_23))  # -> Minimum, Maximum
cull_pattern_2 = CullPattern(List=flatten(list_indices), CullPattern=flatten(expression_23))
singlejoint_boolean = Integer(min_max_2.Maximum)
singlejoint_index = Integer(cull_pattern_2)
list_item_12 = ListItem(List=s_cap_i, Index=singlejoint_index, Wrap=True)
singlejoint_sliding_direction = Vector(list_item_12)

panel_8 = Panel("0.00001")
equality_within_tolerance_3 = EqualityWithinTolerance(FirstNumber=case2, SecondNumber="0", Tolerance=panel_3)  # -> simplify(Equality), Inequality

if_case2_zero = Number(equality_within_tolerance_3.Equality)

expression_24 = Expression(
    case0=simplify(case0_if_non_parallel),
    if_case2_zero=if_case2_zero,
    case3=case3,
    Expression="case0*if_case2_zero*if(case3≤0, 1, 0)*2")
cull_pattern_3 = CullPattern(List=flatten(i_xref), CullPattern=flatten(expression_24))
cull_pattern_4 = CullPattern(List=flatten(j_xref), CullPattern=flatten(expression_24))
min_max_3 = MinMax(Number=flatten(expression_24))  # -> Minimum, Maximum
cull_pattern_5 = CullPattern(List=flatten(k_xref), CullPattern=flatten(expression_24))
cull_pattern_6 = CullPattern(List=flatten(s_cap_ij), CullPattern=flatten(expression_24))
merge_2 = Merge(Data1=cull_pattern_3, Data2=cull_pattern_4, Data3=cull_pattern_5)
count_unique_2 = CountUnique(Key=flatten(merge_2), SortIfPossible=False, LastSaveLocalization="neutral,N")  # -> flatten(KeyList), Count
first_last_3 = FirstLast(List=cull_pattern_6)  # -> FirstValue, LastValue
morethantwojoints_index = Integer(count_unique_2.KeyList)
morethantwojoints_boolean = Integer(min_max_3.Maximum)

morethantwojoints_sliding_direction = Vector(first_last_3.FirstValue)

# ----
# Sliding direction number, vector, and joint indices
null_values = NullValues(LastSaveLocalization="neutral,N")  # -> Null, NaN, Infinity, Infinity_2

# ---- group: Sliding direction VECTOR
null_values_2 = NullValues(LastSaveLocalization="neutral,N")  # -> Null, NaN, Infinity, Infinity_2

# ----
multiplication_7 = Multiplication(If_case2_not_zero=equality_within_tolerance_3.Inequality, B=larger_than_2.LargerThan)
mass_addition_7 = MassAddition(Input=multiplication_7)  # -> Result, PartialResults
duplicate_data_5 = DuplicateData(Data=simplify(graft(mass_addition_7.Result)), Number=expression_8, Order=True)  # -> simplify(Data)

# ---- group: 3.11
number_case2_greater_zero = Integer(duplicate_data_5)

# ----
expression_25 = Expression(
    number_case2_greater_zero=number_case2_greater_zero,
    number_k=expression_8,
    case4=case4_2,
    case5=case5,
    Expression="if(number_case2_greater_zero=number_k, 1, 0)*if(case4≤0, 1, 0)*if(case5≤0, 1, 0)*4")
cull_pattern_7 = CullPattern(List=flatten(i_xref), CullPattern=flatten(expression_25))
cull_pattern_8 = CullPattern(List=flatten(j_xref), CullPattern=flatten(expression_25))
min_max_4 = MinMax(Number=flatten(expression_25))  # -> Minimum, Maximum
merge_3 = Merge(Data1=cull_pattern_7, Data2=cull_pattern_8)  # -> flatten(Result)
cull_pattern_9 = CullPattern(List=flatten(s_cap_ij), CullPattern=flatten(expression_25))
count_unique_3 = CountUnique(Key=merge_3, SortIfPossible=False, LastSaveLocalization="neutral,N")  # -> KeyList, Count
first_last_4 = FirstLast(List=cull_pattern_9)  # -> FirstValue, LastValue
jointintersection_sliding_direction = Vector(first_last_4.FirstValue)
jointintersection_index = Integer(count_unique_3.KeyList)
jointintersection_boolean = Integer(min_max_4.Maximum)

mass_addition_8 = MassAddition(Input=flatten([falling_lifting_boolean, morethantwojoints_boolean, singlejoint_boolean, jointintersection_boolean]))  # -> Result, PartialResults

# ---- group: If not removable, returns 0
multiplication_8 = Multiplication(A=mass_addition_8.Result, B=if_removable)

# ----
sliding_direction_number = Integer(multiplication_8)
stream_filter_5 = StreamFilter(
    Gate=sliding_direction_number,
    Stream2=morethantwojoints_index,
    Stream3=singlejoint_index,
    Stream4=jointintersection_index)
cull_index_2 = CullIndex(List=list_indices, Indices=stream_filter_5, Wrap=False)
non_sliding_joint_index = Integer(cull_index_2)
sliding_joint_index = Integer(stream_filter_5)

# ---- group: 4.4 & 4.6
# Normal Force
sliding_joint_index_2 = Integer(sliding_joint_index)
sliding_direction = Integer(sliding_direction_number)
n_cap_i_3 = Vector(unitize(n_cap_i))

# ---- group: Sliding direction VECTOR (continued)
stream_filter_6 = StreamFilter(
    Gate=sliding_direction,
    Stream0=null_values_2.NaN,
    Stream1=falling_lifting_sliding_direction,
    Stream2=morethantwojoints_sliding_direction,
    Stream3=singlejoint_sliding_direction,
    Stream4=jointintersection_sliding_direction)
s_cap = Vector(unitize(stream_filter_6))

# ---- group: 4.4 & 4.6 / 4.2
list_item_13 = ListItem(List=n_cap_i_3, Index=sliding_joint_index_2, Wrap=True)
expression_26 = Expression(F=F, n_cap_i=list_item_13, Expression="-F•n_cap_i")
replace_items_2 = ReplaceItems(List=duplicate_data, Item=expression_26, Indices=sliding_joint_index_2, Wrap=False)
singlejoint_normalforce = Number(replace_items_2)

# ---- group: 4.4 & 4.6 / 4.7 / Ensure normal vectors pointing downwards
deconstruct_vector = DeconstructVector(Vector=list_item_13)  # -> XComponent, YComponent, ZComponent
smaller_than = SmallerThan(FirstNumber=deconstruct_vector.ZComponent, SecondNumber="0")  # -> SmallerThan, OrEqualTo
reverse_2 = Reverse(Vector=list_item_13)
pick_n_choose_3 = PickNChoose(Pattern=smaller_than.SmallerThan, Stream0=reverse_2, Stream1=list_item_13)
normal_force_vector_downwards = Vector(pick_n_choose_3)

# ---- group: 4.4 & 4.6 / 4.7
# Plunge
sliding_direction_vector = Vector(s_cap)
xy_plane_2 = XYPlane(Origin=Point(0, 0, 0))
project = Project(Geometry=sliding_direction_vector, Plane=xy_plane_2)  # -> Geometry, Transform
angle = Angle(VectorA=project.Geometry, VectorB=sliding_direction_vector)  # -> Angle, Reflex
degrees = Degrees(Radians=angle.Angle)
plunge = Panel(degrees)

# Construction XY and YZ Planes
# X along sliding direction
# Y horizontal
sliding_direction_vector_2 = Vector(s_cap)
plane_normal = PlaneNormal(Origin=Point(0, 0, 0), ZAxis=sliding_direction_vector_2)
xy_plane_3 = XYPlane(Origin=Point(0, 0, 0))
plane_plane = PlanePlane(PlaneA=plane_normal, PlaneB=xy_plane_3)
construct_plane = ConstructPlane(Origin=Point(0, 0, 0), XAxis=sliding_direction_vector_2, YAxis=plane_plane)
case_xy_plane = Plane(construct_plane)
deconstruct_plane_3 = DeconstructPlane(Plane=case_xy_plane)  # -> Origin, XAxis, YAxis, ZAxis
construct_plane_2 = ConstructPlane(Origin=deconstruct_plane_3.Origin, XAxis=deconstruct_plane_3.YAxis, YAxis=deconstruct_plane_3.ZAxis)
case_yz_plane = Plane(construct_plane_2)

# theta_l
normal_force_vector_downwards_2 = Vector(normal_force_vector_downwards)
angle_2 = Angle(VectorA=normal_force_vector_downwards_2, VectorB=deconstruct_plane_3.YAxis, Plane=construct_plane_2)  # -> Angle, Reflex
degrees_2 = Degrees(Radians=angle_2.Angle)

# L
plane_normal_2 = PlaneNormal(Origin=Point(0, 0, 0), ZAxis=normal_force_vector_downwards)
joint_plane_facing_downwards = Plane(plane_normal_2)
case_yz_plane_2 = Plane(construct_plane_2)
plane_plane_2 = PlanePlane(PlaneA=case_yz_plane_2, PlaneB=joint_plane_facing_downwards)
length = Length(Curve=plane_plane_2)

# ---- group: Driving force
# FACTOR OF SAFETY
A_3 = Expression(A=A, s_cap=s_cap, Expression="A•s_cap")
null_item = NullItem(Item=A_3)  # -> NullFlags, InvalidFlags, Description
stream_filter_7 = StreamFilter(Gate=null_item.NullFlags, Stream0=A_3, Stream1="0")

# ---- group: 4.4 & 4.6
first_last_5 = FirstLast(List=list_item_13)  # -> FirstValue, LastValue

# ---- group: 4.4 & 4.6 / 4.4
expression_27 = Expression(
    F=F,
    n_cap_1=first_last_5.FirstValue,
    n_cap_2=first_last_5.LastValue,
    Expression="-((F┴n_cap_2)•(n_cap_1┴n_cap_2))/((n_cap_1┴n_cap_2)•(n_cap_1┴n_cap_2))")

# ---- group: 4.4 & 4.6 / 4.5
expression_28 = Expression(
    F=F,
    n_cap_1=first_last_5.FirstValue,
    n_cap_2=first_last_5.LastValue,
    Expression="-((F┴n_cap_1)•(n_cap_2┴n_cap_1))/((n_cap_2┴n_cap_1)•(n_cap_2┴n_cap_1))")

# ---- group: 4.4 & 4.6 (continued)
n_i_xref = Number(expression_27)
n_j_xref = Number(expression_28)
merge_4 = Merge(Data1=n_i_xref, Data2=n_j_xref)
replace_items_3 = ReplaceItems(List=duplicate_data, Item=merge_4, Indices=sliding_joint_index_2, Wrap=False)
jointintersection_normalforce = Number(replace_items_3)

# ---- group: 4.4 & 4.6 / 4.7
# Normal force calculation by Mauldon & Ureta 1996
theta_l_deg_wedge_x = Panel(degrees_2)
theta_r_wedge_x = Panel("90")
l_m_wedge_x = Panel(length)
plunge_wedge_x = Panel(degrees)
deconstruct_vector_2 = DeconstructVector(Vector=F)  # -> XComponent, YComponent, ZComponent
absolute_2 = Absolute(Value=deconstruct_vector_2.ZComponent)
w_wedge_x = Panel(absolute_2)
radians = Radians(Degrees=plunge_wedge_x)
expression_29 = Expression(plunge=radians, W=w_wedge_x, Expression="W*cos(plunge)")

# ---- group: Numerical analysis takes time. Only enabled when needed.
equality_5 = Equality(FirstNumber=sliding_direction_number, SecondNumber="2")  # -> Equality, Inequality
multiple_sliding_surface_normal_force_di = MultipleSlidingSurfaceNormalForceDistribution(
    activate=equality_5.Equality,
    l_m=l_m_wedge_x,
    theta_l_deg=theta_l_deg_wedge_x,
    theta_r_deg=theta_r_wedge_x,
    r_n_mn=expression_29)  # -> n_l_2, num_theta_s_2; "Multiple sliding surface normal Force Distribution"

# ---- group: 4.4 & 4.6 / 4.7 (continued)
panel_9 = Panel(multiple_sliding_surface_normal_force_di.n_l_2)
panel_10 = Panel(multiple_sliding_surface_normal_force_di.num_theta_s_2)
replace_items_4 = ReplaceItems(List=duplicate_data, Item=multiple_sliding_surface_normal_force_di.n_l_2, Indices=sliding_joint_index_2, Wrap=False)
multiplejoint_normalforce = Number(replace_items_4)

# ---- group: 4.4 & 4.6 (continued)
stream_filter_8 = StreamFilter(
    Gate=sliding_direction,
    Stream0=stable_normalforce,
    Stream1=falling_lifting_normalforce,
    Stream2=multiplejoint_normalforce,
    Stream3=singlejoint_normalforce,
    Stream4=jointintersection_normalforce)
n_i = Number(stream_filter_8)

# ---- group: 5.1- Normal stress on Each Joint
# SHEAR STRENGTH
expression_30 = Expression(N_i=n_i, a_i=mass_addition_4.Result, Expression="N_i/a_i")
sigma_n_i = Number(expression_30)

# ---- group: 5.2 -Shear Strength of Each Joint (Mohr-Coulomb)
c_i_2 = Number(cohesion_of_joint_1)
phi_i = Number(friction_angle_of_joint_1)
radians_2 = Radians(Degrees=phi_i)
expression_31 = Expression(c_i=c_i_2, sigma_n_i=sigma_n_i, Phi_i=radians_2, Expression="c_i+sigma_n_i*tan(Phi_i)")
larger_than_4 = LargerThan(FirstNumber=sigma_n_i, SecondNumber="0")  # -> LargerThan, OrEqualTo
multiplication_9 = Multiplication(A=expression_31, B=larger_than_4.LargerThan)
tau_i = Number(multiplication_9)

# ---- group: 5.16 - Resisting Force due to Shear Strength
angle_3 = Angle(VectorA=s_cap, VectorB=deconstruct_plane.YAxis)  # -> Angle, Reflex
a_i = Number(flatten(area_3.Area))
theta_i = Number(angle_3.Angle)
expression_32 = Expression(tau_i=tau_i, a_i=a_i, theta_i=theta_i, Expression="tau_i*a_i")
mass_addition_9 = MassAddition(Input=expression_32)  # -> Result, PartialResults
j_i = Number(mass_addition_9.Result)
null_item_2 = NullItem(Item=j_i)  # -> NullFlags, InvalidFlags, Description
stream_filter_9 = StreamFilter(Gate=null_item_2.NullFlags, Stream0=j_i, Stream1="0")

# ---- group: 6.4 - Unsupported Factor of Safety
resisting_force = Number(j_i)
driving_force = Number(stream_filter_7)
division_2 = Division(A=resisting_force, B=driving_force)
fs_u = Number(division_2)

# ----
# New definition of FS (Li & Høien 2023)
expression_33 = Expression(
    H=H,
    Y=Y,
    B_p=b_p,
    B_a=b_a,
    X=X,
    W=W,
    C=C,
    U=U,
    E=E,
    W_s=w_s,
    s_cap=s_cap,
    J_i=j_i,
    Expression="(J_i-((H+Y+B_p+B_a+X)•s_cap))/((W+U+E+W_s+C)•s_cap)")
fs_s = Number(expression_33)

# ---- group: 6.1 - Factor of Safety
fs_u_2 = Number(fs_u)
fs_s_2 = Number(fs_s)
fs_f_2 = Number(fs_f)

# ----
# Unconditionally stable: returns FS = 100 if s_cap is {0,0,0}
vector_length = VectorLength(Vector=s_cap)
equality_6 = Equality(FirstNumber=vector_length, SecondNumber="0")  # -> Equality, Inequality

multiplication_10 = Multiplication(A=equality_6.Equality, B="100")

_0_or_9999 = Integer(multiplication_10)

# ---- group: 6.1 - Factor of Safety (continued)
entwine = Entwine(Branch00=fs_f_2, Branch01=fs_u_2, Branch02=fs_s_2, Branch03=_0_or_9999, FlattenInputs=True)  # -> flatten(Result)
min_max_5 = MinMax(Number=entwine)  # -> Minimum, Maximum
fs = Number(min_max_5.Maximum)

# ----
# Sliding direction number:
# 0 = Unconditionally stable
# 1 = Falling or lifting
# 2 = Sliding on more than two joints
# 3 = Sliding on single joint
# 4 = Sliding on joint intersection
sliding_joint_index_3 = Integer(stream_filter_5)
resisting_force_2 = Number(stream_filter_9)
driving_force_2 = Number(stream_filter_7)
# OUTPUT
fs_2 = Number(fs)
sliding_direction_number_2 = Integer(sliding_direction_number)
sliding_direction_unit_vector = Vector(s_cap)
shear_resistance_on_joints_mn = Number(expression_32)
normal_force_joints_mn = Number(n_i)
water_pressure_mpa = Number(stream_filter)
text_join_2 = TextJoin(Text=sliding_joint_index_3, Join=",")
first_last_6 = FirstLast(List=sliding_joint_index_3)  # -> FirstValue, LastValue
null_item_3 = NullItem(Item=first_last_6.FirstValue)  # -> NullFlags, InvalidFlags, Description
resisting_force_3 = Panel(resisting_force_2)
driving_force_3 = Panel(driving_force_2)
fs_3 = Panel(fs_2)
sliding_direction_number_3 = Panel(sliding_direction_number_2)
sliding_direction_unit_vector_2 = Panel(sliding_direction_unit_vector)
text_join_3 = TextJoin(Text=shear_resistance_on_joints_mn, Join=",")
text_join_4 = TextJoin(Text=normal_force_joints_mn, Join=",")
text_join_5 = TextJoin(Text=water_pressure_mpa, Join=",")
pick_n_choose_4 = PickNChoose(Pattern=null_item_3.NullFlags, Stream0=text_join_2, Stream1="Null")
sliding_joint_index_4 = Text(pick_n_choose_4)
sliding_direction_number_4 = ClusterOutput(sliding_direction_number_2)  # Sliding direction number: 0 = Unconditionally stable; 1 = Falling or lifting; 2 = Sliding on more than two joints; 3 = Sliding on single joint; 4 = Sliding on joint intersection
sliding_direction_unit_vector_3 = ClusterOutput(sliding_direction_unit_vector)
normal_force_on_joints_mn = Panel(text_join_4)
shear_resistance_on_joints_mn_2 = Panel(text_join_3)
resisting_force_4 = ClusterOutput(resisting_force_2)
factor_of_safety = ClusterOutput(fs_2)
driving_force_4 = ClusterOutput(driving_force_2)
sliding_joint_index_5 = ClusterOutput(sliding_joint_index_4)
sliding_joint_index_6 = Panel(pick_n_choose_4)
water_pressure_on_joints_mpa = Panel(text_join_5)
normal_force_on_joints_mn_2 = Text(text_join_4)
water_pressure_on_joints_mpa_2 = Text(text_join_5)
shear_resistance_on_joints_mn_3 = Text(text_join_3)
normal_force_on_joints_mn_3 = ClusterOutput(normal_force_on_joints_mn_2)
shear_resistance_on_joints_mn_4 = ClusterOutput(shear_resistance_on_joints_mn_3)
water_pressure_on_joints_mpa_3 = ClusterOutput(water_pressure_on_joints_mpa_2)

# ==== cluster DipDipDirectionToPlane

dip_deg = ClusterInput()
dip_direction_deg = ClusterInput()
origin = ClusterInput()
dip_direction_deg_2 = Number(dip_direction_deg)
dip_deg_2 = Number(dip_deg)
origin_2 = Point(origin)

# ---- group: Rotate plane to specific dip
xy_plane = XYPlane(Origin=origin_2)
radians = Radians(Degrees=dip_deg_2)
negative = Negative(Value=radians)
yz_plane = YZPlane(Origin=origin_2)
rotate = Rotate(Geometry=xy_plane, Angle=negative, Plane=yz_plane)  # -> Geometry, Transform

# ---- group: Rotate plane to specific dip direction (y-axis of plane)
radians_2 = Radians(Degrees=dip_direction_deg_2)
negative_2 = Negative(Value=radians_2)
rotate_2 = Rotate(Geometry=rotate.Geometry, Angle=negative_2, Plane=xy_plane)  # -> Geometry, Transform
face_normals = FaceNormals(Mesh=rotate_2.Geometry)  # -> Centers, flatten(Normals)

# ----
plane = Plane(rotate_2.Geometry)
plane_2 = ClusterOutput(plane)

plane_normal = Vector(face_normals.Normals)
plane_normal_2 = ClusterOutput(plane_normal)

# ==== cluster MeshDipDipDirection: Calculate dip and direction of mesh

# ---- group: Inputs
mesh = ClusterInput()
round_to_nearest = ClusterInput()
no_of_decimal_place = ClusterInput()
round_to_nearest_2 = Boolean(round_to_nearest)
no_of_decimal_place_2 = Integer(no_of_decimal_place)
mesh_2 = Mesh(mesh)

# ---- group: Get arithmetic mean of normal for each mesh
face_normals = FaceNormals(Mesh=mesh_2)  # -> Centers, Normals
average = Average(Input=face_normals.Normals)  # -> flatten(ArithmeticMean)

# ---- group: Obtain horisontal components; ensure vector length greater than zero
deconstruct_vector = DeconstructVector(Vector=average)  # -> XComponent, YComponent, ZComponent
vector_xyz = VectorXYZ(XComponent=deconstruct_vector.XComponent, YComponent=deconstruct_vector.YComponent, ZComponent=0)  # -> Vector, Length
vector_length = VectorLength(Vector=vector_xyz.Vector)
dup = DuplicateDataMatch(SourceDataTree=vector_xyz.Vector, SecondaryDataSecondaryData1="{0,1,0}")  # -> SourceData, SecondaryDataSecondaryData1
equality = Equality(FirstNumber=vector_length, SecondNumber="0")  # -> Equality, Inequality
pick_n_choose = PickNChoose(Pattern=equality.Equality, Stream0=vector_xyz.Vector, Stream1=<missing>)

# ---- group: Dip direction calculation
larger_than = LargerThan(FirstNumber=deconstruct_vector.ZComponent, SecondNumber="0")  # -> LargerThan, OrEqualTo
reverse = Reverse(Vector=pick_n_choose)
pick_n_choose_2 = PickNChoose(Pattern=larger_than.LargerThan, Stream0=reverse, Stream1=pick_n_choose)
unit_y = UnitY(Factor=1)
deconstruct_vector_2 = DeconstructVector(Vector=pick_n_choose_2)  # -> XComponent, YComponent, ZComponent
larger_than_2 = LargerThan(FirstNumber=deconstruct_vector_2.XComponent, SecondNumber="0")  # -> LargerThan, OrEqualTo
angle = Angle(VectorA=unit_y, VectorB=pick_n_choose_2)  # -> Angle, Reflex
pick_n_choose_3 = PickNChoose(Pattern=larger_than_2.LargerThan, Stream0=angle.Reflex, Stream1=angle.Angle)
degrees = Degrees(Radians=pick_n_choose_3)
addition = Addition(A=degrees)

# ---- group: Dip angle calculation
angle_2 = Angle(VectorA=pick_n_choose, VectorB=average)  # -> Angle, Reflex
degrees_2 = Degrees(Radians=angle_2.Angle)
subtraction = Subtraction(A="90", B=degrees_2)
absolute = Absolute(Value=subtraction)

# ---- group: Dip: Replace with null if null; rounding
null_item = NullItem(Item=degrees_2)  # -> NullFlags, InvalidFlags, Description
round_to_decimal_place = RoundToDecimalPlace(NumberX=absolute, DecimalPlace=no_of_decimal_place_2, RoundType=0)  # -> Rounded, Difference
list_indices = ListIndices(List=null_item.NullFlags)
cull_pattern = CullPattern(List=list_indices, CullPattern=null_item.NullFlags)
replace_items = ReplaceItems(List=absolute, Indices=cull_pattern, Wrap=False)
replace_items_2 = ReplaceItems(List=round_to_decimal_place.Rounded, Indices=cull_pattern, Wrap=False)
stream_filter = StreamFilter(Gate=round_to_nearest_2, Stream0=replace_items, Stream1=replace_items_2)

# ---- group: Dip Direction: Replace with null if null; rounding
null_item_2 = NullItem(Item=degrees_2)  # -> NullFlags, InvalidFlags, Description
round_to_decimal_place_2 = RoundToDecimalPlace(NumberX=addition, DecimalPlace=no_of_decimal_place_2, RoundType=0)  # -> Rounded, Difference
list_indices_2 = ListIndices(List=null_item_2.NullFlags)
cull_pattern_2 = CullPattern(List=list_indices_2, CullPattern=null_item_2.NullFlags)
replace_items_3 = ReplaceItems(List=round_to_decimal_place_2.Rounded, Indices=cull_pattern_2, Wrap=False)
replace_items_4 = ReplaceItems(List=degrees, Indices=cull_pattern_2, Wrap=False)
stream_filter_2 = StreamFilter(Gate=round_to_nearest_2, Stream0=replace_items_4, Stream1=replace_items_3)

# ---- group: Output-numeric
dip_deg = Number(stream_filter)
dip_direction_deg = Number(stream_filter_2)
dip_deg_2 = ClusterOutput(dip_deg)
dip_direction_deg_2 = ClusterOutput(dip_direction_deg)

# ---- group: Output-text
concatenate = Concatenate(Fragment_A=dip_deg, A="/", Fragment_B=dip_direction_deg)
dip_dipdirection = Text(concatenate)
dip_dipdirection_2 = ClusterOutput(dip_dipdirection)

# ==== cluster MultipleSlidingSurfaceNormalForceDistribution
activate = ClusterInput()
l_m = ClusterInput()  # Length of each contact plane in the YZ plane.
theta_l_deg = ClusterInput()  # Angle of each plane measured from the positive X axis.
r_n_mn = ClusterInput()  # Resultant active force acting on the rock block perpendicular to the sliding direction.
theta_r_deg = ClusterInput()  # Angle defining the direction of the resultant force.
# Mauldon & Ureta 1996
activate_2 = Boolean(activate)
theta_r_deg_2 = Number(theta_r_deg)
theta_l_deg_2 = EleFrontDataDescription(theta_l_deg, ShiftDepth=0, isNameSet=False)
l_m_2 = Number(l_m)
r_n_mn_2 = Number(r_n_mn)
null_values = NullValues(LastSaveLocalization="neutral,N")  # -> Null, NaN, Infinity, Infinity_2
stream_filter = StreamFilter(Gate=activate_2, Stream0=null_values.Null, Stream1="0")
series = Series(Start=stream_filter, Step="0.1", Count="3600")
theta_s = Number(series)
expression = Expression(theta_s=graft(theta_s), theta_l=theta_l_deg_2, Expression="(theta_s-theta_l)*π/180")
expression_2 = Expression(theta_s=graft(theta_s), theta_r=theta_r_deg_2, Expression="tan((theta_s-theta_r)*π/180)")
x = Number(expression)
expression_3 = Expression(L=l_m_2, x=x, Expression="L*sin(x)*cos(x)")
expression_4 = Expression(L=l_m_2, x=x, Expression="L*(cos(x))²")
mass_addition = MassAddition(Input=expression_3)  # -> Result, PartialResults
mass_addition_2 = MassAddition(Input=expression_4)  # -> Result, PartialResults
division = Division(A=mass_addition.Result, B=mass_addition_2.Result)
subtraction = Subtraction(A=division, B=expression_2)  # -> flatten(Result)
absolute = Absolute(Value=subtraction)
sort_list = SortList(Keys=absolute, ValuesValuesA=theta_s)  # -> Keys, ValuesValuesA
first_last = FirstLast(List=sort_list.ValuesValuesA)  # -> FirstValue, LastValue
num_theta_s = Number(first_last.FirstValue)
expression_5 = Expression(num_theta_s=num_theta_s, theta_l=theta_l_deg_2, L=l_m_2, Expression="L*cos((num_theta_s-theta_l)*π/180)²")
mass_addition_3 = MassAddition(Input=expression_5)  # -> Result, PartialResults
expression_6 = Expression(
    num_theta_s=num_theta_s,
    theta_r=theta_r_deg_2,
    R_N=r_n_mn_2,
    eq_16=mass_addition_3.Result,
    Expression="R_N*(cos((num_theta_s-theta_r)*π/180)/eq_16)")
expression_7 = Expression(
    s=expression_6,
    L=l_m_2,
    num_theta_s=num_theta_s,
    theta_l=theta_l_deg_2,
    Expression="s*L*cos((num_theta_s-theta_l)*π/180)")
n_l = Number(expression_7)
n_l_2 = ClusterOutput(n_l)  # Normal force on sliding surface
num_theta_s_2 = ClusterOutput(num_theta_s)

# ==== cluster JointWaterPressure
# JOINT WATER PRESSURE % FILLED
joint_brep_simplified_tree = ClusterInput()
n_cap_i = ClusterInput()
water_table_plane_z_upwards = ClusterInput()
unit_weight_water_mn_m3 = ClusterInput()
joint_brep_simplified_tree_2 = Brep(joint_brep_simplified_tree)

# ---- group: normal pointing inwards
n_cap_i_2 = Vector(n_cap_i)

# ----
unit_weight_water_mn_m3_2 = Number(unit_weight_water_mn_m3)
water_table_plane_z_upwards_2 = Plane(water_table_plane_z_upwards)
reverse = Reverse(Vector=n_cap_i_2)

# ---- group: All line of intersections
cross_reference = CrossReference(ListListA=flatten(joint_brep_simplified_tree_2), ListListB=flatten(joint_brep_simplified_tree_2), CrossMode=7)  # -> ListListA, ListListB
brep_brep = BrepBrep(BrepA=cross_reference.ListListA, BrepB=cross_reference.ListListB)  # -> simplify(Curves), Points

# ---- group: Trim joint breps above water level
plane_trim_surface = PlaneTrimSurface(Surface=joint_brep_simplified_tree_2, Plane=water_table_plane_z_upwards_2, Flip=invert(False))  # -> simplify(Trimmed), Intersected
area = Area(Geometry=plane_trim_surface.Trimmed)  # -> Area, Centroid
point_plane_side = PointPlaneSide(Point=area.Centroid, Plane=water_table_plane_z_upwards_2)  # -> Side, Front, Back, Distance
cull_pattern = CullPattern(List=plane_trim_surface.Trimmed, CullPattern=simplify(point_plane_side.Back))
trimmed_surfaces = Surface(cull_pattern)

# ---- group: Plane normal
is_planar = IsPlanar(Surface=joint_brep_simplified_tree_2, Interior=True)  # -> Planar, Plane

# ----
cross_reference_2 = CrossReference(ListListA=flatten(trimmed_surfaces), ListListB=flatten(trimmed_surfaces), CrossMode=7)  # -> ListListA, ListListB
brep_brep_2 = BrepBrep(BrepA=cross_reference_2.ListListA, BrepB=cross_reference_2.ListListB)  # -> simplify(Curves), Points
shift_to_depth = ShiftToDepth(Tree=trimmed_surfaces, Depth="1", shiftFromStart=False)
tree_statistics = TreeStatistics(Tree=shift_to_depth)  # -> Paths, Length, Count
sort_list = SortList(Keys=tree_statistics.Length, ValuesValuesA=tree_statistics.Paths)  # -> reverse(Keys), reverse(ValuesValuesA)

# ---- group: Get mid-height point for single plane
bounding_rectangle = BoundingRectangle(Geometry=trimmed_surfaces, Plane=PlaneXY(0, 0, 0), Axis=0, Slide=Slider(0.5, range=0..1), Union=True)  # -> Bounding, DimensionX, DimensionY
brep_brep_3 = BrepBrep(BrepA=trimmed_surfaces, BrepB=bounding_rectangle.Bounding)  # -> Curves, Points
curve_middle = CurveMiddle(Curve=brep_brep_3.Curves)  # -> flatten(Midpoint)

# ---- group: If only one joint?
null_item = NullItem(Item=flatten(brep_brep_2.Curves))  # -> NullFlags, InvalidFlags, Description

# ----
mass_addition = MassAddition(Input=null_item.NullFlags)  # -> Result, PartialResults
sorted_data_path = DataPath(sort_list.ValuesValuesA)
sorted_data_path_2 = ClusterOutput(sorted_data_path)

# ----
# Get peak water pressure points
line_of_intersections = Curve(flatten(brep_brep_2.Curves))
multiple_curves = MultipleCurves(Curves=line_of_intersections)  # -> Points, IndexA, IndexB, ParamA, ParamB

# ---- group: If NOT networked lines of intersection, return mid-point
count_unique = CountUnique(Key=[multiple_curves.IndexA, multiple_curves.IndexB], SortIfPossible=False, LastSaveLocalization="neutral,N")  # -> KeyList, Count
cull_index = CullIndex(List=line_of_intersections, Indices=count_unique.KeyList, Wrap=True)
curve_middle_2 = CurveMiddle(Curve=cull_index)  # -> flatten(Midpoint)

# ---- group: If networked lines of intersection, return coincident point
count_unique_2 = CountUnique(Key=multiple_curves.Points, SortIfPossible=False, LastSaveLocalization="neutral,N")  # -> flatten(KeyList), Count

# ----
merge = Merge(Data1=count_unique_2.KeyList, Data2=curve_middle_2)  # -> flatten(Result)

stream_filter = StreamFilter(Gate=mass_addition.Result, Stream0=merge, Stream1=curve_middle)
peak_water_pressure_points = Point(stream_filter)

# ---- group: Determine water head on peak water pressure points
pull_point = PullPoint(Point=peak_water_pressure_points, Geometry=water_table_plane_z_upwards_2, ClosestOnly=True)  # -> ClosestPoint, Distance

# ----
multiplication = Multiplication(A=pull_point.Distance, B=unit_weight_water_mn_m3_2)

# ---- group: If water pressure peak point in on plane (returns 0)
point_plane_side_2 = PointPlaneSide(Point=peak_water_pressure_points, Plane=is_planar.Plane)  # -> Side, Front, Back, Distance

# ---- group: Vector for extruding peak water pressure points for each joint
cull_pattern_2 = CullPattern(List=multiplication, CullPattern=invert(point_plane_side_2.Side))
amplitude = Amplitude(Vector=simplify(graft(reverse)), Amplitude=cull_pattern_2)

# ---- group: Peak water pressure points for each joint
cull_pattern_3 = CullPattern(List=peak_water_pressure_points, CullPattern=invert(point_plane_side_2.Side))

# ---- group: sort tree such that path 0 is not empty
tree_branch = TreeBranch(Tree=simplify(trimmed_surfaces), Path=sort_list.ValuesValuesA, MaintainPaths=False)
tree_branch_2 = TreeBranch(Tree=simplify(cull_pattern_3), Path=sort_list.ValuesValuesA, MaintainPaths=False)
tree_branch_3 = TreeBranch(Tree=simplify(amplitude), Path=sort_list.ValuesValuesA, MaintainPaths=False)
stream_filter_2 = StreamFilter(Gate=mass_addition.Result, Stream0=tree_branch, Stream1=trimmed_surfaces)  # -> simplify(Stream)
stream_filter_3 = StreamFilter(Gate=mass_addition.Result, Stream0=tree_branch_2, Stream1=cull_pattern_3)  # -> simplify(Stream)
stream_filter_4 = StreamFilter(Gate=mass_addition.Result, Stream0=tree_branch_3, Stream1=amplitude)  # -> simplify(Stream)

# ----
vector_display = VectorDisplay(Anchor=stream_filter_3, Vector=stream_filter_4)
area_2 = Area(Geometry=stream_filter_2)  # -> Area, Centroid
extrude_to_1_2_points = ExtrudeTo12Points(joint_brep_tree=stream_filter_2, peak_pressure_points_tree=stream_filter_3, peak_pressure_vectors_tree=stream_filter_4)
move = Move(Geometry=stream_filter_3, Motion=stream_filter_4)  # -> Geometry, Transform
addition = Addition(A=area_2.Area, B="0")
volume = Volume(Geometry=extrude_to_1_2_points)  # -> Volume, Centroid
wetted_area = Number(addition)
replace_items = ReplaceItems(List=wetted_area, Item="0", Indices="0", Wrap=False)  # -> simplify(List)
moved_peak_water_pressure_points = Point(move.Geometry)
addition_2 = Addition(A=volume.Volume, B=replace_items)
amplitude_2 = Amplitude(Vector=simplify(graft(n_cap_i_2)), Amplitude=addition_2)  # -> simplify(Vector)
peak_water_pressure_points_2 = ClusterOutput(peak_water_pressure_points)
extrusion = ClusterOutput(extrude_to_1_2_points)
division = Division(A=addition_2, B=wetted_area)
joint_water_force_vector = Vector(amplitude_2)
moved_peak_water_pressure_points_2 = ClusterOutput(moved_peak_water_pressure_points)
addition_3 = Addition(A=division, B="0")
average_water_pressure = Number(addition_3)
joint_water_force_vector_2 = ClusterOutput(joint_water_force_vector)
wetted_area_2 = ClusterOutput(wetted_area)
average_water_pressure_2 = ClusterOutput(average_water_pressure)

# ==== cluster ExtrudeTo12Points
peak_pressure_vectors_tree = ClusterInput()
peak_pressure_points_tree = ClusterInput()
joint_brep_tree = ClusterInput()
joint_brep_tree_2 = Brep(joint_brep_tree)
peak_pressure_points_tree_2 = Point(peak_pressure_points_tree)
peak_pressure_vectors_tree_2 = Vector(peak_pressure_vectors_tree)
move = Move(Geometry=peak_pressure_points_tree_2, Motion=peak_pressure_vectors_tree_2)  # -> Geometry, Transform
first_last = FirstLast(List=peak_pressure_points_tree_2)  # -> FirstValue, LastValue
first_last_2 = FirstLast(List=move.Geometry)  # -> FirstValue, LastValue

# ----
# 1st moved peak point extrusion
extrude_point = ExtrudePoint(Base=joint_brep_tree_2, Point=first_last_2.FirstValue)
deconstruct_brep = DeconstructBrep(Brep=extrude_point)  # -> Faces, Edges, Vertices
is_planar = IsPlanar(Surface=deconstruct_brep.Faces, Interior=True)  # -> Planar, Plane

# ----
# Poyline: 2nd peak - 1st moved peak, coincide --> returns True
polyline = PolyLine(Vertices=[first_last.LastValue, first_last_2.FirstValue], Closed=False)
curve_middle = CurveMiddle(Curve=polyline)
point_plane_side = PointPlaneSide(Point=curve_middle, Plane=is_planar.Plane)  # -> Side, Front, Back, Distance
invert_boolean = InvertBoolean(Boolean=point_plane_side.Side)  # -> simplify(Inverted), Number

# ----
# Poyline: 1st peak - 1st moved peak, NOT coincide --> returns True
polyline_2 = PolyLine(Vertices=[first_last_2.FirstValue, first_last.FirstValue], Closed=False)
curve_middle_2 = CurveMiddle(Curve=polyline_2)
point_plane_side_2 = PointPlaneSide(Point=curve_middle_2, Plane=is_planar.Plane)  # -> Side, Front, Back, Distance
boolean = Boolean(simplify(point_plane_side_2.Side))

# ----
# 2nd moved peak point extrusion
multiplication = Multiplication(A=invert_boolean.Inverted, B=boolean)
cull_pattern = CullPattern(List=deconstruct_brep.Faces, CullPattern=multiplication)
extrude_point_2 = ExtrudePoint(Base=cull_pattern, Point=first_last_2.LastValue)  # -> simplify(Extrusion)

# ----
# Extrusions union
merge = Merge(Data1=extrude_point, Data2=extrude_point_2)
shift_to_depth = ShiftToDepth(Tree=merge, Depth=1, shiftFromStart=False)
solid_union = SolidUnion(Breps=shift_to_depth)
extrusion = Brep(solid_union)

extrusion_2 = ClusterOutput(extrusion)
