# Grasshopper definition Verification_NewFS.gh (Grasshopper 1.0.7)
# plug-ins: Pufferfish

# ----
# Joint parameters
panel = Panel("33.5")

# ----
# Joint parameters
panel_2 = Panel("33.5")

# ----
# Direction of seismic force along line of intersection projected to XY plane
panel_3 = Panel("0.3303")
cluster = Cluster(dip_deg="75", dip_direction_deg="248", origin="{0,0,0}")  # -> plane_2, plane_normal_2
cluster_2 = Cluster(dip_deg="75", dip_direction_deg=panel_2, origin="{0,0,0}")  # -> plane_2, plane_normal_2
plane_plane = PlanePlane(PlaneA=cluster_2.plane_2, PlaneB=cluster.plane_2)
xy_plane = XYPlane(Origin="{0,0,0}")
project = Project(Geometry=plane_plane, Plane=xy_plane)  # -> Geometry, Transform
vector = Vector(unitize(project.Geometry))

# ----
# Joint parameters
panel_4 = Panel("195")
panel_5 = Panel("70")

# ----
# Verification of GH component block with new FS definition with cases in SWedge Verification Manual
# Date: 2023-03-14
# Author: Jessica Ka Yi Chiu
# 
# Blue zones & thicker wires = Variables with specific values
# SWedge Verification Problem #3
# FS = 0.7123
xy_plane_2 = XYPlane(Origin=Point(0, 0, 0))
polygon = Polygon(Plane=xy_plane_2, Radius="1", Segments="3", FilletRadius=0)  # -> Polygon, Length
unit_z = UnitZ(Factor="0")
cluster_3 = Cluster_4(
    gamma_r="0.027",
    V="1",
    h_w="1",
    a_t="0",
    wedge_left_joint_mesh=polygon.Polygon,
    wedge_right_joint_mesh=polygon.Polygon,
    wedge_slope_face_mesh=polygon.Polygon,
    wedge_upper_face_mesh=polygon.Polygon,
    left_joint_dip="45",
    left_joint_dip_direction=panel_4,
    right_joint_dip="70",
    right_joint_dip_direction="105",
    slope_dip="160",
    slope_dip_direction="30",
    c_1="0",
    phi_1="30",
    c_2="0",
    phi_2="30",
    k="0",
    e_cap_seismic="{0,0,0}",
    joint_water_pressure="0",
    u_1="0",
    u_2="0",
    u_t="0",
    c_active="0",
    e_cap_bolt_active=unit_z,
    c_passive="0",
    e_cap_bolt_passive=unit_z)  # -> fs_system_2, fs_s_2, fs_c_2, shear_failure_sliding_direction_2
panel_6 = Panel(cluster_3.fs_system_2)

# ----
# SWedge Verification Problem #4 - Static
# FS = 2.0203
xy_plane_3 = XYPlane(Origin=Point(0, 0, 0))
unit_z_2 = UnitZ(Factor="0")
polygon_2 = Polygon(Plane=xy_plane_3, Radius="1", Segments="3", FilletRadius=0)  # -> Polygon, Length
cluster_4 = Cluster_4(
    gamma_r="0.027",
    V="1",
    h_w="1",
    a_t="0",
    wedge_left_joint_mesh=polygon_2.Polygon,
    wedge_right_joint_mesh=polygon_2.Polygon,
    wedge_slope_face_mesh=polygon_2.Polygon,
    wedge_upper_face_mesh=polygon_2.Polygon,
    left_joint_dip="75",
    left_joint_dip_direction=panel,
    right_joint_dip="75",
    right_joint_dip_direction="248",
    slope_dip="75",
    slope_dip_direction="337.5",
    c_1="0",
    phi_1="40.8",
    c_2="0",
    phi_2="40.8",
    k="0",
    e_cap_seismic="{0,0,0}",
    joint_water_pressure="0",
    u_1="0",
    u_2="0",
    u_t="0",
    c_active="0",
    e_cap_bolt_active=unit_z_2,
    c_passive="0",
    e_cap_bolt_passive=unit_z_2)  # -> fs_system_2, fs_s_2, fs_c_2, shear_failure_sliding_direction_2
panel_7 = Panel(cluster_4.fs_system_2)

# ----
# SWedge Verification Problem #4 - Dynamic
# FS = 0.9872
xy_plane_4 = XYPlane(Origin=Point(0, 0, 0))
polygon_3 = Polygon(Plane=xy_plane_4, Radius="1", Segments="3", FilletRadius=0)  # -> Polygon, Length
unit_z_3 = UnitZ(Factor="0")
cluster_5 = Cluster_4(
    gamma_r="0.027",
    V="1",
    h_w="1",
    a_t="0",
    wedge_left_joint_mesh=polygon_3.Polygon,
    wedge_right_joint_mesh=polygon_3.Polygon,
    wedge_slope_face_mesh=polygon_3.Polygon,
    wedge_upper_face_mesh=polygon_3.Polygon,
    left_joint_dip="75",
    left_joint_dip_direction=panel_2,
    right_joint_dip="75",
    right_joint_dip_direction="248",
    slope_dip="75",
    slope_dip_direction="337.5",
    c_1="0",
    phi_1="40.8",
    c_2="0",
    phi_2="40.8",
    k=panel_3,
    e_cap_seismic=vector,
    joint_water_pressure="0",
    u_1="0",
    u_2="0",
    u_t="0",
    c_active="0",
    e_cap_bolt_active=unit_z_3,
    c_passive="0",
    e_cap_bolt_passive=unit_z_3)  # -> fs_system_2, fs_s_2, fs_c_2, shear_failure_sliding_direction_2
panel_8 = Panel(cluster_5.fs_system_2)

# ----
# Joint area
xy_plane_5 = XYPlane(Origin=Point(0, 0, 0))
xy_plane_6 = XYPlane(Origin=Point(0, 0, 0))
polygon_4 = Polygon(Plane=xy_plane_5, Radius="1", Segments="3", FilletRadius=0)  # -> Polygon, Length
polygon_5 = Polygon(Plane=xy_plane_6, Radius="1", Segments="3", FilletRadius=0)  # -> Polygon, Length
scale_to_area = ScaleToArea(Geometry=polygon_4.Polygon, Plane=xy_plane_5, Area="68404.636", FactorX=1, FactorY=1, FactorZ=1)  # -> Scaled, Transform
scale_to_area_2 = ScaleToArea(Geometry=polygon_5.Polygon, Plane=xy_plane_6, Area="69797.393", FactorX=1, FactorY=1, FactorZ=1)  # -> Scaled, Transform

# ----
# Wedge Weight
panel_9 = Panel("0.025")
expression = Expression(W="98870.95", gamma_r=panel_9, Expression="W/gamma_r")
panel_10 = Panel(expression)

# ----
# Joint area
xy_plane_7 = XYPlane(Origin=Point(0, 0, 0))
xy_plane_8 = XYPlane(Origin=Point(0, 0, 0))
polygon_6 = Polygon(Plane=xy_plane_7, Radius="1", Segments="3", FilletRadius=0)  # -> Polygon, Length
polygon_7 = Polygon(Plane=xy_plane_8, Radius="1", Segments="3", FilletRadius=0)  # -> Polygon, Length
scale_to_area_3 = ScaleToArea(Geometry=polygon_6.Polygon, Plane=xy_plane_7, Area="68404.636", FactorX=1, FactorY=1, FactorZ=1)  # -> Scaled, Transform
scale_to_area_4 = ScaleToArea(Geometry=polygon_7.Polygon, Plane=xy_plane_8, Area="69797.393", FactorX=1, FactorY=1, FactorZ=1)  # -> Scaled, Transform

# ----
# Wedge Weight
panel_11 = Panel("0.025")
expression_2 = Expression(W="98870.95", gamma_r=panel_11, Expression="W/gamma_r")
panel_12 = Panel(expression_2)

# ----
# Joint area
xy_plane_9 = XYPlane(Origin=Point(0, 0, 0))
xy_plane_10 = XYPlane(Origin=Point(0, 0, 0))
polygon_8 = Polygon(Plane=xy_plane_9, Radius="1", Segments="3", FilletRadius=0)  # -> Polygon, Length
polygon_9 = Polygon(Plane=xy_plane_10, Radius="1", Segments="3", FilletRadius=0)  # -> Polygon, Length
scale_to_area_5 = ScaleToArea(Geometry=polygon_8.Polygon, Plane=xy_plane_9, Area="68404.636", FactorX=1, FactorY=1, FactorZ=1)  # -> Scaled, Transform
scale_to_area_6 = ScaleToArea(Geometry=polygon_9.Polygon, Plane=xy_plane_10, Area="69797.393", FactorX=1, FactorY=1, FactorZ=1)  # -> Scaled, Transform

# ----
# Wedge Weight
panel_13 = Panel("0.025")
expression_3 = Expression(W="98870.95", gamma_r=panel_13, Expression="W/gamma_r")
panel_14 = Panel(expression_3)

# ----
# Joint parameters
panel_15 = Panel("30")

# ----
# Joint parameters
panel_16 = Panel("30")

# ----
# Direction of seismic force along line of intersection projected to XY plane
panel_17 = Panel("{0,0,0}")
cluster_6 = Cluster(dip_deg="41", dip_direction_deg="150", origin=panel_17)  # -> plane_2, plane_normal_2
cluster_7 = Cluster(dip_deg="41", dip_direction_deg=panel_16, origin=panel_17)  # -> plane_2, plane_normal_2
plane_plane_2 = PlanePlane(PlaneA=cluster_7.plane_2, PlaneB=cluster_6.plane_2)
vector_2 = Vector(unitize(plane_plane_2))
reverse = Reverse(Vector=vector_2)

# ----
# Joint parameters
panel_18 = Panel("30")

# ----
# Direction of seismic force along line of intersection projected to XY plane
panel_19 = Panel("{0,0,0}")
cluster_8 = Cluster(dip_deg="41", dip_direction_deg="150", origin=panel_19)  # -> plane_2, plane_normal_2
cluster_9 = Cluster(dip_deg="41", dip_direction_deg=panel_18, origin=panel_19)  # -> plane_2, plane_normal_2
plane_plane_3 = PlanePlane(PlaneA=cluster_9.plane_2, PlaneB=cluster_8.plane_2)
vector_3 = Vector(unitize(plane_plane_3))
reverse_2 = Reverse(Vector=vector_3)

# ----
# Joint parameters
panel_20 = Panel("30")

# ----
# SWedge Verification Problem #5 - Case 1 - static
# FS = 1.9577
xy_plane_11 = XYPlane(Origin=Point(0, 0, 0))
unit_z_4 = UnitZ(Factor="0")
polygon_10 = Polygon(Plane=xy_plane_11, Radius="1", Segments="3", FilletRadius=0)  # -> Polygon, Length
cluster_10 = Cluster_4(
    gamma_r="0.027",
    V="1",
    h_w="1",
    a_t="0",
    wedge_left_joint_mesh=polygon_10.Polygon,
    wedge_right_joint_mesh=polygon_10.Polygon,
    wedge_slope_face_mesh=polygon_10.Polygon,
    wedge_upper_face_mesh=polygon_10.Polygon,
    left_joint_dip="41",
    left_joint_dip_direction=panel_15,
    right_joint_dip="41",
    right_joint_dip_direction="150",
    slope_dip="35",
    slope_dip_direction="91",
    c_1="0",
    phi_1="35",
    c_2="0",
    phi_2="35",
    k="0",
    e_cap_seismic="{0,0,0}",
    joint_water_pressure="0",
    u_1="0",
    u_2="0",
    u_t="0",
    c_active="0",
    e_cap_bolt_active=unit_z_4,
    c_passive="0",
    e_cap_bolt_passive=unit_z_4)  # -> fs_system_2, fs_s_2, fs_c_2, shear_failure_sliding_direction_2
panel_21 = Panel(cluster_10.fs_system_2)

# ----
# Water parameters
panel_22 = Panel("0.3537")

# ----
# Water parameters
panel_23 = Panel("0.3414")

# ----
# Water parameters
panel_24 = Panel("0.406")

# ----
# SWedge Verification Problem #5 - Case 3
# FS = 0.9678
xy_plane_12 = XYPlane(Origin=Point(0, 0, 0))
polygon_11 = Polygon(Plane=xy_plane_12, Radius="1", Segments="3", FilletRadius=0)  # -> Polygon, Length
unit_z_5 = UnitZ(Factor="0")
cluster_11 = Cluster_4(
    gamma_r=panel_9,
    V=expression,
    h_w="1",
    a_t="0",
    wedge_left_joint_mesh=scale_to_area.Scaled,
    wedge_right_joint_mesh=scale_to_area_2.Scaled,
    wedge_slope_face_mesh=polygon_11.Polygon,
    wedge_upper_face_mesh=polygon_11.Polygon,
    left_joint_dip="41",
    left_joint_dip_direction=panel_16,
    right_joint_dip="41",
    right_joint_dip_direction="150",
    slope_dip="35",
    slope_dip_direction="91",
    c_1="0",
    phi_1="35",
    c_2="0",
    phi_2="35",
    k="0.05",
    e_cap_seismic=reverse,
    joint_water_pressure="1",
    u_1=panel_22,
    u_2=panel_22,
    u_t="0",
    c_active="0",
    e_cap_bolt_active=unit_z_5,
    c_passive="0",
    e_cap_bolt_passive=unit_z_5)  # -> fs_system_2, fs_s_2, fs_c_2, shear_failure_sliding_direction_2
panel_25 = Panel(cluster_11.fs_system_2)

# ----
# SWedge Verification Problem #5 - Case 4
# FS = 1.0659
xy_plane_13 = XYPlane(Origin=Point(0, 0, 0))
polygon_12 = Polygon(Plane=xy_plane_13, Radius="1", Segments="3", FilletRadius=0)  # -> Polygon, Length
unit_z_6 = UnitZ(Factor="0")
cluster_12 = Cluster_4(
    gamma_r=panel_11,
    V=expression_2,
    h_w="1",
    a_t="0",
    wedge_left_joint_mesh=scale_to_area_3.Scaled,
    wedge_right_joint_mesh=scale_to_area_4.Scaled,
    wedge_slope_face_mesh=polygon_12.Polygon,
    wedge_upper_face_mesh=polygon_12.Polygon,
    left_joint_dip="41",
    left_joint_dip_direction=panel_18,
    right_joint_dip="41",
    right_joint_dip_direction="150",
    slope_dip="35",
    slope_dip_direction="91",
    c_1="0",
    phi_1="35",
    c_2="0",
    phi_2="35",
    k="0.02",
    e_cap_seismic=reverse_2,
    joint_water_pressure="1",
    u_1=panel_23,
    u_2=panel_23,
    u_t="0",
    c_active="0",
    e_cap_bolt_active=unit_z_6,
    c_passive="0",
    e_cap_bolt_passive=unit_z_6)  # -> fs_system_2, fs_s_2, fs_c_2, shear_failure_sliding_direction_2
panel_26 = Panel(cluster_12.fs_system_2)

# ----
# SWedge Verification Problem #5 - Case 2
# FS = 0.9608
xy_plane_14 = XYPlane(Origin=Point(0, 0, 0))
polygon_13 = Polygon(Plane=xy_plane_14, Radius="1", Segments="3", FilletRadius=0)  # -> Polygon, Length
unit_z_7 = UnitZ(Factor="0")
cluster_13 = Cluster_4(
    gamma_r=panel_13,
    V=expression_3,
    h_w="1",
    a_t="0",
    wedge_left_joint_mesh=scale_to_area_5.Scaled,
    wedge_right_joint_mesh=scale_to_area_6.Scaled,
    wedge_slope_face_mesh=polygon_13.Polygon,
    wedge_upper_face_mesh=polygon_13.Polygon,
    left_joint_dip="41",
    left_joint_dip_direction=panel_20,
    right_joint_dip="41",
    right_joint_dip_direction="150",
    slope_dip="35",
    slope_dip_direction="91",
    c_1="0",
    phi_1="35",
    c_2="0",
    phi_2="35",
    k="0",
    e_cap_seismic="{0,0,0}",
    joint_water_pressure="1",
    u_1=panel_24,
    u_2=panel_24,
    u_t="0",
    c_active="0",
    e_cap_bolt_active=unit_z_7,
    c_passive="0",
    e_cap_bolt_passive=unit_z_7)  # -> fs_system_2, fs_s_2, fs_c_2, shear_failure_sliding_direction_2
panel_27 = Panel(cluster_13.fs_system_2)

# ----
# Joint parameters
panel_28 = Panel("30")

# ----
# Direction of seismic force along line of intersection
panel_29 = Panel("{0,0,0}")
cluster_14 = Cluster(dip_deg="41", dip_direction_deg="150", origin=panel_29)  # -> plane_2, plane_normal_2
cluster_15 = Cluster(dip_deg="41", dip_direction_deg=panel_28, origin=panel_29)  # -> plane_2, plane_normal_2
plane_plane_4 = PlanePlane(PlaneA=cluster_15.plane_2, PlaneB=cluster_14.plane_2)
reverse_3 = Reverse(Vector=plane_plane_4)
vector_4 = Vector(unitize(reverse_3))

# ----
# SWedge Verification Problem #5 - Case 1 - dynamic
# FS = 1.0822
xy_plane_15 = XYPlane(Origin=Point(0, 0, 0))
unit_z_8 = UnitZ(Factor="0")
polygon_14 = Polygon(Plane=xy_plane_15, Radius="1", Segments="3", FilletRadius=0)  # -> Polygon, Length
cluster_16 = Cluster_4(
    gamma_r="0.027",
    V="1",
    h_w="1",
    a_t="0",
    wedge_left_joint_mesh=polygon_14.Polygon,
    wedge_right_joint_mesh=polygon_14.Polygon,
    wedge_slope_face_mesh=polygon_14.Polygon,
    wedge_upper_face_mesh=polygon_14.Polygon,
    left_joint_dip="41",
    left_joint_dip_direction=panel_28,
    right_joint_dip="41",
    right_joint_dip_direction="150",
    slope_dip="35",
    slope_dip_direction="91",
    c_1="0",
    phi_1="35",
    c_2="0",
    phi_2="35",
    k="0.3225",
    e_cap_seismic=vector_4,
    joint_water_pressure="0",
    u_1="0",
    u_2="0",
    u_t="0",
    c_active="0",
    e_cap_bolt_active=unit_z_8,
    c_passive="0",
    e_cap_bolt_passive=unit_z_8)  # -> fs_system_2, fs_s_2, fs_c_2, shear_failure_sliding_direction_2
panel_30 = Panel(cluster_16.fs_system_2)

# ----
# Joint area
xy_plane_16 = XYPlane(Origin=Point(0, 0, 0))
xy_plane_17 = XYPlane(Origin=Point(0, 0, 0))
polygon_15 = Polygon(Plane=xy_plane_16, Radius="1", Segments="3", FilletRadius=0)  # -> Polygon, Length
polygon_16 = Polygon(Plane=xy_plane_17, Radius="1", Segments="3", FilletRadius=0)  # -> Polygon, Length
scale_to_area_7 = ScaleToArea(Geometry=polygon_15.Polygon, Plane=xy_plane_16, Area="34.393", FactorX=1, FactorY=1, FactorZ=1)  # -> Scaled, Transform
scale_to_area_8 = ScaleToArea(Geometry=polygon_16.Polygon, Plane=xy_plane_17, Area="56.613", FactorX=1, FactorY=1, FactorZ=1)  # -> Scaled, Transform

# ----
# Wedge Weight
panel_31 = Panel("0.025")
expression_4 = Expression(W="2.0435", gamma_r=panel_31, Expression="W/gamma_r")
panel_32 = Panel(expression_4)

# ----
# Joint parameters
panel_33 = Panel("65")

# ----
# Water parameters
panel_34 = Panel("0.025")

# ----
# SWedge Verification Problem #7
# FS = 0.8493
mode = Panel("0")
xy_plane_18 = XYPlane(Origin=Point(0, 0, 0))
polygon_17 = Polygon(Plane=xy_plane_18, Radius="1", Segments="3", FilletRadius=0)  # -> Polygon, Length
unit_z_9 = UnitZ(Factor="0")
cluster_17 = Cluster_4(
    gamma_r=panel_31,
    V=expression_4,
    h_w="1",
    a_t="0",
    wedge_left_joint_mesh=scale_to_area_7.Scaled,
    wedge_right_joint_mesh=scale_to_area_8.Scaled,
    wedge_slope_face_mesh=polygon_17.Polygon,
    wedge_upper_face_mesh=polygon_17.Polygon,
    left_joint_dip="74",
    left_joint_dip_direction=panel_33,
    right_joint_dip="41",
    right_joint_dip_direction="186",
    slope_dip="65",
    slope_dip_direction="134",
    c_1="0.015",
    phi_1="32",
    c_2="0.005",
    phi_2="40",
    k="0",
    e_cap_seismic="{0,0,0}",
    joint_water_pressure="1",
    u_1=panel_34,
    u_2="0.015",
    c_active="0",
    e_cap_bolt_active=unit_z_9,
    c_passive="0",
    e_cap_bolt_passive=unit_z_9)  # -> fs_system_2, fs_s_2, fs_c_2, shear_failure_sliding_direction_2
panel_35 = Panel(cluster_17.fs_system_2)

# ----
# Bolt parameters
panel_36 = Panel("0.1")
cluster_18 = Cluster_2(trend="0", plunge="0")  # -> unitize(vector_2)

# ----
# Wedge weight
panel_37 = Panel("295.256")

# ----
# Joint parameters
panel_38 = Panel("125")

# ----
# Bolt parameters
panel_39 = Panel("0.1")
cluster_19 = Cluster_2(trend="0", plunge="0")  # -> unitize(vector_2)

# ----
# Wedge weight
panel_40 = Panel("295.256")

# ----
# Joint parameters
panel_41 = Panel("125")

# ----
# SWedge Verification Problem Bolt #1 - Simple PASSIVE bolt force
# FS = 0.989
mode_2 = Panel("1")
xy_plane_19 = XYPlane(Origin=Point(0, 0, 0))
polygon_18 = Polygon(Plane=xy_plane_19, Radius="1", Segments="3", FilletRadius=0)  # -> Polygon, Length
unit_z_10 = UnitZ(Factor="0")
cluster_20 = Cluster_4(
    gamma_r="0.027",
    V=panel_37,
    h_w="1",
    a_t="0",
    wedge_left_joint_mesh=polygon_18.Polygon,
    wedge_right_joint_mesh=polygon_18.Polygon,
    wedge_slope_face_mesh=polygon_18.Polygon,
    wedge_upper_face_mesh=polygon_18.Polygon,
    left_joint_dip="45",
    left_joint_dip_direction=panel_38,
    right_joint_dip="70",
    right_joint_dip_direction="225",
    slope_dip="90",
    slope_dip_direction="180",
    c_1="0",
    phi_1="35",
    phi_1_r="35",
    c_2="0",
    phi_2="35",
    phi_2_r="35",
    k="0",
    e_cap_seismic="{0,0,0}",
    joint_water_pressure="0",
    u_1="0",
    u_2="0",
    u_t="0",
    c_active="0",
    e_cap_bolt_active=unit_z_10,
    c_passive=panel_36,
    e_cap_bolt_passive=cluster_18)  # -> fs_system_2, fs_s_2, fs_c_2, shear_failure_sliding_direction_2
panel_42 = Panel(cluster_20.fs_system_2)

# ----
# SWedge Verification Problem Bolt #1 - Simple ACTIVE bolt force
# FS = 1.014
mode_3 = Panel("0")
xy_plane_20 = XYPlane(Origin=Point(0, 0, 0))
polygon_19 = Polygon(Plane=xy_plane_20, Radius="1", Segments="3", FilletRadius=0)  # -> Polygon, Length
unit_z_11 = UnitZ(Factor="0")
cluster_21 = Cluster_4(
    gamma_r="0.027",
    V=panel_40,
    h_w="1",
    a_t="0",
    wedge_left_joint_mesh=polygon_19.Polygon,
    wedge_right_joint_mesh=polygon_19.Polygon,
    wedge_slope_face_mesh=polygon_19.Polygon,
    wedge_upper_face_mesh=polygon_19.Polygon,
    left_joint_dip="45",
    left_joint_dip_direction=panel_41,
    right_joint_dip="70",
    right_joint_dip_direction="225",
    slope_dip="90",
    slope_dip_direction="180",
    c_1="0",
    phi_1="35",
    c_2="0",
    phi_2="35",
    k="0",
    e_cap_seismic="{0,0,0}",
    joint_water_pressure="0",
    u_1="0",
    u_2="0",
    u_t="0",
    c_active=panel_39,
    e_cap_bolt_active=cluster_19,
    c_passive="0",
    e_cap_bolt_passive=unit_z_11)  # -> fs_system_2, fs_s_2, fs_c_2, shear_failure_sliding_direction_2
panel_43 = Panel(cluster_21.fs_system_2)

# ----
# Bolt parameters
panel_44 = Panel("0.05")
cluster_22 = Cluster_2(trend="0", plunge="0")  # -> unitize(vector_2)

# ----
# Wedge weight
panel_45 = Panel("295.256")

# ----
# Joint parameters
panel_46 = Panel("125")

# ----
# Bolt parameters
panel_47 = Panel("0.03")
cluster_23 = Cluster_2(trend="0", plunge="0")  # -> unitize(vector_2)

# ----
# Wedge weight
panel_48 = Panel("295.256")

# ----
# Joint parameters
panel_49 = Panel("125")

# ----
# SWedge Verification Problem Bolt #1 - ACTIVE & PASSIVE bolt force (no shear failure)
# FS system = FS for shear failure = 1.001
# FS for collapse = 1.014
xy_plane_21 = XYPlane(Origin=Point(0, 0, 0))
polygon_20 = Polygon(Plane=xy_plane_21, Radius="1", Segments="3", FilletRadius=0)  # -> Polygon, Length
unit_z_12 = UnitZ(Factor="0")
cluster_24 = Cluster_4(
    gamma_r="0.027",
    V=panel_45,
    h_w="1",
    a_t="0",
    wedge_left_joint_mesh=polygon_20.Polygon,
    wedge_right_joint_mesh=polygon_20.Polygon,
    wedge_slope_face_mesh=polygon_20.Polygon,
    wedge_upper_face_mesh=polygon_20.Polygon,
    left_joint_dip="45",
    left_joint_dip_direction=panel_46,
    right_joint_dip="70",
    right_joint_dip_direction="225",
    slope_dip="90",
    slope_dip_direction="180",
    c_1="0",
    phi_1="35",
    phi_1_r="30",
    c_2="0",
    phi_2="35",
    phi_2_r="30",
    k="0",
    e_cap_seismic="{0,0,0}",
    joint_water_pressure="0",
    u_1="0",
    u_2="0",
    u_t="0",
    c_active=panel_44,
    e_cap_bolt_active=cluster_22,
    c_passive="0.1",
    e_cap_bolt_passive=cluster_22)  # -> fs_system_2, fs_s_2, fs_c_2, shear_failure_sliding_direction_2
panel_50 = Panel(cluster_24.fs_c_2)

# ----
# SWedge Verification Problem Bolt #1 - ACTIVE & PASSIVE bolt force (shear failure)
# FS system = FS for shear failure = 0.996
# FS for collapse = 0.838
xy_plane_22 = XYPlane(Origin=Point(0, 0, 0))
polygon_21 = Polygon(Plane=xy_plane_22, Radius="1", Segments="3", FilletRadius=0)  # -> Polygon, Length
unit_z_13 = UnitZ(Factor="0")
cluster_25 = Cluster_4(
    gamma_r="0.027",
    V=panel_48,
    h_w="1",
    a_t="0",
    wedge_left_joint_mesh=polygon_21.Polygon,
    wedge_right_joint_mesh=polygon_21.Polygon,
    wedge_slope_face_mesh=polygon_21.Polygon,
    wedge_upper_face_mesh=polygon_21.Polygon,
    left_joint_dip="45",
    left_joint_dip_direction=panel_49,
    right_joint_dip="70",
    right_joint_dip_direction="225",
    slope_dip="90",
    slope_dip_direction="180",
    c_1="0",
    phi_1="35",
    phi_1_r="30",
    c_2="0",
    phi_2="35",
    phi_2_r="30",
    k="0",
    e_cap_seismic="{0,0,0}",
    joint_water_pressure="0",
    u_1="0",
    u_2="0",
    u_t="0",
    c_active=panel_47,
    e_cap_bolt_active=cluster_23,
    c_passive="0.1",
    e_cap_bolt_passive=cluster_23)  # -> fs_system_2, fs_s_2, fs_c_2, shear_failure_sliding_direction_2
panel_51 = Panel(cluster_25.fs_c_2)

panel_52 = Panel(cluster_24.fs_system_2)
panel_53 = Panel(cluster_24.fs_s_2)
panel_54 = Panel(cluster_25.fs_system_2)
panel_55 = Panel(cluster_25.fs_s_2)

# ==== cluster Cluster

dip_deg = ClusterInput()
dip_direction_deg = ClusterInput()
origin = ClusterInput()
dip_direction_deg_2 = Number(dip_direction_deg)
dip_deg_2 = Number(dip_deg)
origin_2 = Point(origin)

# ---- group: Rotate plane to specific dip
xy_plane = XYPlane(Origin=origin_2)
radians = Radians(Degrees=dip_deg_2)
negative = Negative(Value=radians)
yz_plane = YZPlane(Origin=origin_2)
rotate = Rotate(Geometry=xy_plane, Angle=negative, Plane=yz_plane)  # -> Geometry, Transform

# ---- group: Rotate plane to specific dip direction (y-axis of plane)
radians_2 = Radians(Degrees=dip_direction_deg_2)
negative_2 = Negative(Value=radians_2)
rotate_2 = Rotate(Geometry=rotate.Geometry, Angle=negative_2, Plane=xy_plane)  # -> Geometry, Transform
face_normals = FaceNormals(Mesh=rotate_2.Geometry)  # -> Centers, Normals

# ----
plane = Plane(rotate_2.Geometry)
plane_2 = ClusterOutput(plane)

plane_normal = Vector(face_normals.Normals)
plane_normal_2 = ClusterOutput(plane_normal)

# ==== cluster Cluster_2

trend = ClusterInput()  # Degree
plunge = ClusterInput()  # Degree (upwards = -ve)
trend_2 = Number(trend)
plunge_2 = Number(plunge)
yz_plane = YZPlane(Origin=Point(0, 0, 0))
unit_y = UnitY(Factor=1)
radians = Radians(Degrees=plunge_2)
radians_2 = Radians(Degrees=trend_2)
negative = Negative(Value=radians)
rotate = Rotate(Geometry=unit_y, Angle=negative, Plane=yz_plane)  # -> Geometry, Transform
negative_2 = Negative(Value=radians_2)
rotate_2 = Rotate(Geometry=rotate.Geometry, Angle=negative_2, Plane=PlaneXY(0, 0, 0))  # -> Geometry, Transform
vector = Vector(unitize(rotate_2.Geometry))
vector_2 = ClusterOutput(vector)

# ==== cluster Cluster_4
e_cap_seismic = ClusterInput()

gamma_r = ClusterInput()
V = ClusterInput()
h_w = ClusterInput()
a_t = ClusterInput()
wedge_left_joint_mesh = ClusterInput()
wedge_right_joint_mesh = ClusterInput()
wedge_upper_face_mesh = ClusterInput()
left_joint_dip_direction = ClusterInput()
right_joint_dip_direction = ClusterInput()
phi_2 = ClusterInput()
wedge_slope_face_mesh = ClusterInput()
c_2 = ClusterInput()
phi_2_r = ClusterInput()
k = ClusterInput()
joint_water_pressure = ClusterInput()
percentage_fill = ClusterInput()
u_1 = ClusterInput()
u_2 = ClusterInput()
left_joint_dip = ClusterInput()
right_joint_dip = ClusterInput()
slope_dip = ClusterInput()
slope_dip_direction = ClusterInput()
phi_1_r = ClusterInput()
u_t = ClusterInput()
c_1 = ClusterInput()
phi_1 = ClusterInput()
e_cap_bolt_passive = ClusterInput()
e_cap_bolt_active = ClusterInput()
c_passive = ClusterInput()
c_active = ClusterInput()
e_cap_bolt_passive_2 = UnitDirectionOfPassiveBolt(e_cap_bolt_passive)
c_passive_2 = CapacityOfPassiveBolt(c_passive)
c_active_2 = CapcaityOfActiveBolt(c_active)
e_cap_bolt_active_2 = UnitDirectionOfActiveBolt(e_cap_bolt_active)
h_w_2 = VerticalHeightOfLineOfIntersection(h_w)
a_t_2 = AreaOfTensionCrack(a_t)
phi_2_2 = FrictionAngleOfJoint2(phi_2)
c_2_2 = CohesionOfJoint2(c_2)
left_joint_dip_2 = Number(left_joint_dip)
phi_2_r_2 = FrictionAngleOfJoint2(phi_2_r)
k_2 = Number(k)
e_cap_seismic_2 = DirectionOfSeismicForce(e_cap_seismic)
joint_water_pressure_2 = JointWaterPressure(joint_water_pressure)
percentage_fill_2 = PercentageFill(percentage_fill)
u_1_2 = ConstantPressureOnJoint1(u_1)
u_2_2 = ConstantPressureOnJoint2(u_2)
gamma_r_2 = UnitWeightOfRock(gamma_r)
V_2 = WedgeVolume(V)
phi_1_r_2 = FrictionAngleOfJoint1(phi_1_r)
wedge_left_joint_mesh_2 = Mesh(wedge_left_joint_mesh)
wedge_right_joint_mesh_2 = Mesh(wedge_right_joint_mesh)
wedge_slope_face_mesh_2 = Mesh(wedge_slope_face_mesh)
wedge_upper_face_mesh_2 = Mesh(wedge_upper_face_mesh)
left_joint_dip_direction_2 = Number(left_joint_dip_direction)
right_joint_dip_2 = Number(right_joint_dip)
right_joint_dip_direction_2 = Number(right_joint_dip_direction)
slope_dip_2 = Number(slope_dip)
slope_dip_direction_2 = Number(slope_dip_direction)
c_1_2 = CohesionOfJoint1(c_1)
phi_1_2 = FrictionAngleOfJoint1(phi_1)
u_t_2 = ConstantPressureOnTensionCrack(u_t)

# ----
# Active support - Ultimate load
# Active support - FS for shear failure
# Passive support - Ultimate laod
panel = Panel("0")

c_i = IndividualExternalForceVectors("{0,0,0}")

cluster = Cluster_3(
    unit_weight_of_rock=gamma_r_2,
    wedge_volume=V_2,
    vertical_height_of_line_of_intersection=h_w_2,
    area_of_tension_crack=a_t_2,
    wedge_left_joint_mesh=wedge_left_joint_mesh_2,
    wedge_right_joint_mesh=wedge_right_joint_mesh_2,
    wedge_slope_face_mesh=wedge_slope_face_mesh_2,
    wedge_upper_face_mesh=wedge_upper_face_mesh_2,
    left_joint_dip=left_joint_dip_2,
    left_joint_dip_direction=left_joint_dip_direction_2,
    right_joint_dip=right_joint_dip_2,
    right_joint_dip_direction=right_joint_dip_direction_2,
    slope_dip=slope_dip_2,
    slope_dip_direction=slope_dip_direction_2,
    cohesion_of_joint_1=c_1_2,
    friction_angle_of_joint_1=phi_1_2,
    cohesion_of_joint_2=c_2_2,
    friction_angle_of_joint_2=phi_2_2,
    k=k_2,
    direction_of_seismic_force=e_cap_seismic_2,
    individual_external_force_vectors=c_i,
    joint_water_pressure=joint_water_pressure_2,
    percentage_fill=percentage_fill_2,
    constant_pressure_on_joint_1=u_1_2,
    constant_pressure_on_joint_2=u_2_2,
    constant_pressure_on_tension_crack=u_t_2,
    capcaity_of_active_bolt=c_passive_2,
    unit_direction_of_active_bolt=e_cap_bolt_active_2,
    capacity_of_passive_bolt=panel,
    unit_direction_of_passive_bolt="{0,0,0}",
    trace_length_of_joint_1_on_slope_face=panel,
    trace_length_of_joint_2_on_slope_face=panel,
    shotcrete_thickness=panel,
    shotcrete_shear_strength=panel,
    active_pressure_magnitude_on_slope_face=panel,
    trend_plunge_of_active_slope_pressure="{0,0,0}",
    active_pressure_magnitude_on_upper_face=panel,
    trend_plunge_of_active_upper_face_pressu="{0,0,0}",
    passive_pressure_magnitude_on_slope_face=panel,
    trend_plunge_of_passive_slope_pressure="{0,0,0}",
    passive_pressure_magnitude_on_upper_face=panel,
    trend_plunge_of_passive_upper_face_press="{0,0,0}")  # -> factor_of_safety, sliding_direction_3
cluster_2 = Cluster_3(
    unit_weight_of_rock=gamma_r_2,
    wedge_volume=V_2,
    vertical_height_of_line_of_intersection=h_w_2,
    area_of_tension_crack=a_t_2,
    wedge_left_joint_mesh=wedge_left_joint_mesh_2,
    wedge_right_joint_mesh=wedge_right_joint_mesh_2,
    wedge_slope_face_mesh=wedge_slope_face_mesh_2,
    wedge_upper_face_mesh=wedge_upper_face_mesh_2,
    left_joint_dip=left_joint_dip_2,
    left_joint_dip_direction=left_joint_dip_direction_2,
    right_joint_dip=right_joint_dip_2,
    right_joint_dip_direction=right_joint_dip_direction_2,
    slope_dip=slope_dip_2,
    slope_dip_direction=slope_dip_direction_2,
    cohesion_of_joint_1=panel,
    friction_angle_of_joint_1=phi_1_r_2,
    cohesion_of_joint_2=panel,
    friction_angle_of_joint_2=phi_2_r_2,
    k=k_2,
    direction_of_seismic_force=e_cap_seismic_2,
    individual_external_force_vectors=c_i,
    joint_water_pressure=joint_water_pressure_2,
    percentage_fill=percentage_fill_2,
    constant_pressure_on_joint_1=u_1_2,
    constant_pressure_on_joint_2=u_2_2,
    constant_pressure_on_tension_crack=u_t_2,
    capcaity_of_active_bolt=panel,
    unit_direction_of_active_bolt=e_cap_bolt_active_2,
    capacity_of_passive_bolt=c_passive_2,
    unit_direction_of_passive_bolt="{0,0,0}",
    trace_length_of_joint_1_on_slope_face=panel,
    trace_length_of_joint_2_on_slope_face=panel,
    shotcrete_thickness=panel,
    shotcrete_shear_strength=panel,
    active_pressure_magnitude_on_slope_face=panel,
    trend_plunge_of_active_slope_pressure="{0,0,0}",
    active_pressure_magnitude_on_upper_face=panel,
    trend_plunge_of_active_upper_face_pressu="{0,0,0}",
    passive_pressure_magnitude_on_slope_face=panel,
    trend_plunge_of_passive_slope_pressure="{0,0,0}",
    passive_pressure_magnitude_on_upper_face=panel,
    trend_plunge_of_passive_upper_face_press="{0,0,0}")  # -> factor_of_safety, sliding_direction_3

cluster_3 = Cluster_3(
    unit_weight_of_rock=gamma_r_2,
    wedge_volume=V_2,
    vertical_height_of_line_of_intersection=h_w_2,
    area_of_tension_crack=a_t_2,
    wedge_left_joint_mesh=wedge_left_joint_mesh_2,
    wedge_right_joint_mesh=wedge_right_joint_mesh_2,
    wedge_slope_face_mesh=wedge_slope_face_mesh_2,
    wedge_upper_face_mesh=wedge_upper_face_mesh_2,
    left_joint_dip=left_joint_dip_2,
    left_joint_dip_direction=left_joint_dip_direction_2,
    right_joint_dip=right_joint_dip_2,
    right_joint_dip_direction=right_joint_dip_direction_2,
    slope_dip=slope_dip_2,
    slope_dip_direction=slope_dip_direction_2,
    cohesion_of_joint_1=c_1_2,
    friction_angle_of_joint_1=phi_1_2,
    cohesion_of_joint_2=c_2_2,
    friction_angle_of_joint_2=phi_2_2,
    k=k_2,
    direction_of_seismic_force=e_cap_seismic_2,
    individual_external_force_vectors=c_i,
    joint_water_pressure=joint_water_pressure_2,
    percentage_fill=percentage_fill_2,
    constant_pressure_on_joint_1=u_1_2,
    constant_pressure_on_joint_2=u_2_2,
    constant_pressure_on_tension_crack=u_t_2,
    capcaity_of_active_bolt=c_active_2,
    unit_direction_of_active_bolt=e_cap_bolt_active_2,
    capacity_of_passive_bolt=panel,
    unit_direction_of_passive_bolt="{0,0,0}",
    trace_length_of_joint_1_on_slope_face=panel,
    trace_length_of_joint_2_on_slope_face=panel,
    shotcrete_thickness=panel,
    shotcrete_shear_strength=panel,
    active_pressure_magnitude_on_slope_face=panel,
    trend_plunge_of_active_slope_pressure="{0,0,0}",
    active_pressure_magnitude_on_upper_face=panel,
    trend_plunge_of_active_upper_face_pressu="{0,0,0}",
    passive_pressure_magnitude_on_slope_face=panel,
    trend_plunge_of_passive_slope_pressure="{0,0,0}",
    passive_pressure_magnitude_on_upper_face=panel,
    trend_plunge_of_passive_upper_face_press="{0,0,0}")  # -> factor_of_safety, sliding_direction_3
panel_2 = Panel(cluster_3.sliding_direction_3)
larger_than = LargerThan(FirstNumber=cluster_3.factor_of_safety, SecondNumber="1")  # -> LargerThan, OrEqualTo
fs_c_active = Number(cluster.factor_of_safety)
panel_3 = Panel(cluster.sliding_direction_3)
panel_4 = Panel(cluster_2.sliding_direction_3)
fs_c_passive = Number(cluster_2.factor_of_safety)
pick_n_choose = PickNChoose(Pattern=larger_than.OrEqualTo, Stream0=fs_c_passive, Stream1=fs_c_active)

shear_failure_sliding_direction = Integer(cluster_3.sliding_direction_3)
fs_c = Number(pick_n_choose)
fs_s = Number(cluster_3.factor_of_safety)
shear_failure_sliding_direction_2 = ClusterOutput(shear_failure_sliding_direction)
fs_s_2 = ClusterOutput(fs_s)
fs_c_2 = ClusterOutput(fs_c)

fs_system = Number(fs_s)
fs_system_2 = ClusterOutput(fs_system)

# ==== cluster Cluster_3

left_joint_dip = ClusterInput()
left_joint_dip_direction = ClusterInput()
right_joint_dip = ClusterInput()
right_joint_dip_direction = ClusterInput()
slope_dip = ClusterInput()
slope_dip_direction = ClusterInput()
tension_crack_dip_direction = Number("0")
tension_crack_dip = Number("0")
left_joint_dip_2 = Number(left_joint_dip)
left_joint_dip_direction_2 = Number(left_joint_dip_direction)
right_joint_dip_2 = Number(right_joint_dip)
right_joint_dip_direction_2 = Number(right_joint_dip_direction)
slope_dip_2 = Number(slope_dip)
slope_dip_direction_2 = Number(slope_dip_direction)
dip_dipdirection_to_plane = Cluster(
    dip_deg=left_joint_dip_2,
    dip_direction_deg=left_joint_dip_direction_2,
    origin=Point(353.9549866, 506.8420105, 44.99300003))  # -> plane_2, plane_normal_2
dip_dipdirection_to_plane_2 = Cluster(
    dip_deg=right_joint_dip_2,
    dip_direction_deg=right_joint_dip_direction_2,
    origin=Point(353.9549866, 506.8420105, 44.99300003))  # -> plane_2, plane_normal_2
dip_dipdirection_to_plane_3 = Cluster(dip_deg=slope_dip_2, dip_direction_deg=slope_dip_direction_2, origin=Point(353.9549866, 506.8420105, 44.99300003))  # -> plane_2, plane_normal_2
dip_dipdirection_to_plane_4 = Cluster(
    dip_deg=tension_crack_dip,
    dip_direction_deg=tension_crack_dip_direction,
    origin=Point(353.9549866, 506.8420105, 44.99300003))  # -> plane_2, plane_normal_2
deconstruct_plane = DeconstructPlane(Plane=dip_dipdirection_to_plane.plane_2)  # -> Origin, XAxis, YAxis, ZAxis
deconstruct_plane_2 = DeconstructPlane(Plane=dip_dipdirection_to_plane_2.plane_2)  # -> Origin, XAxis, YAxis, ZAxis

wedge_left_joint_mesh = ClusterInput()
wedge_right_joint_mesh = ClusterInput()
wedge_slope_face_mesh = ClusterInput()
wedge_upper_face_mesh = ClusterInput()
wedge_right_joint_mesh_2 = Mesh(wedge_right_joint_mesh)
wedge_left_joint_mesh_2 = Mesh(wedge_left_joint_mesh)
wedge_slope_face_mesh_2 = Mesh(wedge_slope_face_mesh)
wedge_upper_face_mesh_2 = Mesh(wedge_upper_face_mesh)
area = Area(Geometry=wedge_left_joint_mesh_2)  # -> Area, Centroid
area_2 = Area(Geometry=wedge_slope_face_mesh_2)  # -> Area, Centroid
area_3 = Area(Geometry=wedge_right_joint_mesh_2)  # -> Area, Centroid
area_4 = Area(Geometry=wedge_upper_face_mesh_2)  # -> Area, Centroid

# ---- group: Wedge rock properties
area_of_tension_crack = ClusterInput()  # m2
unit_weight_of_rock = ClusterInput()  # MN/m3
wedge_volume = ClusterInput()  # m3
vertical_height_of_line_of_intersection = ClusterInput()  # m

# ---- group: Joint properties
cohesion_of_joint_1 = ClusterInput()  # MPa
friction_angle_of_joint_1 = ClusterInput()  # degree
cohesion_of_joint_2 = ClusterInput()
friction_angle_of_joint_2 = ClusterInput()  # degree

# ---- group: Seismic
direction_of_seismic_force = ClusterInput()
k = ClusterInput()

# ---- group: External Forces
individual_external_force_vectors = ClusterInput()

# ---- group: Water
joint_water_pressure = ClusterInput()  # No water pressure = 0 Constant water pressure = 1 Filled pressure (No Tension Crack) = 2 Filled pressure (With Tension Crack) = 3
percentage_fill = ClusterInput()  # 0 to 100.
constant_pressure_on_joint_1 = ClusterInput()  # MPa
constant_pressure_on_joint_2 = ClusterInput()  # MPa
constant_pressure_on_tension_crack = ClusterInput()  # MPa
percentage_fill_2 = Number(percentage_fill)
joint_water_pressure_2 = Integer(joint_water_pressure)

# ---- group: Bolt
capcaity_of_active_bolt = ClusterInput()  # MN
unit_direction_of_active_bolt = ClusterInput()
capacity_of_passive_bolt = ClusterInput()  # MN
unit_direction_of_passive_bolt = ClusterInput()

# ---- group: Shotcrete
trace_length_of_joint_1_on_slope_face = ClusterInput()  # m
trace_length_of_joint_2_on_slope_face = ClusterInput()  # m
shotcrete_thickness = ClusterInput()  # m
shotcrete_shear_strength = ClusterInput()  # MPa

# ---- group: Active support pressure
active_pressure_magnitude_on_slope_face = ClusterInput()  # MPa
trend_plunge_of_active_slope_pressure = ClusterInput()
active_pressure_magnitude_on_upper_face = ClusterInput()  # MPa
trend_plunge_of_active_upper_face_pressu = ClusterInput()

# ---- group: Passive support pressure
passive_pressure_magnitude_on_slope_face = ClusterInput()  # MPa
trend_plunge_of_passive_slope_pressure = ClusterInput()
passive_pressure_magnitude_on_upper_face = ClusterInput()  # MPa
trend_plunge_of_passive_upper_face_press = ClusterInput()

# ---- group: 3.1k - Active Bolt Force Vector
e_cap_bolt_active = Vector(unitize(unit_direction_of_active_bolt))
c_active = Number(capcaity_of_active_bolt)
multiplication = Multiplication(A=c_active, B=e_cap_bolt_active)
mass_addition = MassAddition(Input=multiplication)  # -> Result, PartialResults
b_a = Vector(mass_addition.Result)

# ---- group: 3.1b - Wedge Weight Vector
gamma_r = Number(unit_weight_of_rock)
g_cap = Vector("{0,0,-1}")
V = Number(wedge_volume)
expression = Expression(gamma_r=gamma_r, V=V, g_cap=g_cap, Expression="(gamma_r*V)•g_cap")
W = Vector(expression)

# ----
p_s_active = Number(active_pressure_magnitude_on_slope_face)

# ---- group: 3.1c - External Force Vector
c_i = Vector(individual_external_force_vectors)
mass_addition_2 = MassAddition(Input=flatten(c_i))  # -> Result, PartialResults
C = Vector(mass_addition_2.Result)

# ----
p_u_active = Number(active_pressure_magnitude_on_upper_face)

# ---- group: 3.1d - Pressure Force (Active) Vector
n_cap_s_active = Vector(unitize(trend_plunge_of_active_slope_pressure))
n_cap_u_active = Vector(unitize(trend_plunge_of_active_upper_face_pressu))
a_s = Number(area_2.Area)
a_u = Number(area_4.Area)
_3_1d_pressure_force_active_vector = Expression(
    p_s_active=p_s_active,
    a_s=a_s,
    n_cap_s_active=n_cap_s_active,
    p_u_active=p_u_active,
    a_u=a_u,
    n_cap_u_active=n_cap_u_active,
    Expression="p_s_active*a_s*n_cap_s_active+p_u_active*a_u*n_cap_u_active")
X = Vector(_3_1d_pressure_force_active_vector)

# ---- group: 3.1j - Seismic Force Vector
e_cap_seismic = Vector(direction_of_seismic_force)
gamma_r_2 = Number(gamma_r)
# Pond Water Pressure not included.
k_2 = Number(k)
expression_2 = Expression(k=k_2, gamma_r=gamma_r_2, V=V, e_cap_seismic=e_cap_seismic, Expression="(k*gamma_r*V)•e_cap_seismic")
E = Vector(expression_2)

# ---- group: 3.1e - Constant Pressure on Each Joint / Left joint
n_cap_1 = Vector(unitize(dip_dipdirection_to_plane.plane_normal_2))
u_1 = Number(constant_pressure_on_joint_1)
a_1 = Number(area.Area)

# ---- group: 3.1e - Constant Pressure on Each Joint / Right joint
n_cap_2 = Vector(unitize(dip_dipdirection_to_plane_2.plane_normal_2))
u_2 = Number(constant_pressure_on_joint_2)
a_2 = Number(area_3.Area)

# ---- group: 3.1e - Constant Pressure on Each Joint / Tension crack
n_cap_t = Vector(unitize(dip_dipdirection_to_plane_4.plane_normal_2))
u_t = Number(constant_pressure_on_tension_crack)
a_t = Number(area_of_tension_crack)

# ---- group: Right joint
n_cap_2_2 = Vector(n_cap_2)
a_2_2 = Number(a_2)

# ----
p = Number(percentage_fill_2)

# ---- group: Left joint
a_1_2 = Number(a_1)
n_cap_1_2 = Vector(n_cap_1)

n_cap_1_3 = Vector(n_cap_1)
a_1_3 = Number(a_1)

# ----
gamma_w = Number("0.00981")
h_w = Number(vertical_height_of_line_of_intersection)

# ---- group: Right joint
n_cap_2_3 = Vector(n_cap_2)
a_2_3 = Number(a_2)

# ---- group: Tension Crack
a_t_2 = Number(a_t)
n_cap_t_2 = Vector(n_cap_t)

# ----
expression_3 = Expression(u_2=u_2, a_2=a_2, n_cap_2=n_cap_2, Expression="u_2*a_2*n_cap_2")
expression_4 = Expression(u_1=u_1, a_1=a_1, n_cap_1=n_cap_1, Expression="u_1*a_1*n_cap_1")
expression_5 = Expression(u_t=u_t, a_t=a_t, n_cap_t=n_cap_t, Expression="u_t*a_t*n_cap_t")

# ---- group: 3.1e - Constant Pressure on Each Joint
mass_addition_3 = MassAddition(Input=flatten([expression_4, expression_3, expression_5]))  # -> Result, PartialResults
U = Vector(mass_addition_3.Result)

# ---- group: 3.2b - Pressure Force (Passive) Vector
n_cap_s_passive = Vector(unitize(trend_plunge_of_passive_slope_pressure))
n_cap_u_passive = Vector(unitize(trend_plunge_of_passive_upper_face_press))
p_s_passive = Number(passive_pressure_magnitude_on_slope_face)
p_u_passive = Number(passive_pressure_magnitude_on_upper_face)
_3_1d_pressure_force_active_vector_2 = Expression(
    p_s_passive=p_s_passive,
    a_s=a_s,
    n_cap_s_passive=n_cap_s_passive,
    p_u_passive=p_u_passive,
    a_u=a_u,
    n_cap_u_passive=n_cap_u_passive,
    Expression="p_s_passive*a_s*n_cap_s_passive+p_u_passive*a_u*n_cap_u_passive")
H = Vector(_3_1d_pressure_force_active_vector_2)

# ---- group: 3.2d - Passive Bolt Force Vector
e_cap_bolt_passive = Vector(unitize(unit_direction_of_passive_bolt))
c_passive = Number(capacity_of_passive_bolt)
multiplication_2 = Multiplication(A=c_passive, B=e_cap_bolt_passive)
mass_addition_4 = MassAddition(Input=multiplication_2)  # -> Result, PartialResults
b_p = Vector(mass_addition_4.Result)

# ---- group: 3.2c Shotcrete Shear Resistance
n_cap_s = Vector(unitize(dip_dipdirection_to_plane_3.plane_normal_2))
l_1 = Number(trace_length_of_joint_1_on_slope_face)
t = Number(shotcrete_thickness)
tau_s = Number(shotcrete_shear_strength)
l_2 = Number(trace_length_of_joint_2_on_slope_face)
expression_6 = Expression(L_1=l_1, L_2=l_2, t=t, tau_s=tau_s, n_cap_s=n_cap_s, Expression="(L_1+L_2)*t*tau_s*n_cap_s")
Y = Vector(expression_6)

# ---- group: 3.1a - Active Force Vector / 3.2a - Passive Force Vector
# 3.2 Passive Force Vector
H_2 = Vector(H)
Y_2 = Vector(Y)
b_p_2 = Vector(b_p)
expression_7 = Expression(H=H_2, Y=Y_2, B_p=b_p_2, Expression="H+Y+B_p")
P = Vector(expression_7)

# ---- group: 3.1a - Active Force Vector
b_a_2 = Vector(b_a)
# 3.1 Active Force Vector
W_2 = Vector(W)
C_2 = Vector(C)
X_2 = Vector(X)
E_2 = Vector(E)

# ---- group: 3.1g - Gravitational Pressure (With Tension Crack)
expression_8 = Expression(p=p, gamma_w=gamma_w, H_w=h_w, Expression="(p/100)³*gamma_w*H_w")
mass_multiplication = MassMultiplication(Input=flatten([a_1_3, expression_8, n_cap_1_3]))  # -> Result, PartialResults
mass_multiplication_2 = MassMultiplication(Input=flatten([expression_8, a_2_3, n_cap_2_3]))  # -> Result, PartialResults
mass_multiplication_3 = MassMultiplication(Input=flatten([a_t_2, expression_8, n_cap_t_2]))  # -> Result, PartialResults
mass_addition_5 = MassAddition(Input=flatten([mass_multiplication.Result, mass_multiplication_2.Result, mass_multiplication_3.Result]))  # -> Result, PartialResults

# ----
multiplication_3 = Multiplication(A=mass_addition_5.Result, B="1/3")

# ---- group: 3.1g - Gravitational Pressure (With Tension Crack) (continued)
U_2 = Vector(multiplication_3)

# ---- group: 3.1f - Gravitational Pressure (No Tension Crack)
expression_9 = Expression(p=p, gamma_w=gamma_w, H_w=h_w, Expression="(p/100)³*gamma_w*H_w")
mass_multiplication_4 = MassMultiplication(Input=flatten([a_1_2, expression_9, n_cap_1_2]))  # -> Result, PartialResults
mass_multiplication_5 = MassMultiplication(Input=flatten([a_2_2, expression_9, n_cap_2_2]))  # -> Result, PartialResults
mass_addition_6 = MassAddition(Input=flatten([mass_multiplication_4.Result, mass_multiplication_5.Result]))  # -> Result, PartialResults

# ----
multiplication_4 = Multiplication(A=mass_multiplication_4.Result, B="1/6")
multiplication_5 = Multiplication(A=mass_multiplication_5.Result, B="1/6")
multiplication_6 = Multiplication(A=mass_addition_6.Result, B="1/6")
vector_length = VectorLength(Vector=multiplication_4)
vector_length_2 = VectorLength(Vector=multiplication_5)

# ---- group: 3.1f - Gravitational Pressure (No Tension Crack) (continued)
U_3 = Vector(multiplication_6)

# ----
joint_1_water_force = Panel(vector_length)
joint_1_water_force_2 = Panel(vector_length_2)
pick_n_choose = PickNChoose(Pattern=joint_water_pressure_2, Stream0="{0,0,0}", Stream1=U, Stream2=U_3, Stream3=U_2)
U_4 = Vector(pick_n_choose)

# ---- group: 3.1a - Active Force Vector (continued)
U_5 = Vector(U_4)
expression_10 = Expression(W=W_2, C=C_2, X=X_2, U=U_5, E=E_2, B_a=b_a_2, Expression="W+C+X+U+E+B_a")
A = Vector(expression_10)

# ---- group: Case 1
expression_11 = Expression(A=A, n_cap_1=n_cap_1, Expression="A•n_cap_1")
case1 = Number(expression_11)

# ---- group: Case 2
expression_12 = Expression(A=A, n_cap_2=n_cap_2, Expression="A•n_cap_2")
case2 = Number(expression_12)

# ---- group: 4a - Lifting
# 4. Sliding Direction
A_2 = Vector(A)
s_cap_0 = Vector(unitize(A_2))

# ---- group: Case 3
expression_13 = Expression(A=A, W=W, Expression="A•W")
case3 = Number(expression_13)

# ---- group: 4b - Sliding on a Single Face
expression_14 = Expression(n_cap_1=n_cap_1, A=A, Expression="(n_cap_1┴A)┴n_cap_1")
expression_15 = Expression(n_cap_2=n_cap_2, A=A, Expression="(n_cap_2┴A)┴n_cap_2")
s_cap_1 = Vector(unitize(expression_14))
s_cap_2 = Vector(unitize(expression_15))

# ---- group: Case 5
expression_16 = Expression(s_cap_2=s_cap_2, n_cap_1=n_cap_1, Expression="s_cap_2•n_cap_1")
case5 = Number(expression_16)

# ---- group: Case 4
expression_17 = Expression(s_cap_1=s_cap_1, n_cap_2=n_cap_2, Expression="s_cap_1•n_cap_2")
case4 = Number(expression_17)

# ----
# 1 = Lifting Wedge
# 2 = Sliding on Joint 1
# 3 = Sliding on Joint 2
# 4 = Sliding on the Intersection of Joint 1 and Joint 2
expression_18 = Expression(case1=case1, case2=case2, case3=case3, Expression="if(case1>0, 1, 0)*if(case2>0, 1, 0)*if(case3<0, 1, 0)*1")
expression_19 = Expression(case1=case1, case4=case4, Expression="if(case1≤0, 1, 0)*if(case4>0, 1, 0)*2")
expression_20 = Expression(case2=case2, case5=case5, Expression="if(case2≤0, 1, 0)*if(case5>0, 1, 0)*3")
expression_21 = Expression(case4=case4, case5=case5, Expression="if(case4≤0, 1, 0)*if(case5≤0, 1, 0)*4")
mass_addition_7 = MassAddition(Input=flatten([expression_18, expression_21, expression_19, expression_20]))  # -> Result, PartialResults
sliding_direction = Integer(mass_addition_7.Result)

# ----
# "the force vector, F, is generally either
# the active or the passive resultant force vector".
# 
# How to determine this?
expression_22 = Expression(A=A, P=P, Expression="A+P")
F = Vector(expression_22)

# ---- group: 5a to 5d - Normal Force
# 5. Normal Force
sliding_direction_2 = Integer(sliding_direction)
expression_23 = Expression(
    F=F,
    n_cap_1=n_cap_1,
    n_cap_2=n_cap_2,
    Expression="-((F┴n_cap_2)•(n_cap_1┴n_cap_2))/((n_cap_1┴n_cap_2)•(n_cap_1┴n_cap_2))")
expression_24 = Expression(
    F=F,
    n_cap_1=n_cap_1,
    n_cap_2=n_cap_2,
    Expression="-((F┴n_cap_1)•(n_cap_2┴n_cap_1))/((n_cap_2┴n_cap_1)•(n_cap_2┴n_cap_1))")
expression_25 = Expression(F=F, n_cap_1=n_cap_1, Expression="-F•n_cap_1")
expression_26 = Expression(F=F, n_cap_2=n_cap_2, Expression="-F•n_cap_2")
_0 = Number(0)
n_1 = Number(expression_23)
n_2 = Number(expression_24)
stream_filter = StreamFilter(Gate=sliding_direction_2, Stream0=_0, Stream1=_0, Stream2=expression_25, Stream3=_0, Stream4=n_1)
stream_filter_2 = StreamFilter(Gate=sliding_direction_2, Stream0=_0, Stream1=_0, Stream2=_0, Stream3=expression_26, Stream4=n_2)
n_2_2 = Number(stream_filter_2)
n_1_2 = Number(stream_filter)

# ---- group: 6.1a - Normal stress on Each Joint
expression_27 = Expression(N_2=n_2_2, a_2=a_2, Expression="N_2/a_2")
expression_28 = Expression(N_1=n_1_2, a_1=a_1, Expression="N_1/a_1")
sigma_n_2 = Number(expression_27)
sigma_n_1 = Number(expression_28)

# ---- group: 6.1b -Shear Strength of Each Joint (Mohr-Coulomb)
phi_1 = Number(friction_angle_of_joint_1)
phi_2 = Number(friction_angle_of_joint_2)
c_1 = Number(cohesion_of_joint_1)
c_2 = Number(cohesion_of_joint_2)
radians = Radians(Degrees=phi_1)
radians_2 = Radians(Degrees=phi_2)
expression_29 = Expression(c_1=c_1, sigma_n_1=sigma_n_1, Phi_1=radians, Expression="c_1+sigma_n_1*tan(Phi_1)")
expression_30 = Expression(c_2=c_2, sigma_n_2=sigma_n_2, Phi_2=radians_2, Expression="c_2+sigma_n_2*tan(Phi_2)")
tau_2 = Number(expression_30)
tau_1 = Number(expression_29)
stream_filter_3 = StreamFilter(Gate=sliding_direction_2, Stream0=_0, Stream1=_0, Stream2=tau_1, Stream3=_0, Stream4=tau_1)
stream_filter_4 = StreamFilter(Gate=sliding_direction_2, Stream0=_0, Stream1=_0, Stream2=_0, Stream3=tau_2, Stream4=tau_2)
tau_1_2 = Number(stream_filter_3)
tau_2_2 = Number(stream_filter_4)

# ----
s_cap_0_2 = Vector(s_cap_0)

# ---- group: 7b - Lifting Factor of Safety
expression_31 = Expression(P=P, A=A, s_cap_0=s_cap_0_2, Expression="(-P•s_cap_0)/(A•s_cap_0)")
fs_f = Number(expression_31)

# ---- group: 4c - Sliding on a Two Faces
expression_32 = Expression(n_cap_1=n_cap_1, n_cap_2=n_cap_2, A=A, Expression="(n_cap_1┴n_cap_2)•A")

# ----
expression_33 = Expression(x=expression_32, Expression="if(x>0,1,if(x<0,-1,0))")

# ---- group: 4c - Sliding on a Two Faces (continued)
expression_34 = Expression(n_cap_1=n_cap_1, n_cap_2=n_cap_2, sign=expression_33, Expression="(n_cap_1┴n_cap_2)*sign")
s_cap_12 = Vector(unitize(expression_34))

# ---- group: Sliding direction
s_cap_1_2 = Vector(s_cap_1)
s_cap_2_2 = Vector(s_cap_2)
# 6. Shear Strength
s_cap_12_2 = Vector(s_cap_12)
stream_filter_5 = StreamFilter(Gate=sliding_direction_2, Stream2=s_cap_1_2, Stream3=s_cap_2_2, Stream4=s_cap_12_2)
s_cap = Vector(stream_filter_5)

# ---- group: Driving force
A_3 = Expression(A=A, s_cap=s_cap, Expression="A•s_cap")

# ---- group: theta_1
angle = Angle(VectorA=s_cap, VectorB=deconstruct_plane.YAxis)  # -> Angle, Reflex
theta_1 = Number(angle.Angle)

# ----
driving_force = Panel(A_3)

# ---- group: theta_2
angle_2 = Angle(VectorA=s_cap, VectorB=deconstruct_plane_2.YAxis)  # -> Angle, Reflex
theta_2 = Number(angle_2.Angle)

# ---- group: 6.1e - Resisting Force due to Shear Strength
# *** cos(theta_1) or cos(theta_2) not included as written in the Theory Manual?
expression_35 = Expression(tau_2=tau_2_2, a_2=a_2, theta_2=theta_2, Expression="tau_2*a_2")
expression_36 = Expression(tau_1=tau_1_2, a_1=a_1, theta_1=theta_1, Expression="tau_1*a_1")
j_2 = Number(expression_35)
j_1 = Number(expression_36)

# ----
addition = Addition(A=j_1, B=j_2)
resisting_force = Panel(addition)

# ----
# Returns FS = 1 if s_cap is {0,0,0}
vector_length_3 = VectorLength(Vector=s_cap)
equality = Equality(FirstNumber=vector_length_3, SecondNumber="0")  # -> Equality, Inequality
sliding_direction_3 = ClusterOutput(sliding_direction)
integer = Integer(equality.Equality)

# ---- group: 7d - Supported Factor of Safety
# New definition of FS (Li & Høien 2023)
expression_37 = Expression(
    F=F,
    H=H,
    Y=Y,
    B_p=b_p,
    B_a=b_a,
    X=X,
    W=W,
    C=C,
    U=U_4,
    E=E,
    s_cap=s_cap,
    J_1=j_1,
    J_2=j_2,
    Expression="(J_1+J_2-((H+Y+C+B_p+B_a+X)•s_cap))/((W+U+E)•s_cap)")
fs_s = Number(expression_37)

# ---- group: 7a - Factor of Safety
# 7. Factor of Safety
fs_f_2 = Number(fs_f)
fs_u = Number()
fs_s_2 = Number(fs_s)
entwine = Entwine(Branch00=fs_f_2, Branch01=fs_u, Branch02=fs_s_2, Branch03=integer, FlattenInputs=True)  # -> flatten(Result)
sort_list = SortList(Keys=entwine, ValuesValuesA=entwine)  # -> Keys, reverse(ValuesValuesA)
first_last = FirstLast(List=sort_list.ValuesValuesA)  # -> FirstValue, LastValue
fs = Number(first_last.FirstValue)

# ----
factor_of_safety = ClusterOutput(fs)
